# Grasshopper definition 11_10_24.gh (Grasshopper 1.0.8)
# plug-ins: Aggregations, RhinoCodePluginGH, Heteroptera, Pufferfish, Human, MetaHopper, Palette, Telepathy

# ----
# GH COLORS
boolean_toggle = BooleanToggle(True)
palette = Palette(
    ModeCustomStandard=boolean_toggle,
    Component_Normal_Deselected_Fill_Color=ColourSwatch(SwatchColor=RGB(235, 235, 235)),
    Component_Normal_Deselected_Edge_Color=ColourSwatch(SwatchColor=RGB(25, 105, 86)),
    Component_Normal_Deselected_Text_Color=ColourSwatch(SwatchColor=RGB(0, 0, 0)),
    Component_Normal_Selected_Fill_Color=ColourSwatch(SwatchColor=RGB(120, 176, 109)),
    Component_Normal_Selected_Edge_Color=RGB(0, 50, 0),
    Component_Normal_Selected_Text_Color=RGB(0, 25, 0),
    Component_Hidden_Deselected_Fill_Color=ColourSwatch(SwatchColor=RGB(145, 145, 145)),
    Component_Hidden_Deselected_Edge_Color=ColourSwatch(SwatchColor=RGB(0, 0, 0)),
    Component_Hidden_Deselected_Text_Color=ColourSwatch(SwatchColor=RGB(64, 63, 63)),
    Component_Hidden_Selected_Fill_Color=ColourSwatch(SwatchColor=RGB(120, 176, 109)),
    Component_Hidden_Selected_Edge_Color=RGB(0, 35, 0),
    Component_Hidden_Selected_Text_Color=RGB(0, 25, 0),
    Component_Disabled_Deselected_Fill_Color=ColourSwatch(SwatchColor=RGB(156, 81, 81)),
    Component_Disabled_Deselected_Edge_Color=ColourSwatch(SwatchColor=RGB(0, 0, 0)),
    Component_Disabled_Deselected_Text_Color=ColourSwatch(SwatchColor=RGB(227, 227, 227)),
    Component_Disabled_Selected_Fill_Color=ColourSwatch(SwatchColor=RGB(199, 178, 74)),
    Component_Disabled_Selected_Edge_Color=RGB(40, 70, 40),
    Component_Disabled_Selected_Text_Color=RGB(75, 100, 65),
    Component_Warning_Deselected_Fill_Color=RGB(255, 140, 20),
    Component_Warning_Deselected_Edge_Color=RGB(80, 10, 0),
    Component_Warning_Deselected_Text_Color=RGB(0, 0, 0),
    Component_Warning_Selected_Fill_Color=RGB(185, 205, 0),
    Component_Warning_Selected_Edge_Color=RGB(0, 50, 0),
    Component_Warning_Selected_Text_Color=RGB(0, 0, 0),
    Component_Error_Deselected_Fill_Color=RGB(200, 0, 0),
    Component_Error_Deselected_Edge_Color=RGB(60, 0, 0),
    Component_Error_Deselected_Text_Color=RGB(0, 0, 0),
    Component_Error_Selected_Fill_Color=RGB(125, 155, 0),
    Component_Error_Selected_Edge_Color=RGB(0, 50, 0),
    Component_Error_Selected_Text_Color=RGB(255, 255, 255),
    Component_Label_Deselected_Fill_Color=RGB(50, 50, 50),
    Component_Label_Deselected_Edge_Color=RGB(0, 0, 0),
    Component_Label_Deselected_Text_Color=RGB(255, 255, 255),
    Component_Label_Selected_Fill_Color=RGB(25, 60, 25),
    Component_Label_Selected_Edge_Color=RGB(0, 35, 0),
    Component_Label_Selected_Text_Color=RGB(190, 250, 180),
    Galapagos_Deselected_Fill_Color=RGB(255, 0, 125),
    Galapagos_Deselected_Edge_Color=RGB(100, 0, 50),
    Galapagos_Selected_Fill_Color=RGB(160, 210, 30),
    Galapagos_Selected_Edge_Color=RGB(0, 50, 0),
    Wire_Normal_Color=ColourSwatch(SwatchColor=RGB(0, 0, 0)),
    Wire_Empty_Color=RGBA(255, 60, 0, 180),
    Wire_Selected_Start_Color=ColourSwatch(SwatchColor=RGB(126, 224, 52)),
    Wire_Selected_End_Color=ColourSwatch(SwatchColor=RGB(35, 89, 41)),
    Panel_Default_Color=ColourSwatch(SwatchColor=RGB(255, 255, 255)),
    Group_Default_Color=ColourSwatch(SwatchColor=RGB(116, 178, 176)),
    Canvas_Background_Color=ColourSwatch(SwatchColor=RGB(196, 196, 196)),
    Canvas_Gridline_Color=RGBA(0, 0, 0, 30),
    Canvas_Gridline_Width=150,
    Canvas_Gridline_Height=50,
    Canvas_Edge_Color=RGB(0, 0, 0),
    Canvas_Shadow_Color=RGBA(0, 0, 0, 80),
    Canvas_Shadow_Size=30,
    MonochromaticOnOff=Toggle(False),
    Monochromatic_Color=RGB(212, 208, 200))

# ----
# Robot Setup
group_toggle = GroupToggle(ToggleActive=True, ToggleVisible=False)  # disabled

value_list = ValueList({"UR5 A": 0, "UR5 B": 1, "COMAU": 2, "COWORKING": 3}, selected="UR5 A")
value_list_2 = ValueList({"UR5 A": 0, "UR5 B": 1, "COMAU": 2, "COWORKING": 3}, selected="UR5 B")
panel = Panel("""UR5 A
COMAU""")
stream_filter = StreamFilter(Gate=value_list, Stream0="UR5 A", Stream1="UR5 B", Stream2="COMAU", Stream3=panel)
stream_filter_2 = StreamFilter(Gate=value_list_2, Stream0="UR5 A", Stream1="UR5 B", Stream2="COMAU", Stream3=panel)
robot_1 = RemoteSender(stream_filter)
robot_2 = RemoteSender(stream_filter_2)

value_list_3 = ValueList({"UR5 A": 0, "UR5 B": 1, "COMAU": 2, "COWORKING": 3}, selected="COMAU")

# ----
# Table Points
number_slider = Slider(20, range=0..100)
tablepoints = Point([<point referenced from the Rhino model> x1683])
point = Point([<point referenced from the Rhino model> x1683])
unit_z = UnitZ(Factor="20")
tablepointscomau = RemoteSender(point)
tablepointsur5 = RemoteSender(tablepoints)
unit_z_2 = UnitZ(Factor=number_slider)
move = Move(Geometry=tablepointscomau, Motion=unit_z)  # -> Geometry, Transform
move_2 = Move(Geometry=tablepointsur5, Motion=unit_z_2)  # -> Geometry, Transform
point_list = PointList(Points=move.Geometry, Size=Slider(10, range=1..10))  # disabled
point_list_2 = PointList(Points=move_2.Geometry, Size=Slider(10, range=1..10))  # disabled

stream_filter_3 = StreamFilter(Gate=value_list_3, Stream0="UR5 A", Stream1="UR5 B", Stream2="COMAU", Stream3=panel)
robot_3 = RemoteSender(stream_filter_3)

dynamic_geometry_pipeline = DynamicGeometryPipeline(
    LayerFilter="Structure::Lines",
    TypeFilter="Curve",
    NameFilter="*",
    GroupByLayer=False,
    GroupByType=False,
    IncludeHidden=True,
    IncludeLocked=True,
    enableFullPath=True,
    listenToAttributes=True)
dynamic_geometry_pipeline_2 = DynamicGeometryPipeline(
    LayerFilter="Structure::Rigid",
    TypeFilter="Point",
    NameFilter="*",
    GroupByLayer=False,
    GroupByType=False,
    IncludeHidden=True,
    IncludeLocked=True,
    enableFullPath=True,
    listenToAttributes=True)
dynamic_geometry_pipeline_3 = DynamicGeometryPipeline(
    LayerFilter="Structure::Start",
    TypeFilter="Point",
    NameFilter="*",
    GroupByLayer=False,
    GroupByType=False,
    IncludeHidden=True,
    IncludeLocked=True,
    enableFullPath=True,
    listenToAttributes=True)

robot_3_2 = RemoteReceiver(robot_3)
python_3_script = Python3Script(RobotName=robot_3_2)  # -> X_Axis, Y_Axis, Z_Axis, RobotPosition, JointPoints, JointLines
# ---------- python_3_script: Python ----------
import robolink as rl  # RoboDK API
import robodk as rdk
import Rhino.Geometry as rg
import math
import numpy as np

# === Inputs ===
# RobotName: Name of the robot in RoboDK (e.g., "COMAU NJ 60-2.2")

# Initialize outputs
RobotPosition = None
X_Axis = None
Y_Axis = None
Z_Axis = None
JointPoints = []
JointLines = []
SuccessMessage = ""

# Initialize RoboDK connection
RDK = rl.Robolink()

# Get the robot by name
robot = RDK.Item(RobotName, rl.ITEM_TYPE_ROBOT)

if not robot.Valid():
    SuccessMessage = f"Error: Could not find {RobotName} in RoboDK."
else:
    SuccessMessage = f"Connected to {RobotName} in RoboDK."

    # Get the robot's base pose
    robot_base = robot.Parent()
    if robot_base.Valid():
        base_pose = robot_base.Pose()
    else:
        base_pose = rdk.Mat()

    # Get the robot's current joint angles (degrees)
    joints_deg = robot.Joints().list()
    # Convert joint angles to radians
    joints_rad = [math.radians(angle) for angle in joints_deg]

    # COMAU NJ 60-2.2 DH parameters (in millimeters and radians)
    d1 = 740
    a2 = 600
    a3 = 1200
    d4 = 1350
    d6 = 260

    # DH parameters for COMAU NJ 60-2.2
    alpha = [math.pi/2, 0, 0, math.pi/2, -math.pi/2, 0]
    a = [0, a2, a3, 0, 0, 0]
    d = [d1, 0, 0, d4, 0, d6]
    theta = [
        joints_rad[0],
        joints_rad[1],
        joints_rad[2],
        joints_rad[3],
        joints_rad[4],
        joints_rad[5],
    ]

    # Initialize the base transformation matrix
    T_base = np.array(base_pose.rows)
    # Ensure T_base is a 4x4 matrix
    if T_base.shape != (4, 4):
        SuccessMessage += " Error: Base pose matrix is not 4x4."
    else:
        # Initialize the transformation matrix
        T = T_base

        # Initialize joint positions list
        JointPoints = []

        # Store transformation matrices for each joint
        T_matrices = []

        for i in range(6):  # Six joints
            # DH parameters for current joint
            ai = a[i]
            alphai = alpha[i]
            di = d[i]
            thetai = theta[i]

            # Compute transformation matrix using DH parameters
            cos_theta = math.cos(thetai)
            sin_theta = math.sin(thetai)
            cos_alpha = math.cos(alphai)
            sin_alpha = math.sin(alphai)

            T_joint = np.array([
                [cos_theta, -sin_theta * cos_alpha,  sin_theta * sin_alpha, ai * cos_theta],
                [sin_theta,  cos_theta * cos_alpha, -cos_theta * sin_alpha, ai * sin_theta],
                [0,          sin_alpha,              cos_alpha,             di],
                [0,          0,                      0,                     1]
            ])

            # Update the overall transformation matrix
            T = np.dot(T, T_joint)

            # Save the transformation matrix for this joint
            T_matrices.append(T.copy())

            # Extract the position of the current joint
            position = T[:3, 3]

            # No conversion needed since we're working in millimeters
            joint_point = rg.Point3d(position[0], position[1], position[2])
            JointPoints.append(joint_point)

        # Create lines connecting the joints
        JointLines = []
        for i in range(1, len(JointPoints)):
            line = rg.Line(JointPoints[i - 1], JointPoints[i])
            JointLines.append(line)

        # Optionally, connect the base to the first joint
        if JointPoints:
            base_position = T_base[:3, 3]
            base_point = rg.Point3d(base_position[0], base_position[1], base_position[2])
            line = rg.Line(base_point, JointPoints[0])
            JointLines.insert(0, line)

        # Fetch the robot's pose relative to its base
        robot_pose = robot.Pose()

        # Compute the absolute pose of the TCP in the world coordinate system
        absolute_pose = base_pose * robot_pose

        # Extract position from the absolute pose
        position = absolute_pose.Pos()  # [x, y, z]

        # Create Rhino point for the robot's TCP position
        RobotPosition = rg.Point3d(position[0], position[1], position[2])

        # Extract orientation vectors from the rotation matrix of the absolute pose
        x_vector = rg.Vector3d(absolute_pose[0,0], absolute_pose[1,0], absolute_pose[2,0])
        y_vector = rg.Vector3d(absolute_pose[0,1], absolute_pose[1,1], absolute_pose[2,1])
        z_vector = rg.Vector3d(absolute_pose[0,2], absolute_pose[1,2], absolute_pose[2,2])

        # Scale vectors for visualization purposes
        scale_factor = 200  # Adjust as needed
        x_vector *= scale_factor
        y_vector *= scale_factor
        z_vector *= scale_factor

        # Create lines representing the robot's TCP axes
        X_Axis = rg.Line(RobotPosition, rg.Point3d(RobotPosition.X + x_vector.X, RobotPosition.Y + x_vector.Y, RobotPosition.Z + x_vector.Z))
        Y_Axis = rg.Line(RobotPosition, rg.Point3d(RobotPosition.X + y_vector.X, RobotPosition.Y + y_vector.Y, RobotPosition.Z + y_vector.Z))
        Z_Axis = rg.Line(RobotPosition, rg.Point3d(RobotPosition.X + z_vector.X, RobotPosition.Y + z_vector.Y, RobotPosition.Z + z_vector.Z))

        # Optionally, connect the last joint to the TCP
        if JointPoints and RobotPosition:
            line = rg.Line(JointPoints[-1], RobotPosition)
            JointLines.append(line)
# ---------- end python_3_script ----------

tablepointscomau_2 = RemoteReceiver(tablepointscomau)
deconstruct = Deconstruct(Point=tablepointscomau_2)  # -> XComponent, YComponent, ZComponent
concatenate = Concatenate(
    FragmentA="{",
    FragmentB=deconstruct.XComponent,
    FragmentA_2=",",
    FragmentB_2=deconstruct.YComponent,
    FragmentA_3=",",
    FragmentA_4=deconstruct.ZComponent,
    FragmentA_5="}")  # -> flatten(Result)

number_slider_2 = Slider(55, range=0..1683)
tablepointsur5_2 = RemoteReceiver(tablepointsur5)
data_dam = DataDam(DataDataA=Slider(1654, range=0..1683), BufferDelay=10000000, BufferMode=0)
data_dam_2 = DataDam(DataDataA=Slider(549, range=0..1683), BufferDelay=10000000, BufferMode=0)
data_dam_3 = DataDam(DataDataA=Slider(90, range=-360..360), BufferDelay=10000000, BufferMode=0)
data_dam_4 = DataDam(DataDataA=number_slider_2, BufferDelay=10000000, BufferMode=0)
data_dam_5 = DataDam(DataDataA=Slider(180, range=-360..360), BufferDelay=10000000, BufferMode=0)
data_dam_6 = DataDam(DataDataA=Slider(0, range=-360..360), BufferDelay=10000000, BufferMode=0)
deconstruct_2 = Deconstruct(Point=tablepointsur5_2)  # -> XComponent, YComponent, ZComponent
robot_1_2 = RemoteReceiver(robot_1)
robot_2_2 = RemoteReceiver(robot_2)
robot_3_3 = RemoteReceiver(robot_3)
python_3_script_2 = Python3Script(TablePoints=tablepointscomau_2, RobotName=robot_3_3, PointIndex=data_dam_4, SetBase=Toggle(True), RotationZ=data_dam_5)  # -> out, BasePosition, SuccessMessage; inputs TablePoints: list of Point3d, PointIndex: Int32, RotationZ: Double
# ---------- python_3_script_2: Python ----------
import robolink as rl        # RoboDK API for communication 
import robodk as rdk         # RoboDK robotic simulation environment
import Rhino.Geometry as rg  # Rhino geometry for working with 3D points
import math                  # Math module for calculations

# Initialize RoboDK link
RDK = rl.Robolink()
# Ensure that RobotName is defined correctly from Grasshopper
if 'RobotName' not in globals() or not RobotName:
    raise NameError("RobotName is not defined or empty.")

# Fetch robot item by name
robot = RDK.Item(RobotName, rl.ITEM_TYPE_ROBOT)

# Ensure the robot is found in RoboDK
if not robot.Valid():
    raise NameError(f"Error: Could not find robot '{RobotName}' in RoboDK.")

# Define functions
def connect_to_robot(robot_name) -> str:
    """
    Connect to the robot using its name and return a success or error message.

    :param robot_name: The name of the robot in RoboDK.
    :return: A message indicating success or error.
    """
    robot = RDK.Item(robot_name, rl.ITEM_TYPE_ROBOT)
    if not robot.Valid():
        return f"Error: Could not find robot '{robot_name}' in RoboDK."
    else:
        return f"Connected to robot '{robot_name}' in RoboDK."


def set_robot_base(robot, x, y, z, rz_deg) -> str:
    """
    Set the robot's base at a specific point (x, y, z) with a rotation along the Z-axis.

    :param robot: The robot item in RoboDK.
    :param x: X coordinate for the base position.
    :param y: Y coordinate for the base position.
    :param z: Z coordinate for the base position.
    :param rz_deg: Rotation angle around the Z-axis in degrees.
    :return: A success or error message regarding the base setting.
    """
    rz_rad = math.radians(rz_deg)  # Convert degrees to radians
    rotation_matrix = rdk.rotz(rz_rad)  # Create a rotation matrix
    translation_matrix = rdk.transl(x, y, z)  # Create a translation matrix
    base_pose = translation_matrix * rotation_matrix  # Combine translation and rotation

    robot_base = robot.Parent()  # Get the robot's base (parent in RoboDK)

    if robot_base.Valid():
        robot_base.setPose(base_pose)  # Set the base pose
        return f"Robot '{RobotName}' base set at Point {PointIndex} with RotationZ={rz_deg} degrees successfully."
    else:
        return "Error: Could not find or access the robot base."


def get_current_base_position(robot) -> str:
    """
    Retrieve the current base position and rotation of the robot.

    :param robot: The robot item in RoboDK.
    :return: A string containing the current base position and rotation details.
    """
    robot_base = robot.Parent()  # Get the robot's base

    if robot_base.Valid():
        current_base_pose = robot_base.Pose()  # Get the current pose of the base
        current_position = current_base_pose.Pos()  # Extract position (X, Y, Z)
        rx_rad, ry_rad, rz_rad = rdk.pose_2_xyzrpy(current_base_pose)[3:]  # Get rotation angles
        rz_deg = math.degrees(rz_rad)  # Convert Z-axis rotation to degrees
        return f"Current base position: X={current_position[0]}, Y={current_position[1]}, Z={current_position[2]}, RotationZ={rz_deg} degrees"
    else:
        return "Error: Could not retrieve base position."


def validate_point_index(point_index, points_list) -> bool:
    """
    Validate whether the point index is within the bounds of the points list.

    :param point_index: The index of the point to check.
    :param points_list: The list of points.
    :return: True if the index is valid, False otherwise.
    """
    return 0 <= point_index < len(points_list)


# Function to transform Rhino Z-axis values for RoboDK
def rhino_to_robodk_coordinates(point):
    """
    Transform a Rhino point to RoboDK-compatible coordinates, ensuring correct height (Z) adjustment.
    
    :param point: A Rhino point (with X, Y, Z values).
    :return: Transformed X, Y, Z coordinates.
    """
    # Assuming that Rhino Z needs to map directly to RoboDK Z and no additional transformation is needed.
    # If a transformation is needed (for example, flipping the Z axis), apply it here.
    return point.X, point.Y, point.Z

# Main script logic
SuccessMessage = connect_to_robot(RobotName)  # Connect to the robot
if "Error" not in SuccessMessage:
    # Validate the point index
    if not validate_point_index(PointIndex, TablePoints):
        SuccessMessage = f"Error: Point index {PointIndex} is out of bounds."
    else:
        point = TablePoints[PointIndex]  # Get the point at the specified index
        x, y, z = rhino_to_robodk_coordinates(point)  # Transform Rhino coordinates to RoboDK coordinates

        # Set the base if SetBase is true, otherwise retrieve current base position
        if SetBase:
            rz_deg = RotationZ  # Get the rotation value for the base
            SuccessMessage = set_robot_base(robot, x, y, z, rz_deg)
            BasePosition = f"Base set at: X={x}, Y={y}, Z={z}, RotationZ={rz_deg} degrees"
        else:
            BasePosition = get_current_base_position(robot)
else:
    BasePosition = ""

# Output the messages
print(SuccessMessage)
print(BasePosition)
# ---------- end python_3_script_2 ----------
concatenate_2 = Concatenate(
    FragmentA="{",
    FragmentB=deconstruct_2.XComponent,
    FragmentA_2=",",
    FragmentB_2=deconstruct_2.YComponent,
    FragmentA_3=",",
    FragmentA_4=deconstruct_2.ZComponent,
    FragmentA_5="}")  # -> flatten(Result)
python_3_script_3 = Python3Script(TablePoints=concatenate_2, RobotName=robot_1_2, PointIndex=data_dam, SetBase=Toggle(True), RotationZ=data_dam_6)  # -> out, BasePosition, SuccessMessage; inputs TablePoints: list of Point3d, PointIndex: Int32, RotationZ: Double; same code as python_3_script_2
python_3_script_4 = Python3Script(TablePoints=concatenate_2, RobotName=robot_2_2, PointIndex=data_dam_2, SetBase=Toggle(False), RotationZ=data_dam_3)  # -> out, BasePosition, SuccessMessage; inputs TablePoints: list of Point3d, PointIndex: Int32, RotationZ: Double
# ---------- python_3_script_4: Python ----------
import robolink as rl       
import robodk as rdk        
import Rhino.Geometry as rg 
import math                 
SuccessMessage = ""   
BasePosition = ""     
JointPoints = []      
JointLines = []       


RDK = rl.Robolink()
robot = RDK.Item(RobotName, rl.ITEM_TYPE_ROBOT)
if not robot.Valid():
    
    SuccessMessage = f"Error: Could not find robot '{RobotName}' in RoboDK."
else:
    
    SuccessMessage = f"Connected to robot '{RobotName}' in RoboDK."

    
    if PointIndex >= len(TablePoints) or PointIndex < 0:
        SuccessMessage = f"Error: Point index {PointIndex} is out of bounds."
    else:
        
        point = TablePoints[PointIndex]
        
        
        x = float(point.X)
        y = float(point.Y)
        z = float(point.Z)
        
        
        if SetBase:
           

            
            rz_deg = RotationZ  

            
            rz_rad = math.radians(rz_deg)

           
            rotation_matrix = rdk.rotz(rz_rad)

           
            translation_matrix = rdk.transl(x, y, z)

            
            base_pose = translation_matrix * rotation_matrix

            # === End of Code for RotationZ ===

            # Get the robot's base (parent item in RoboDK)
            robot_base = robot.Parent()

            # Check if robot base is valid before setting pose
            if robot_base.Valid():
                # Set the robot base pose in RoboDK
                robot_base.setPose(base_pose)

                
                BasePosition = f"Base set at: X={x}, Y={y}, Z={z}, RotationZ={rz_deg} degrees"
                SuccessMessage = f"Robot '{RobotName}' base set at Point {PointIndex} with RotationZ={rz_deg} degrees successfully."
            else:
                
                SuccessMessage = "Error: Could not find or access the robot base."
                BasePosition = ""
        else:
            
            robot_base = robot.Parent()
            if robot_base.Valid():
                
                current_base_pose = robot_base.Pose()
                # Extract the translation components (position)
                current_position = current_base_pose.Pos()
                # Extract rotation angles around X, Y, Z axes (in radians)
                rx_rad, ry_rad, rz_rad = rdk.pose_2_xyzrpy(current_base_pose)[3:]  # Angles in radians
                # Convert rotation around Z-axis from radians to degrees
                rz_deg = math.degrees(rz_rad)
                # Update the BasePosition output with current position and rotation
                BasePosition = f"Current base position: X={current_position[0]}, Y={current_position[1]}, Z={current_position[2]}, RotationZ={rz_deg} degrees"
            else:
                # If robot base is not valid, update the BasePosition output
                BasePosition = "Error: Could not retrieve base position."
# ---------- end python_3_script_4 ----------
panel_2 = Panel(python_3_script_3.BasePosition)
panel_3 = Panel(python_3_script_3.SuccessMessage)
panel_4 = Panel(python_3_script_4.BasePosition)
panel_5 = Panel(python_3_script_4.SuccessMessage)
panel_6 = Panel(python_3_script_2.BasePosition)
panel_7 = Panel(python_3_script_2.SuccessMessage)

list_item = ListItem(List=tablepointscomau_2, Index=number_slider_2, Wrap=True)
point_2 = Point(list_item)
sphere = Sphere(Base=point_2, Radius=Slider(78, range=0..100))
custom_preview = CustomPreview(Geometry=sphere, Material=ColourSwatch(SwatchColor=RGB(117, 117, 117)))

end_points = EndPoints(Curve=python_3_script.X_Axis)  # -> Start, End
end_points_2 = EndPoints(Curve=python_3_script.Y_Axis)  # -> Start, End
end_points_3 = EndPoints(Curve=python_3_script.Z_Axis)  # -> Start, End
text_tag = TextTag(Location=end_points.End, Text="x")
text_tag_2 = TextTag(Location=end_points_2.End, Text="y")
text_tag_3 = TextTag(Location=end_points_3.End, Text="z")
panel_8 = Panel(python_3_script.JointPoints)

point_3 = Point(python_3_script.JointPoints)  # disabled
sphere_2 = Sphere(Base=point_3, Radius=Slider(50, range=0..100))  # disabled
custom_preview_2 = CustomPreview(Geometry=sphere_2, Material=ColourSwatch(SwatchColor=RGB(227, 32, 32)))  # disabled

point_4 = Point(python_3_script.RobotPosition)
sphere_3 = Sphere(Base=point_4, Radius=Slider(38, range=0..100))
custom_preview_3 = CustomPreview(Geometry=sphere_3, Material=ColourSwatch(SwatchColor=RGB(150, 150, 150)))

entwine = Entwine(Branch00=python_3_script.X_Axis, Branch01=python_3_script.Y_Axis, Branch02=python_3_script.Z_Axis, FlattenInputs=True)
entwine_2 = Entwine(
    Branch00=ColourSwatch(SwatchColor=RGB(255, 0, 0)),
    Branch01=ColourSwatch(SwatchColor=RGB(82, 255, 3)),
    Branch02=ColourSwatch(SwatchColor=RGB(17, 101, 145)),
    FlattenInputs=True)
custom_preview_lineweights = CustomPreviewLineweights(Geometry=entwine, Shader=entwine_2, Thickness=Slider(5, range=0..5), Absolute=False)

custom_preview_lineweights_2 = CustomPreviewLineweights(
    Geometry=python_3_script.JointLines,
    Shader=ColourSwatch(SwatchColor=RGB(0, 0, 0)),
    Thickness=Slider(2.7, range=0..5),
    Absolute=False)  # disabled

# ----
# Tony will fix this
# Until Monday :)
py3 = Python3Script(
    in_lines=dynamic_geometry_pipeline,
    in_rigid_points=dynamic_geometry_pipeline_2,
    in_start_point=dynamic_geometry_pipeline_3)  # -> out, assembly_steps, ordered_nodes; inputs in_lines: list of Line, in_rigid_points: list of Point3d, in_start_point: Point3d
# ---------- py3: Python ----------
import rhinoscriptsyntax as rs
import Grasshopper as gh
from Grasshopper.Kernel.Data import GH_Path
import Rhino.Geometry as rg
import networkx as nx
import numpy as np
import itertools
from itertools import combinations

class Trussemble:
    def __init__(self, lines, rigid_points, start_point):
        ## inputs
        self.lines = lines
        self.points, self.connection_tree = self.__get_line_connectivity()
        self.rigid_points = rigid_points
        self.rigid_indices = self.__get_rigid_point_indices()
        self.start_point = start_point
        ## outputs
        self.graph = self.__turn_tree_to_graph(self.connection_tree)
        self.assembly_steps = gh.DataTree[object]()
        self.processed_nodes = []

    def __average_point(self, pt1, pt2, pt3):
        # Calculate the average of the x, y, and z coordinates
        avg_x = (pt1.X + pt2.X + pt3.X) / 3
        avg_y = (pt1.Y + pt2.Y + pt3.Y) / 3
        avg_z = (pt1.Z + pt2.Z + pt3.Z) / 3

        # Return the average point as a Point3d
        average_point = rg.Point3d(avg_x, avg_y, avg_z)
        return average_point

    def __get_rigid_point_indices(self):
        rigid_indices = []
        points_array = np.array([[pt.X, pt.Y, pt.Z] for pt in self.points])

        for rigid_point in self.rigid_points:
            if rigid_point in self.points:
                rigid_indices.append(self.points.index(rigid_point))
            else:
                rigid_point_array = np.array([rigid_point.X, rigid_point.Y, rigid_point.Z])
                distances = np.linalg.norm(points_array - rigid_point_array, axis=1)
                rigid_idx = np.argmin(distances)
                rigid_indices.append(rigid_idx)
        return rigid_indices

    def __get_line_connectivity(self):
        lines = self.lines
        connectivity_tree = gh.DataTree[object]()
        unique_points = {}
        point_index = 0

        for line_index, line in enumerate(lines):
            # Get the start and end points of the line
            start_point = line.From
            end_point = line.To

            # Convert to Point3d objects
            start_point3d = rg.Point3d(start_point.X, start_point.Y, start_point.Z)
            end_point3d = rg.Point3d(end_point.X, end_point.Y, end_point.Z)

            # Add points to the unique points dictionary if they don't already exist
            if start_point3d not in unique_points:
                unique_points[start_point3d] = point_index
                point_index += 1
            if end_point3d not in unique_points:
                unique_points[end_point3d] = point_index
                point_index += 1

            # Get the indices of the start and end points
            start_index = unique_points[start_point3d]
            end_index = unique_points[end_point3d]

            # Append the indices to the connectivity tree
            connectivity_tree.EnsurePath(GH_Path(line_index))  # Create a new branch for the line index
            connectivity_tree.AddRange([start_index, end_index], GH_Path(line_index))

        # Convert unique points to a list of Point3d
        unique_points_list = [None] * len(unique_points)
        for pt, idx in unique_points.items():
            unique_points_list[idx] = pt

        return unique_points_list, connectivity_tree

    def __can_node_be_rigid(self, node):
        graph = self.graph
        neighbours = list(graph.neighbors(node))
        count_existing_neighbours = sum(1 for neighbour in neighbours if neighbour in self.processed_nodes)
        return count_existing_neighbours >= 3

    def __turn_tree_to_graph(self, connections_tree):
        list_of_tuples = []
        for i in range(connections_tree.BranchCount):
            branch = connections_tree.Branch(i)
            if len(branch) == 2:
                list_of_tuples.append(tuple(branch))
        G = nx.Graph()
        G.add_edges_from(list_of_tuples)
        return G

    def __get_first_move(self):
        start_point = self.start_point
        rigid_ids = self.rigid_indices
        points = self.points
        graph = self.graph

        min_avg_distance_to_start = float('inf')
        neighbours_to_connect_to = []
        first_supports = None

        def find_common_neighbour_combinations(graph, rigid_points_indices):
            valid_combinations = []
            common_neighbors = []
            for comb in combinations(rigid_points_indices, 3):
                neighbors_sets = [set(graph.neighbors(node)) for node in comb]
                common_neighbor = set.intersection(*neighbors_sets)
                if common_neighbor:
                    valid_combinations.append(comb)
                    common_neighbors.append(list(common_neighbor)[0])
            return valid_combinations, common_neighbors

        starting_three_candidates, common_neighbours = find_common_neighbour_combinations(graph, rigid_ids)

        for i, starting_three in enumerate(starting_three_candidates):
            p1 = points[starting_three[0]]
            p2 = points[starting_three[1]]
            p3 = points[starting_three[2]]

            centre = self.__average_point(p1, p2, p3)

            avg_distance = (start_point - centre).Length
            if avg_distance < min_avg_distance_to_start:
                min_avg_distance_to_start = avg_distance
                first_supports = starting_three
                neighbours_to_connect_to.append([common_neighbours[i]])

        neighbour_to_connect_to = neighbours_to_connect_to[-1][0]

        self.processed_nodes.extend(first_supports)
        self.processed_nodes.append(neighbour_to_connect_to)
        return list(first_supports), neighbour_to_connect_to

    def __check_missing_edges(self, sub_graph_edges):
        graph = self.graph
        edges_to_add = []

        for node1, node2 in combinations(sub_graph_edges, 2):
            if graph.has_edge(node1, node2):
                edges_to_add.append((node1, node2))

        return edges_to_add

    def __find_unprocessed_neighbors_subgraphs(self):
        graph = self.graph
        processed_nodes = self.processed_nodes
        processed_nodes_set = set(processed_nodes)
        points = self.points

        unprocessed_neighbors = set()
        last_node = processed_nodes[-1]
        neighbors_last_node = set(graph.neighbors(last_node))
        unprocessed_neighbors_last_node = neighbors_last_node - processed_nodes_set

        for node in processed_nodes_set:
            if node == last_node:
                continue
            neighbors = set(graph.neighbors(node))
            unprocessed_neighbors.update(neighbors - processed_nodes_set)

        unprocessed_neighbors.update(unprocessed_neighbors_last_node)

        subgraphs = []
        unprocessed_subgraph = graph.subgraph(unprocessed_neighbors)

        for component in nx.connected_components(unprocessed_subgraph):
            subgraphs.append(list(component))

        subgraphs_sorted = []
        subgraph_last_node = [comp for comp in subgraphs if any(node in unprocessed_neighbors_last_node for node in comp)]
        other_subgraphs = [comp for comp in subgraphs if comp not in subgraph_last_node]

        if subgraph_last_node:
            subgraphs_sorted.extend(subgraph_last_node)
            subgraphs_sorted.extend(other_subgraphs)
            return subgraphs_sorted[0]
        else:
            closest_distance = float('inf')
            first_comp = None
            for comp in subgraphs:
                for node in comp:
                    distance = (points[last_node] - points[node]).Length
                    if distance < closest_distance:
                        first_comp = comp
                        closest_distance = distance
            return first_comp

    def __get_possible_connections(self, node):
        graph = self.graph
        can_connect_to = [neighbour for neighbour in graph.neighbors(node) if neighbour in self.processed_nodes]
        return can_connect_to

    def __sort_rigid_candidates(self, candidates):
        origin = self.processed_nodes[-1]
        points = self.points

        def distance_to_origin(c):
            return (points[origin] - points[c]).Length

        sorted_candidates = sorted(candidates, key=distance_to_origin)
        return sorted_candidates

    def __get_sorted_supports(self, candidate_point, supports):
        support_combinations = list(itertools.combinations(range(len(supports)), 3))
        score_per_combination = {}
        result_supports = []

        def get_combined_distance_to_supports(supports):
            support_coords = np.array([[pt.X, pt.Y, pt.Z] for pt in supports])
            num_supports = len(support_coords)
            diff = support_coords[:, np.newaxis, :] - support_coords[np.newaxis, :, :]
            distances = np.linalg.norm(diff, axis=2)
            # Avoid multiplying by zero by adding small epsilon
            distances += np.eye(num_supports) * 1e-8
            combined_distance = np.prod(distances)
            return combined_distance

        def triangle_area(rs_pointA, rs_pointB, rs_pointC):
            A = np.array([rs_pointA.X, rs_pointA.Y, rs_pointA.Z])
            B = np.array([rs_pointB.X, rs_pointB.Y, rs_pointB.Z])
            C = np.array([rs_pointC.X, rs_pointC.Y, rs_pointC.Z])
            area = 0.5 * np.linalg.norm(np.cross(B - A, C - A))
            return area

        for c in support_combinations:
            supports_list = [supports[c[0]], supports[c[1]], supports[c[2]]]

            combined_distance = get_combined_distance_to_supports(supports_list)
            area = triangle_area(supports_list[0], supports_list[1], supports_list[2])
            if area == 0.0:
                score = combined_distance
            else:
                score = combined_distance / area
            score_per_combination[c] = score

        sorted_combinations = sorted(score_per_combination.items(), key=lambda item: item[1])

        support_combination = sorted_combinations[0][0]
        result_support = list(support_combination)
        for i in range(len(supports)):
            if i not in support_combination:
                result_support.append(i)
                break  # Add only one additional support if any

        return result_support

    def __check_if_door(self, support_nodes, load_node):
        support_points = [self.points[x] for x in support_nodes]
        load_point = self.points[load_node]
        combination = []

        def point_plane_distance(plane_pts, test_pt):
            A, B, C = plane_pts
            AB = B - A
            AC = C - A
            normal_vector = rg.Vector3d.CrossProduct(AB, AC)
            if normal_vector.IsZero:
                return 0.0
            normal_vector.Unitize()
            D = - (normal_vector.X * A.X + normal_vector.Y * A.Y + normal_vector.Z * A.Z)
            numerator = abs(normal_vector.X * test_pt.X + normal_vector.Y * test_pt.Y + normal_vector.Z * test_pt.Z + D)
            distance = numerator  # Since normal_vector is unitized, denominator is 1
            return distance

        def distance_to_centroid(pts, test_pt):
            centroid = rg.Point3d((pts[0].X + pts[1].X + pts[2].X) / 3,
                                  (pts[0].Y + pts[1].Y + pts[2].Y) / 3,
                                  (pts[0].Z + pts[1].Z + pts[2].Z) / 3)
            distance = (test_pt - centroid).Length
            return distance

        def is_door(three_supports, load_point, span_height_ratio=0.25):
            distance = point_plane_distance(three_supports, load_point)
            effective_span = distance_to_centroid(three_supports, load_point)
            if effective_span == 0:
                return False
            ratio = distance / effective_span
            return ratio <= span_height_ratio

        first_three = support_points[:3]
        if not is_door(first_three, load_point):
            return support_points
        else:
            for comb in combinations(support_points, 3):
                if not is_door(list(comb), load_point):
                    combination.extend(list(comb))
                    missing = [x for x in support_points if x not in list(comb)]
                    if missing:
                        combination.extend(missing)
                    return combination
            return True

    def assemble(self):
        graph = self.graph
        points = self.points
        assembly_steps = self.assembly_steps

        while True:
            if len(self.processed_nodes) == 0:
                first_supports, first_neighbour = self.__get_first_move()
                lines_to_add = []

                for support in first_supports:
                    p1 = points[support]
                    p2 = points[first_neighbour]
                    line = rg.LineCurve(p1, p2)
                    lines_to_add.append(line)

                missing_edges = self.__check_missing_edges(first_supports)
                for missing_edge in missing_edges:
                    p1 = points[missing_edge[0]]
                    p2 = points[missing_edge[1]]
                    line = rg.LineCurve(p1, p2)
                    lines_to_add.append(line)

                path = GH_Path(0)
                assembly_steps.AddRange(lines_to_add, path)

            elif len(self.processed_nodes) < len(points):
                non_rigid_candidates = self.__find_unprocessed_neighbors_subgraphs()
                rigid_candidates = [candidate for candidate in non_rigid_candidates if self.__can_node_be_rigid(candidate)]
                sorted_rigid_candidates = self.__sort_rigid_candidates(rigid_candidates)

                for candidate in sorted_rigid_candidates:
                    lines_to_add = []
                    nodes_to_connect_to = self.__get_possible_connections(candidate)
                    supports = [points[x] for x in nodes_to_connect_to]
                    nodes_sorted_indices = self.__get_sorted_supports(points[candidate], supports)
                    sorted_support_nodes = [nodes_to_connect_to[x] for x in nodes_sorted_indices]

                    door_check = self.__check_if_door(sorted_support_nodes, candidate)
                    if door_check == True:
                        continue
                    else:
                        sorted_support_points = door_check

                    for point in sorted_support_points:
                        line = rg.LineCurve(points[candidate], point)
                        lines_to_add.append(line)

                    self.processed_nodes.append(candidate)
                    path = GH_Path(assembly_steps.BranchCount)
                    assembly_steps.AddRange(lines_to_add, path)
                    break  # Proceed to the next candidate
                else:
                    return assembly_steps  # No valid candidates found; exit the loop
            else:
                return assembly_steps  # All nodes have been processed

# Instantiate the class with your inputs
my_truss = Trussemble(in_lines, in_rigid_points, in_start_point)
assembly_steps = my_truss.assemble()
processed_nodes = my_truss.processed_nodes
nodes = my_truss.points
processed_points = nodes
ordered_nodes = processed_points
# ---------- end py3 ----------
previewlw = CustomPreviewLineweights(
    Geometry=dynamic_geometry_pipeline,
    Shader=ColourSwatch(SwatchColor=RGB(117, 117, 117)),
    Thickness=Slider(0, range=0..4),
    Absolute=False)

number_slider_3 = Slider(4, range=1..2182)

assembly_steps = Data(py3.assembly_steps)

trigger = Trigger(Interval=10, TimerInterval=10, Target=[ur5_setup, python_3_script])  # disabled

tstat = TreeStatistics(Tree=assembly_steps)  # -> Paths, Length, Count
series = Series(Start=0, Step=1, Count=number_slider_3)
item = ListItem(List=tstat.Paths, Index=series, Wrap=True)
branch = TreeBranch(Tree=assembly_steps, Path=item, MaintainPaths=True)

connected = GetConnectedObjects(Objects=number_slider_3)
dom = ConstructDomain(DomainStart=1, DomainEnd=expr("x+1", tstat.Count))
set_slider = SetSliderProperties(Slider=connected, Range=dom, Type=1)

curve = Curve(branch)
previewlw_2 = CustomPreviewLineweights(Geometry=branch, Shader=ColourSwatch(SwatchColor=RGB(0, 51, 255)), Thickness=Slider(4, range=0..10), Absolute=False)

# ----
# Roof Base
number_slider_4 = Slider(-200, range=-600..600)
group_toggle_2 = GroupToggle(ToggleActive=True, ToggleVisible=False)  # disabled
unit_z_3 = UnitZ(Factor=number_slider_4)
curve_2 = Curve(<curve referenced from the Rhino model>)
extrude = Extrude(Base=curve_2, Direction=unit_z_3)
offset_surface = OffsetSurface(Surface=extrude, Distance=Slider(20, range=0..200), BothSides=Toggle(False), CreateSolid=Toggle(True))
deconstruct_brep = DeconstructBrep(Brep=offset_surface)  # -> flatten(Faces), Edges, Vertices
custom_preview_4 = CustomPreview(Geometry=offset_surface, Material=ColourSwatch(SwatchColor=RGB(255, 255, 255)))
populate_2d = Populate2D(Region=deconstruct_brep.Faces, Count=Slider(67, range=0..100), Seed=1)  # -> flatten(Population)

curve_middle = CurveMiddle(Curve=curve)
settings_quality = SettingsQuality()
brep = Brep(<brep referenced from the Rhino model>)
mesh_brep = MeshBrep(Brep=brep, Settings=settings_quality)
center = Center(Geometry=mesh_brep)  # -> Center, Dimension
point_5 = Point(center.Center)
python_3_script_5 = Python3Script(mesh_input=mesh_brep, point_input=point_5)  # -> out, a; inputs point_input: Point3d
# ---------- python_3_script_5: Python ----------
import robolink as rl        # RoboDK API for communication
import robodk as rdk         # RoboDK robotic simulation environment
import Rhino.Geometry as rg  # Rhino geometry for working with 3D points
import rhinoscriptsyntax as rs
import os
import tempfile

# Initialize RoboDK connection
RDK = rl.Robolink()

def sync_mesh_with_robodk(mesh, point):
    """
    Synchronize a Rhino mesh object with RoboDK by exporting the mesh to a temporary STL file,
    and position it in RoboDK using the centroid (point) coordinates.
    
    :param mesh: Rhino.Geometry.Mesh, the mesh input from Rhino/Grasshopper.
    :param point: Rhino.Geometry.Point3d, the centroid of the mesh.
    """
    # Create a temporary file for the STL export
    temp_dir = tempfile.gettempdir()
    temp_stl_path = os.path.join(temp_dir, "temp_mesh.stl")
    
    print(f"Exporting mesh to temporary STL file: {temp_stl_path}")
    
    # Export the Rhino mesh to STL
    rs.Command('_-Export "{}" _Enter'.format(temp_stl_path), False)

    # Check if the file exists before attempting to load it into RoboDK
    if not os.path.exists(temp_stl_path):
        print("Error: Failed to export STL file.")
        return

    print("STL file successfully exported.")

    # Load the STL file into RoboDK at the station root (world coordinate system)
    robodk_object = RDK.AddFile(temp_stl_path)  # No parent specified, placed at station root
    if not robodk_object.Valid():
        print("Failed to load mesh into RoboDK.")
        return

    print("Mesh successfully loaded into RoboDK.")

    # Convert Rhino centroid (point_input) coordinates to RoboDK coordinates
    x_rdk, y_rdk, z_rdk = point.X, point.Y, point.Z

    # Create a translation matrix in RoboDK using the converted coordinates
    translation_matrix = rdk.transl(x_rdk, y_rdk, z_rdk)

    # Apply the translation matrix to the mesh in RoboDK
    robodk_object.setPose(translation_matrix)
    print(f"Mesh positioned at RoboDK world coordinates: ({x_rdk}, {y_rdk}, {z_rdk})")

# Main script logic
if mesh_input and point_input:
    print("Starting to sync mesh with RoboDK...")
    sync_mesh_with_robodk(mesh_input, point_input)
else:
    print("Invalid mesh or centroid input.")
# ---------- end python_3_script_5 ----------
panel_9 = Panel(python_3_script_5.out)

# ----
# Box Demo
number_slider_5 = Slider(71.49, range=0..100)  # disabled
number_slider_6 = Slider(96.62, range=0..100)  # disabled
point_6 = Point(<point referenced from the Rhino model>)  # disabled
group_toggle_3 = GroupToggle(ToggleActive=True, ToggleVisible=False)  # disabled
inputpoint = RemoteSender(point_6)  # disabled
inputpoint_2 = RemoteReceiver(inputpoint)  # disabled
number_slider_7 = Slider(56.44, range=0..100)  # disabled
rectangle = Rectangle(Plane=inputpoint_2, XSize=number_slider_5, YSize=number_slider_6, Radius=0)  # -> Rectangle, Length; disabled
unit_z_4 = UnitZ(Factor=number_slider_7)  # disabled
curve_3 = Curve(rectangle.Rectangle)  # disabled
extrude_2 = Extrude(Base=curve_3, Direction=unit_z_4)  # disabled
cap_holes = CapHoles(Brep=extrude_2)  # disabled
deconstruct_brep_2 = DeconstructBrep(Brep=cap_holes)  # -> Faces, Edges, Vertices; disabled
area = Area(Geometry=deconstruct_brep_2.Faces)  # -> Area, Centroid; disabled
box = RemoteSender(cap_holes)  # disabled
deconstruct_3 = Deconstruct(Point=area.Centroid)  # -> XComponent, YComponent, ZComponent; disabled
sort_list = SortList(Keys=deconstruct_3.ZComponent, ValuesValuesA=deconstruct_brep_2.Faces)  # -> Keys, ValuesValuesA; disabled
number_slider_8 = Slider(34, range=0..64)  # disabled
number_slider_9 = Slider(58, range=0..64)  # disabled
list_item_2 = ListItem(List=sort_list.ValuesValuesA, Index=0, Wrap=True)  # disabled
tablepoints_2 = RemoteReceiver()  # disabled
area_2 = Area(Geometry=list_item_2)  # -> Area, Centroid; disabled
list_item_3 = ListItem(List=tablepoints_2, Index=number_slider_8, Wrap=True)  # disabled
list_item_4 = ListItem(List=tablepoints_2, Index=number_slider_9, Wrap=True)  # disabled
box_2 = RemoteReceiver(box)  # disabled
move_to_point = MoveToPoint(Geometry=box_2, PointA=area_2.Centroid, PointB=list_item_3)  # -> Moved, Vector, Transform; disabled
move_to_point_2 = MoveToPoint(Geometry=box_2, PointA=area_2.Centroid, PointB=list_item_4)  # -> Moved, Vector, Transform; disabled
box01a = Geometry(move_to_point.Moved)  # disabled
box02a = Geometry(move_to_point_2.Moved)  # disabled
deconstruct_brep_3 = DeconstructBrep(Brep=box01a)  # -> Faces, Edges, Vertices; disabled
area_3 = Area(Geometry=deconstruct_brep_3.Faces)  # -> Area, Centroid; disabled
deconstruct_4 = Deconstruct(Point=area_3.Centroid)  # -> XComponent, YComponent, ZComponent; disabled
number_slider_10 = Slider(511, range=0..909)  # disabled
sort_list_2 = SortList(Keys=deconstruct_4.ZComponent, ValuesValuesA=area_3.Centroid)  # -> Keys, ValuesValuesA; disabled
list_item_5 = ListItem(Index=number_slider_10, Wrap=True)  # disabled
list_item_6 = ListItem(List=reverse(sort_list_2.ValuesValuesA), Index=0, Wrap=True)  # disabled
point_7 = Point(list_item_5)  # disabled
boxtargetpointa = RemoteSender(list_item_6)  # disabled
targeta = RemoteSender(point_7)  # disabled

deconstruct_brep_4 = DeconstructBrep(Brep=box02a)  # -> Faces, Edges, Vertices; disabled
area_4 = Area(Geometry=deconstruct_brep_4.Faces)  # -> Area, Centroid; disabled
deconstruct_5 = Deconstruct(Point=area_4.Centroid)  # -> XComponent, YComponent, ZComponent; disabled
sort_list_3 = SortList(Keys=deconstruct_5.ZComponent, ValuesValuesA=area_4.Centroid)  # -> Keys, ValuesValuesA; disabled
list_item_7 = ListItem(List=reverse(sort_list_3.ValuesValuesA), Index=0, Wrap=True)  # disabled

boxtargetpointb = RemoteSender(list_item_7)  # disabled

# ----
# Version 1
boxtargetpointb_2 = RemoteReceiver(boxtargetpointb)  # disabled
brep_2 = Brep(<brep referenced from the Rhino model>)  # disabled
number_slider_11 = Slider(100, range=100..1000)  # disabled
boxtargetpointa_2 = RemoteReceiver(boxtargetpointa)  # disabled
group_toggle_4 = GroupToggle(ToggleActive=True, ToggleVisible=False)  # disabled
deconstruct_brep_5 = DeconstructBrep(Brep=brep_2)  # -> Faces, Edges, Vertices; disabled
targeta_2 = RemoteReceiver(targeta)  # disabled
panel_10 = Panel("0")  # disabled
populate_2d_2 = Populate2D(Region=deconstruct_brep_5.Faces, Count=number_slider_11, Seed=1)  # -> flatten(Population); disabled
data_dam_7 = DataDam(DataDataA=boxtargetpointa_2, BufferDelay=10000000, BufferMode=0)  # disabled
boolean_toggle_2 = BooleanToggle(False)  # disabled
panel_11 = Panel("30")  # disabled
panel_12 = Panel("UR51")  # disabled
sphere_4 = Sphere(Base=targeta_2, Radius=panel_11)  # disabled
colour_swatch = ColourSwatch(SwatchColor=RGB(47, 237, 21))  # disabled
python_3_script_6 = Python3Script(
    RobotName=panel_12,
    TargetPoint0=data_dam_7,
    UpdateRoboDK=boolean_toggle_2,
    TargetPointA=targeta_2,
    WorkingTablePoints=populate_2d_2,
    BaseRotationZ=panel_10)  # -> out, SuccessMessage, TCPOrientations, TargetPointCoordinates; inputs TargetPoint0: Point3d, TargetPointA: Point3d, WorkingTablePoints: list of Point3d, BaseRotationZ: Double; disabled
# ---------- python_3_script_6: Python ----------
import robolink as rl    # RoboDK API for controlling and communicating with RoboDK
import robodk as rdk     # RoboDK tools, such as matrix operations and other utilities
import Rhino.Geometry as rg
import math

# === Inputs ===
# RobotName: Name of the robot in RoboDK (e.g., "UR5")
# UpdateRoboDK: Boolean toggle to execute the script and update RoboDK when True
# TargetPoint0: The starting point where the robot should move first (Rhino Point3d)
# TargetPointA: The final point where the robot should move and end the program (Rhino Point3d)
# BaseRotationZ: Rotation of the robot's base around the Z-axis in degrees (optional, can be 0 if no rotation is needed)

# Initialize outputs
SuccessMessage = ""
TargetPose0 = None
TargetPoseA = None
Program = ""
TCPOrientations = []
TargetPointCoordinates = []  # List to store target point coordinates

# Function to apply a Z-axis rotation to a Point3d
def rotate_point_around_z(point, angle_degrees):
    """Rotates a Rhino Point3d around the Z-axis by the given angle in degrees."""
    angle_radians = math.radians(angle_degrees)
    rotation_matrix = rg.Transform.Rotation(angle_radians, rg.Vector3d(0, 0, 1), rg.Point3d(0, 0, 0))
    rotated_point = rg.Point3d(point)
    rotated_point.Transform(rotation_matrix)
    return rotated_point

# Function to convert Rhino Plane to RoboDK Pose (4x4 matrix)
def plane_to_pose(plane):
    """Converts a Rhino plane to a RoboDK pose (4x4 matrix)."""
    pose = rdk.Mat([
        [plane.XAxis.X, plane.YAxis.X, plane.ZAxis.X, plane.OriginX],  
        [plane.XAxis.Y, plane.YAxis.Y, plane.ZAxis.Y, plane.OriginY],
        [plane.XAxis.Z, plane.YAxis.Z, plane.ZAxis.Z, plane.OriginZ],
        [0, 0, 0, 1]
    ])
    return pose

# Function to format the orientation of the TCP as strings for easy reporting
def format_tcp_orientation(plane, milestone):
    """Formats the TCP orientation (X, Y, Z axes) for a given milestone."""
    x_axis = plane.XAxis
    y_axis = plane.YAxis
    z_axis = plane.ZAxis
    return f"TCP orientation at {milestone}:\n  X-axis: {x_axis}\n  Y-axis: {y_axis}\n  Z-axis: {z_axis}"

# Function to format the target point coordinates {x, y, z} for reporting
def format_target_coordinates(plane, milestone):
    """Formats the target point coordinates as a string for a given milestone."""
    return f"{plane.Origin.X}, {plane.Origin.Y}, {plane.Origin.Z}"

# Check required inputs before proceeding
if not RobotName:
    SuccessMessage = "Error: RobotName is required."
elif not isinstance(TargetPoint0, rg.Point3d):
    SuccessMessage = "Error: TargetPoint0 must be a Rhino Point3d."
elif not isinstance(TargetPointA, rg.Point3d):
    SuccessMessage = "Error: TargetPointA must be a Rhino Point3d."
elif UpdateRoboDK is None:
    SuccessMessage = "Error: UpdateRoboDK toggle is required."
elif not UpdateRoboDK:
    SuccessMessage = "UpdateRoboDK is set to False. No action taken."
else:
    # Connect to RoboDK only if UpdateRoboDK is True
    RDK = rl.Robolink()  # Initialize RoboDK connection
    SuccessMessage = "Connected to RoboDK."
    
    # Retrieve the robot by name
    robot = RDK.Item(RobotName, rl.ITEM_TYPE_ROBOT)
    
    if not robot.Valid():
        SuccessMessage += f"\nError: Could not find {RobotName} in RoboDK."
    else:
        SuccessMessage += f"\nFound robot '{robot.Name()}' in RoboDK."
        
        # Get the robot's base and tool
        robot_base = robot.Parent()
        tool = robot.getLink(rl.ITEM_TYPE_TOOL)
        
        # Check if the robot base and tool are valid
        if not robot_base.Valid():
            SuccessMessage += "\nError: Robot's base not found."
        else:
            SuccessMessage += f"\nRobot base: {robot_base.Name()}"

        if not tool.Valid():
            SuccessMessage += "\nError: Robot's tool not found."
        else:
            SuccessMessage += f"\nRobot tool: {tool.Name()}"

        # Enable collision detection in RoboDK
        RDK.setCollisionActive(1)
        
        if not robot_base.Valid() or not tool.Valid():
            SuccessMessage += "\nCannot proceed without valid base and tool."
        else:
            # Apply the user-defined Z-axis rotation to the TargetPoint0 and TargetPointA
            # If BaseRotationZ is 0, no rotation will be applied
            if 'BaseRotationZ' in globals() and isinstance(BaseRotationZ, (int, float)):
                rotated_target_point_0 = rotate_point_around_z(TargetPoint0, BaseRotationZ)
                rotated_target_point_A = rotate_point_around_z(TargetPointA, BaseRotationZ)
            else:
                # No rotation needed, use the original points
                rotated_target_point_0 = TargetPoint0
                rotated_target_point_A = TargetPointA

            # Define the target points (TargetPoint0 and TargetPointA)
            # For TargetPoint0, the Z-axis should point downwards (towards [0, 0, -1])
            z_axis_0 = rg.Vector3d(0, 0, -1)  # TCP faces downwards at TargetPoint0
            x_axis_0 = rg.Vector3d(1, 0, 0)   # X-axis remains unchanged
            y_axis_0 = rg.Vector3d.CrossProduct(z_axis_0, x_axis_0)  # Recalculate Y-axis
            
            # For TargetPointA, the Z-axis should point forward (towards [1, 0, 0]) and Y-axis should point downwards
            z_axis_A = rg.Vector3d(1, 0, 0)   # TCP faces forward at TargetPointA
            y_axis_A = rg.Vector3d(0, 0, -1)  # Y-axis faces downwards at TargetPointA
            x_axis_A = rg.Vector3d.CrossProduct(y_axis_A, z_axis_A)  # Recalculate X-axis to ensure orthogonality

            # Create a plane for the rotated TargetPoint0 (with the TCP facing down)
            TargetPose0 = rg.Plane(rotated_target_point_0, x_axis_0, y_axis_0)
            # Convert TargetPose0 to RoboDK pose
            target_pose_robot_0 = plane_to_pose(TargetPose0)
            
            # Create a plane for the rotated TargetPointA (with the TCP facing forward and Y-axis down)
            TargetPoseA = rg.Plane(rotated_target_point_A, x_axis_A, y_axis_A)
            # Convert TargetPoseA to RoboDK pose
            target_pose_robot_A = plane_to_pose(TargetPoseA)

            # Parse target points and orientations for TargetPoint0 and TargetPointA
            TCPOrientations.append(format_tcp_orientation(TargetPose0, "TargetPoint0"))
            TCPOrientations.append(format_tcp_orientation(TargetPoseA, "TargetPointA"))
            TargetPointCoordinates.append(format_target_coordinates(TargetPose0, "TargetPoint0"))
            TargetPointCoordinates.append(format_target_coordinates(TargetPoseA, "TargetPointA"))

            # Add the movement targets in RoboDK
            target_0 = RDK.AddTarget("TargetPoint0", robot_base, robot)
            target_0.setAsCartesianTarget()
            target_0.setPose(target_pose_robot_0)
            
            target_A = RDK.AddTarget("TargetPointA", robot_base, robot)
            target_A.setAsCartesianTarget()
            target_A.setPose(target_pose_robot_A)

            SuccessMessage += "\nCreating program in RoboDK..."
            program_name = "MoveToTargetProgram"
            program = RDK.AddProgram(program_name, robot)
            
            program.setFrame(robot_base)  # Set the base frame of the robot
            program.setTool(tool)  # Set the tool of the robot

            # Add movements to the program: TargetPoint0 -> TargetPointA
            program.MoveJ(target_0)  # Move to TargetPoint0 (TCP facing downwards)
            program.MoveJ(target_A)  # Move to TargetPointA (TCP facing forward, Y-axis downwards)

            Program = program_name  # Assign the created program's name to the output
            SuccessMessage += f"\nProgram '{program_name}' created successfully."
# ---------- end python_3_script_6 ----------
custom_preview_5 = CustomPreview(Geometry=sphere_4, Material=colour_swatch)  # disabled
panel_13 = Panel(python_3_script_6.TCPOrientations)  # disabled
panel_14 = Panel(python_3_script_6.TargetPointCoordinates)  # disabled

# ----
# select group
number_slider_12 = Slider(9, range=0..20)
construct_domain = ConstructDomain(DomainStart=0, DomainEnd=number_slider_12)
range = Range(Domain=construct_domain, Steps=number_slider_12)  # -> flatten(Range)

partition_list = PartitionList(List=assembly_steps, Size="3")
concatenate_3 = Concatenate(Fragment_A="{", Fragment_B=range, A=";*}")

split_tree = SplitTree(Data=partition_list, Masks=flatten(concatenate_3))  # -> Positive, Negative
curve_middle_2 = CurveMiddle(Curve=split_tree.Positive)
line = Line(split_tree.Positive)

# ----
# script v3
xy_plane = XYPlane(Origin=Point(0, 0, 0))
xy_plane_2 = XYPlane(Origin=Point(500, 500, 0))
null_placeholder = NullPlaceholder()
python_3_script_7 = Python3Script(LinesTree=line, pick_up_plane_A=xy_plane, pick_up_plane_B=xy_plane_2, waiting_command="waiting", pause_command="pause")  # -> out, RobotA_Command, RobotB_Command, RobotA_Status, RobotB_Status; inputs LinesTree: tree of Line
# ---------- python_3_script_7: Python ----------
import Rhino.Geometry as rg
from Grasshopper import DataTree
from Grasshopper.Kernel.Data import GH_Path

# Inputs:
# LinesTree - DataTree of Line objects
# pick_up_plane_A - pick up plane for Robot A (input parameter)
# pick_up_plane_B - pick up plane for Robot B (input parameter)
# pause_command - command for pauses (input parameter)
# waiting_command - command when waiting for other robot (input parameter)

# Initialize output data trees
robotA_commands = DataTree[object]()
robotB_commands = DataTree[object]()
robotA_status = DataTree[str]()
robotB_status = DataTree[str]()

# Collect all heights to determine the middle height of the truss
heights = []
for branch in LinesTree.Branches:
    for line in branch:
        start_pt = line.From
        end_pt = line.To
        avg_height = (start_pt.Z + end_pt.Z) / 2.0
        heights.append(avg_height)

min_height = min(heights)
max_height = max(heights)
middle_height = (min_height + max_height) / 2.0

# Process each branch
for b, branch in enumerate(LinesTree.Branches):
    path = LinesTree.Paths[b]
    # Identify if subbranch is {-;0} or {-;1}
    if path.Indices[-1] == 0:
        # Subbranch {-;0} - special processing
        edges = branch
        if len(edges) != 3:
            # Handle the case where there are not exactly 3 edges
            # For simplicity, assume there are 3 edges
            pass
        else:
            edge1, edge2, edge3 = edges[0], edges[1], edges[2]
            steps = []
            
            # Step 1: Robot A moves to pick up
            step = {'RobotA': {'status': 'Move to pick up', 'command': pick_up_plane_A},
                    'RobotB': {'status': 'Waiting for other robot', 'command': waiting_command}}
            steps.append(step)
            
            # Step 2: Robot A closes gripper
            step = {'RobotA': {'status': 'Close gripper', 'command': 'gripper = 1'},
                    'RobotB': {'status': steps[-1]['RobotB']['status'], 'command': steps[-1]['RobotB']['command']}}
            steps.append(step)
            
            # Step 3: Robot A moves to target (edge1)
            step = {'RobotA': {'status': 'Move to target 1', 'command': edge1},
                    'RobotB': {'status': 'Waiting for other robot', 'command': waiting_command}}
            steps.append(step)
            
            # Step 4: Robot B moves to pick up
            step = {'RobotA': {'status': 'Waiting for other robot', 'command': waiting_command},
                    'RobotB': {'status': 'Move to pick up', 'command': pick_up_plane_B}}
            steps.append(step)
            
            # Step 5: Robot B closes gripper
            step = {'RobotA': {'status': steps[-1]['RobotA']['status'], 'command': steps[-1]['RobotA']['command']},
                    'RobotB': {'status': 'Close gripper', 'command': 'gripper = 1'}}
            steps.append(step)
            
            # Step 6: Robot B moves to target (edge2)
            step = {'RobotA': {'status': 'Waiting for other robot', 'command': waiting_command},
                    'RobotB': {'status': 'Move to target 2', 'command': edge2}}
            steps.append(step)
            
            # Step 7: Both robots pause for connection
            step = {'RobotA': {'status': 'Pause for connection', 'command': pause_command},
                    'RobotB': {'status': 'Pause for connection', 'command': pause_command}}
            steps.append(step)
            
            # Step 8: Robot A opens gripper
            step = {'RobotA': {'status': 'Open gripper', 'command': 'gripper = 0'},
                    'RobotB': {'status': steps[-1]['RobotB']['status'], 'command': steps[-1]['RobotB']['command']}}
            steps.append(step)
            
            # Step 9: Robot A moves to pick up
            step = {'RobotA': {'status': 'Move to pick up', 'command': pick_up_plane_A},
                    'RobotB': {'status': 'Waiting for other robot', 'command': waiting_command}}
            steps.append(step)
            
            # Step 10: Robot A closes gripper
            step = {'RobotA': {'status': 'Close gripper', 'command': 'gripper = 1'},
                    'RobotB': {'status': steps[-1]['RobotB']['status'], 'command': steps[-1]['RobotB']['command']}}
            steps.append(step)
            
            # Step 11: Robot A moves to target (edge3)
            step = {'RobotA': {'status': 'Move to target 3', 'command': edge3},
                    'RobotB': {'status': 'Waiting for other robot', 'command': waiting_command}}
            steps.append(step)
            
            # Step 12: Both robots pause for connection
            step = {'RobotA': {'status': 'Pause for connection', 'command': pause_command},
                    'RobotB': {'status': 'Pause for connection', 'command': pause_command}}
            steps.append(step)
            
            # Step 13: Both robots open gripper
            step = {'RobotA': {'status': 'Open gripper', 'command': 'gripper = 0'},
                    'RobotB': {'status': 'Open gripper', 'command': 'gripper = 0'}}
            steps.append(step)
            
            # Add the steps to the output data trees
            for step in steps:
                robotA_commands.Add(step['RobotA']['command'], path)
                robotA_status.Add(step['RobotA']['status'], path)
                robotB_commands.Add(step['RobotB']['command'], path)
                robotB_status.Add(step['RobotB']['status'], path)
    else:
        # Subbranch {-;1} - process edges assigned to robots, repeating the pattern
        edges = branch
        line_heights = []
        for line in edges:
            start_pt = line.From
            end_pt = line.To
            avg_height = (start_pt.Z + end_pt.Z) / 2.0
            line_heights.append((line, avg_height))
        
        # Sort edges based on their distance from middle height
        line_heights_sorted = sorted(line_heights, key=lambda x: abs(x[1] - middle_height))
        
        # Assign edges to robots based on average height
        robotA_edges = []
        robotB_edges = []
        for line, avg_height in line_heights_sorted:
            if avg_height <= middle_height:
                robotA_edges.append(line)
            else:
                robotB_edges.append(line)
        
        steps = []
        i = 0  # index for Robot A's edges
        j = 0  # index for Robot B's edges
        edge_counter_A = 1
        edge_counter_B = 1
        while i < len(robotA_edges) or j < len(robotB_edges):
            if i < len(robotA_edges):
                # Robot A processes an edge
                # Step: Robot A moves to pick up
                step = {'RobotA': {'status': 'Move to pick up', 'command': pick_up_plane_A},
                        'RobotB': {'status': 'Waiting for other robot', 'command': waiting_command}}
                steps.append(step)
                
                # Step: Robot A closes gripper
                step = {'RobotA': {'status': 'Close gripper', 'command': 'gripper = 1'},
                        'RobotB': {'status': steps[-1]['RobotB']['status'], 'command': steps[-1]['RobotB']['command']}}
                steps.append(step)
                
                # Step: Robot A moves to target
                step = {'RobotA': {'status': f'Move to target {edge_counter_A}', 'command': robotA_edges[i]},
                        'RobotB': {'status': 'Waiting for other robot', 'command': waiting_command}}
                steps.append(step)
                
                # Step: Pause for connection
                step = {'RobotA': {'status': 'Pause for connection', 'command': pause_command},
                        'RobotB': {'status': 'Pause for connection', 'command': pause_command}}
                steps.append(step)
                
                # Step: Robot A opens gripper
                step = {'RobotA': {'status': 'Open gripper', 'command': 'gripper = 0'},
                        'RobotB': {'status': steps[-1]['RobotB']['status'], 'command': steps[-1]['RobotB']['command']}}
                steps.append(step)
                
                i += 1
                edge_counter_A += 1
                
            if j < len(robotB_edges):
                # Robot B processes an edge
                # Step: Robot B moves to pick up
                step = {'RobotA': {'status': 'Waiting for other robot', 'command': waiting_command},
                        'RobotB': {'status': 'Move to pick up', 'command': pick_up_plane_B}}
                steps.append(step)
                
                # Step: Robot B closes gripper
                step = {'RobotA': {'status': steps[-1]['RobotA']['status'], 'command': steps[-1]['RobotA']['command']},
                        'RobotB': {'status': 'Close gripper', 'command': 'gripper = 1'}}
                steps.append(step)
                
                # Step: Robot B moves to target
                step = {'RobotA': {'status': 'Waiting for other robot', 'command': waiting_command},
                        'RobotB': {'status': f'Move to target {edge_counter_B}', 'command': robotB_edges[j]}}
                steps.append(step)
                
                # Step: Pause for connection
                step = {'RobotA': {'status': 'Pause for connection', 'command': pause_command},
                        'RobotB': {'status': 'Pause for connection', 'command': pause_command}}
                steps.append(step)
                
                # Step: Robot B opens gripper
                step = {'RobotA': {'status': steps[-1]['RobotA']['status'], 'command': steps[-1]['RobotA']['command']},
                        'RobotB': {'status': 'Open gripper', 'command': 'gripper = 0'}}
                steps.append(step)
                
                j += 1
                edge_counter_B += 1
                
        # Remove unnecessary double pauses
        optimized_steps = []
        prev_step = None
        for step in steps:
            if prev_step:
                if (prev_step['RobotA']['status'] == 'Pause for connection' and
                    step['RobotA']['status'] == 'Pause for connection'):
                    # Skip this step
                    continue
            optimized_steps.append(step)
            prev_step = step
            
        # Add the steps to the output data trees
        for step in optimized_steps:
            robotA_commands.Add(step['RobotA']['command'], path)
            robotA_status.Add(step['RobotA']['status'], path)
            robotB_commands.Add(step['RobotB']['command'], path)
            robotB_status.Add(step['RobotB']['status'], path)
    
# Set the outputs
RobotA_Command = robotA_commands
RobotB_Command = robotB_commands
RobotA_Status = robotA_status
RobotB_Status = robotB_status
# ---------- end python_3_script_7 ----------

# ----
# Robot_B
# Robot_A
# Command
# Status
# Status
# Command
panel_15 = Panel(python_3_script_7.RobotA_Command)
panel_16 = Panel(python_3_script_7.RobotA_Status)
panel_17 = Panel(python_3_script_7.RobotB_Command)
panel_18 = Panel(python_3_script_7.RobotB_Status)

# ----
# Real-Time Visualization
group_toggle_5 = GroupToggle(ToggleActive=True, ToggleVisible=False)  # disabled
robot_1_3 = RemoteReceiver(robot_1)
robot_2_3 = RemoteReceiver(robot_2)

ur5_setup = Python3Script(RobotName=robot_1_3)  # -> out, RobotPosition, X_Axis, Y_Axis, Z_Axis, JointPoints, JointLines, SuccessMessage
# ---------- ur5_setup: Python ----------
import robolink as rl  # RoboDK API
import robodk as rdk
import Rhino.Geometry as rg
import math
import numpy as np

# === Inputs ===
# RobotName: Name of the robot in RoboDK (e.g., "UR5")

# Initialize outputs
RobotPosition = None
X_Axis = None
Y_Axis = None
Z_Axis = None
JointPoints = []
JointLines = []
SuccessMessage = ""

# Initialize RoboDK connection
RDK = rl.Robolink()

# Get the robot by name
robot = RDK.Item(RobotName, rl.ITEM_TYPE_ROBOT)

if not robot.Valid():
    SuccessMessage = f"Error: Could not find {RobotName} in RoboDK."
else:
    SuccessMessage = f"Connected to {RobotName} in RoboDK."

    # Get the robot's base pose
    robot_base = robot.Parent()
    if robot_base.Valid():
        base_pose = robot_base.Pose()
    else:
        base_pose = rdk.Mat()

    # Get the robot's current joint angles (degrees)
    joints_deg = robot.Joints().list()
    # Convert joint angles to radians
    joints_rad = [math.radians(angle) for angle in joints_deg]

    # UR5 standard DH parameters (in millimeters)
    d1 = 89.159
    a2 = -425.00
    a3 = -392.25
    d4 = 109.15
    d5 = 94.65
    d6 = 82.3

    alpha = [math.pi/2, 0, 0, math.pi/2, -math.pi/2, 0]
    a = [0, a2, a3, 0, 0, 0]
    d = [d1, 0, 0, d4, d5, d6]
    theta = [
        joints_rad[0],
        joints_rad[1],
        joints_rad[2],
        joints_rad[3],
        joints_rad[4],
        joints_rad[5],
    ]

    # Initialize the base transformation matrix
    T_base = np.array(base_pose.rows)
    # Ensure T_base is a 4x4 matrix
    if T_base.shape != (4, 4):
        SuccessMessage += " Error: Base pose matrix is not 4x4."
    else:
        # Initialize the transformation matrix
        T = T_base

        # Initialize joint positions list
        JointPoints = []

        # Store transformation matrices for each joint
        T_matrices = []

        for i in range(6):  # Six joints
            # DH parameters for current joint
            ai = a[i]
            alphai = alpha[i]
            di = d[i]
            thetai = theta[i]

            # Compute transformation matrix using DH parameters
            cos_theta = math.cos(thetai)
            sin_theta = math.sin(thetai)
            cos_alpha = math.cos(alphai)
            sin_alpha = math.sin(alphai)

            T_joint = np.array([
                [cos_theta, -sin_theta * cos_alpha,  sin_theta * sin_alpha, ai * cos_theta],
                [sin_theta,  cos_theta * cos_alpha, -cos_theta * sin_alpha, ai * sin_theta],
                [0,          sin_alpha,              cos_alpha,             di],
                [0,          0,                      0,                     1]
            ])

            # Update the overall transformation matrix
            T = np.dot(T, T_joint)

            # Save the transformation matrix for this joint
            T_matrices.append(T.copy())

            # Extract the position of the current joint
            position = T[:3, 3]

            # No conversion needed since we're working in millimeters
            joint_point = rg.Point3d(position[0], position[1], position[2])
            JointPoints.append(joint_point)

        # Create lines connecting the joints
        JointLines = []
        for i in range(1, len(JointPoints)):
            line = rg.Line(JointPoints[i - 1], JointPoints[i])
            JointLines.append(line)

        # Optionally, connect the base to the first joint
        if JointPoints:
            base_position = T_base[:3, 3]
            base_point = rg.Point3d(base_position[0], base_position[1], base_position[2])
            line = rg.Line(base_point, JointPoints[0])
            JointLines.insert(0, line)

        # Fetch the robot's pose relative to its base
        robot_pose = robot.Pose()

        # Compute the absolute pose of the TCP in the world coordinate system
        absolute_pose = base_pose * robot_pose

        # Extract position from the absolute pose
        position = absolute_pose.Pos()  # [x, y, z]

        # Create Rhino point for the robot's TCP position
        RobotPosition = rg.Point3d(position[0], position[1], position[2])

        # Extract orientation vectors from the rotation matrix of the absolute pose
        x_vector = rg.Vector3d(absolute_pose[0,0], absolute_pose[1,0], absolute_pose[2,0])
        y_vector = rg.Vector3d(absolute_pose[0,1], absolute_pose[1,1], absolute_pose[2,1])
        z_vector = rg.Vector3d(absolute_pose[0,2], absolute_pose[1,2], absolute_pose[2,2])

        # Scale vectors for visualization purposes
        scale_factor = 200  # Adjust as needed
        x_vector *= scale_factor
        y_vector *= scale_factor
        z_vector *= scale_factor

        # Create lines representing the robot's TCP axes
        X_Axis = rg.Line(RobotPosition, x_vector)
        Y_Axis = rg.Line(RobotPosition, y_vector)
        Z_Axis = rg.Line(RobotPosition, z_vector)

        # Optionally, connect the last joint to the TCP
        if JointPoints and RobotPosition:
            line = rg.Line(JointPoints[-1], RobotPosition)
            JointLines.append(line)
# ---------- end ur5_setup ----------
ur5_setup_2 = Python3Script(RobotName=robot_2_3)  # -> out, RobotPosition, X_Axis, Y_Axis, Z_Axis, JointPoints, JointLines, SuccessMessage; disabled; same code as ur5_setup

panel_19 = Panel(ur5_setup.Z_Axis)
panel_20 = Panel(ur5_setup.JointLines)
panel_21 = Panel(ur5_setup.RobotPosition)
panel_22 = Panel(ur5_setup.X_Axis)
panel_23 = Panel(ur5_setup.Y_Axis)
panel_24 = Panel(ur5_setup.SuccessMessage)
panel_25 = Panel(ur5_setup_2.JointLines)
panel_26 = Panel(ur5_setup_2.RobotPosition)
panel_27 = Panel(ur5_setup_2.X_Axis)
panel_28 = Panel(ur5_setup_2.Y_Axis)
panel_29 = Panel(ur5_setup_2.Z_Axis)
panel_30 = Panel(ur5_setup_2.SuccessMessage)
panel_31 = Panel(ur5_setup.JointPoints)
panel_32 = Panel(ur5_setup_2.JointPoints)

list_item_8 = ListItem(List=[ur5_setup.X_Axis, ur5_setup_2.X_Axis], Index=0, Wrap=True)  # -> Item, Item1
list_item_9 = ListItem(List=[ur5_setup.Y_Axis, ur5_setup_2.Y_Axis], Index=0, Wrap=True)  # -> Item, Item1
list_item_10 = ListItem(List=[ur5_setup.Z_Axis, ur5_setup_2.Z_Axis], Index=0, Wrap=True)  # -> Item, Item1

colour_swatch_2 = ColourSwatch(SwatchColor=RGB(255, 0, 0))
colour_swatch_3 = ColourSwatch(SwatchColor=RGB(82, 255, 3))
colour_swatch_4 = ColourSwatch(SwatchColor=RGB(17, 101, 145))
entwine_3 = Entwine(
    Branch00=list_item_8.Item,
    Branch01=list_item_9.Item,
    Branch02=list_item_10.Item,
    Branch03=list_item_8.Item1,
    Branch04=list_item_9.Item1,
    Branch05=list_item_10.Item1,
    FlattenInputs=True)
entwine_4 = Entwine(
    Branch00=colour_swatch_2,
    Branch01=colour_swatch_3,
    Branch02=colour_swatch_4,
    Branch03=colour_swatch_2,
    Branch04=colour_swatch_3,
    Branch05=colour_swatch_4,
    Branch06=colour_swatch_2,
    Branch07=colour_swatch_3,
    Branch08=colour_swatch_4,
    FlattenInputs=True)
custom_preview_lineweights_3 = CustomPreviewLineweights(Geometry=entwine_3, Shader=entwine_4, Thickness=Slider(3, range=0..10), Absolute=False)

entwine_5 = Entwine(Branch00=ur5_setup.JointPoints, Branch01=ur5_setup_2.JointPoints, FlattenInputs=True)
sphere_5 = Sphere(Base=entwine_5, Radius=Slider(20.8, range=0..100))
custom_preview_6 = CustomPreview(Geometry=sphere_5, Material=ColourSwatch(SwatchColor=RGB(21, 201, 237)))
panel_33 = Panel("""J0
J1
J2
J3
J4
J5""")
panel_34 = Panel("""J0
J1
J2
J3
J4
J5""")
colour_swatch_5 = ColourSwatch(SwatchColor=RGB(255, 0, 0))

group_toggle_6 = GroupToggle(ToggleActive=True, ToggleVisible=False)  # disabled
entwine_6 = Entwine(Branch00=list_item_9.Item, Branch01=list_item_9.Item1, FlattenInputs=True)
entwine_7 = Entwine(Branch00=list_item_10.Item, Branch01=list_item_10.Item1, FlattenInputs=True)
merge = Merge(Data1=ur5_setup.JointLines, Data2=ur5_setup_2.JointLines)
data = Data(sphere_5)

entwine_8 = Entwine(Branch00=list_item_8.Item, Branch01=list_item_8.Item1, FlattenInputs=True)
end_points_4 = EndPoints(Curve=entwine_8)  # -> Start, End
end_points_5 = EndPoints(Curve=entwine_6)  # -> Start, End
end_points_6 = EndPoints(Curve=entwine_7)  # -> Start, End
text_tag_4 = TextTag(Location=end_points_4.End, Text="x")
text_tag_5 = TextTag(Location=end_points_5.End, Text="y")
text_tag_6 = TextTag(Location=end_points_6.End, Text="z")

custom_preview_lineweights_4 = CustomPreviewLineweights(Geometry=merge, Shader=ColourSwatch(SwatchColor=RGB(26, 26, 26)), Thickness=Slider(2, range=0..200), Absolute=False)

panel_35 = Panel(data)
area_5 = Area(Geometry=data)  # -> Area, Centroid
scale = Scale(Geometry=sphere_5, Center=area_5.Centroid, Factor=Slider(1.73, range=0..3))  # -> Geometry, Transform; disabled
tree_branch = TreeBranch(Tree=area_5.Centroid, Path="{0;1}", MaintainPaths=True)  # -> flatten(Branch)
text_tag_7 = TextTag(Location=tree_branch, Text=panel_34, Colour=colour_swatch_5)

tree_branch_2 = TreeBranch(Tree=area_5.Centroid, Path="{0;0}", MaintainPaths=True)  # -> flatten(Branch)
panel_36 = Panel(tree_branch_2)

text_tag_8 = TextTag(Location=tree_branch_2, Text=panel_33, Colour=colour_swatch_5)

divide_curve = DivideCurve(Curve=curve, Count=10, Kinks=False)  # -> Points, Tangents, Parameters
point_8 = Point(divide_curve.Points)
list_item_11 = ListItem(List=tablepointsur5_2, Index=data_dam, Wrap=True)
point_9 = Point(list_item_11)
number_slider_13 = Slider(54, range=0..142)
list_item_12 = ListItem(List=tablepointsur5_2, Index="390", Wrap=True)

# ----
# Collision Points
entwine_9 = Entwine(Branch00=point_8, Branch01=populate_2d_2, Branch02=populate_2d, FlattenInputs=True)
point_10 = Point(entwine_9)  # disabled
panel_37 = Panel(entwine_9)

# ----
# orientation frames
# midpoints
# lines
end_points_7 = EndPoints(Curve=curve)  # -> graft(Start), graft(End)
negative = Negative(Value="10000")
trim_tree = TrimTree(Tree=end_points_7.Start, Depth=1)
stream_filter_4 = StreamFilter(Gate=0, Stream0="10000", Stream1=negative)
unit_z_5 = UnitZ(Factor=stream_filter_4)
move_3 = Move(Geometry=point_9, Motion=unit_z_5)  # -> Geometry, Transform
plane_3pt = Plane3Pt(PointA=curve_middle, PointB=trim_tree, PointC=move_3.Geometry)  # -> flatten(Plane)
rotate_plane_by_axis = RotatePlaneByAxis(Plane=plane_3pt, Axis="x", Angle=90)
plane = Plane(rotate_plane_by_axis)
deconstruct_plane = DeconstructPlane(Plane=plane)  # -> Origin, XAxis, YAxis, ZAxis
amplitude = Amplitude(Vector=deconstruct_plane.ZAxis, Amplitude=50)
vector_display = VectorDisplay(Anchor=deconstruct_plane.Origin, Vector=amplitude)

# ----
# approach plane
number_slider_14 = Slider(50, range=0..100)
deconstruct_plane_2 = DeconstructPlane(Plane=plane)  # -> Origin, XAxis, YAxis, ZAxis
amplitude_2 = Amplitude(Vector=deconstruct_plane_2.ZAxis, Amplitude=expr("-x", number_slider_14))
move_4 = Move(Geometry=plane, Motion=amplitude_2)  # -> Geometry, Transform

# ----
# stack
xy_plane_3 = XYPlane(Origin=list_item_12)
flip_plane = FlipPlane(Plane=xy_plane_3, ReverseX=False, ReverseY=False, SwapAxes=True)
list_length = ListLength(List=plane)
duplicate_data = DuplicateData(Data=flip_plane, Number=expr("x-1", list_length), Order=True)  # -> flatten(Data)

# ----
# inbetween plane
number_slider_15 = Slider(400, range=0..1000)
sphere_6 = Sphere(Base=point_9, Radius=number_slider_15)
tween_two_planes = TweenTwoPlanes(PlaneA=plane, PlaneB=flip_plane, Factor=0.5, Quaternion=Toggle(True))
volume = Volume(Geometry=sphere_6)  # -> Volume, Centroid
distance = Distance(PointA=tween_two_planes, PointB=volume.Centroid)
surface_closest_point = SurfaceClosestPoint(Point=tween_two_planes, Surface=sphere_6)  # -> Point, UVPoint, Distance
number_slider_16 = Slider(0, range=0..30)
smaller_than = SmallerThan(FirstNumber=distance, SecondNumber=number_slider_15)  # -> SmallerThan, OrEqualTo
plane_origin = PlaneOrigin(Base=tween_two_planes, Origin=surface_closest_point.Point)
list_item_13 = ListItem(List=plane_origin, Index=number_slider_16, Wrap=True)
list_item_14 = ListItem(List=plane, Index=number_slider_16, Wrap=True)
list_item_15 = ListItem(List=flip_plane, Index=number_slider_16, Wrap=True)
custom_preview_7 = CustomPreview(
    Geometry=[list_item_13, list_item_14, list_item_15],
    Material={diffuse=RGB(221, 160, 221), emission=RGB(66, 48, 66), shine=0.5, specular=RGB(255, 255, 255), transparency=0})

panel_38 = Panel("""0
1
2
3""")
weave = Weave(
    Pattern=panel_38,
    Stream0=duplicate_data,
    Stream1=move_4.Geometry,
    Stream2=plane,
    Stream3=move_4.Geometry,
    NullGaps=False)  # -> flatten(Weave)
panel_39 = Panel(weave)
split_list = SplitList(List=weave, Index="10")  # -> ListA, ListB
planes = RemoteSender(split_list.ListA)

planes_2 = RemoteReceiver(planes)
plane_2 = Plane(planes_2)
robot_1_4 = RemoteReceiver(robot_1)
panel_40 = Panel(planes_2)
python_3_script_8 = Python3Script(RobotName=robot_1_4, UpdateRoboDK=Toggle(False), PlanesList=plane_2)  # -> out, SuccessMessage, TargetPoses, Program, TCPOrientations, PlaneExtra; inputs PlanesList: list of Plane
# ---------- python_3_script_8: Python ----------
import robolink as rl    # RoboDK API for controlling and communicating with RoboDK  
import robodk as rdk     # RoboDK tools, such as matrix operations and other utilities
import Rhino.Geometry as rg  # Import Rhino.Geometry module as rg
import math

# === Inputs ===
# RobotName: Name of the robot in RoboDK (e.g., "UR5")
# UpdateRoboDK: Boolean toggle to execute the script and update RoboDK when True
# PlanesList: List of Rhino Plane objects (each plane contains both target point and orientation)

# Initialize outputs
SuccessMessage = ""
TargetPoses = []  # List of converted poses
Program = ""
TCPOrientations = []
TargetPointCoordinates = []
PlaneExtra = []  # Unreachable planes for other robots to attempt

# Function to convert Rhino Plane to RoboDK Pose (4x4 matrix)
def plane_to_pose(plane):
    """Converts a Rhino plane to a RoboDK pose (4x4 matrix)."""
    pose = rdk.Mat([
        [plane.XAxis.X, plane.YAxis.X, plane.ZAxis.X, plane.OriginX],
        [plane.XAxis.Y, plane.YAxis.Y, plane.ZAxis.Y, plane.OriginY],
        [plane.XAxis.Z, plane.YAxis.Z, plane.ZAxis.Z, plane.OriginZ],
        [0, 0, 0, 1]
    ])
    return pose

# Function to format the orientation of the TCP as strings for easy reporting
def format_tcp_orientation(plane, milestone):
    """Formats the TCP orientation (X, Y, Z axes) for a given milestone."""
    x_axis = plane.XAxis
    y_axis = plane.YAxis
    z_axis = plane.ZAxis
    return f"TCP orientation at {milestone}:\n  X-axis: {x_axis}\n  Y-axis: {y_axis}\n  Z-axis: {z_axis}"

# Function to format the target point coordinates {x, y, z} for reporting
def format_target_coordinates(plane, milestone):
    """Formats the target point coordinates as a string for a given milestone."""
    return f"{plane.OriginX}, {plane.OriginY}, {plane.OriginZ}"

# Check required inputs before proceeding
if not RobotName:
    SuccessMessage = "Error: RobotName is required."
elif not PlanesList or not isinstance(PlanesList, list):
    SuccessMessage = "Error: PlanesList must be a list of Rhino Plane objects."
elif any(not isinstance(plane, rg.Plane) for plane in PlanesList):
    SuccessMessage = "Error: All elements in PlanesList must be Rhino Plane objects."
elif UpdateRoboDK is None:
    SuccessMessage = "Error: UpdateRoboDK toggle is required."
elif not UpdateRoboDK:
    SuccessMessage = "UpdateRoboDK is set to False. No action taken."
else:
    # Connect to RoboDK only if UpdateRoboDK is True
    RDK = rl.Robolink()  # Initialize RoboDK connection
    SuccessMessage = "Connected to RoboDK."
    
    # Retrieve the robot by name
    robot = RDK.Item(RobotName, rl.ITEM_TYPE_ROBOT)
    
    if not robot.Valid():
        SuccessMessage += f"\nError: Could not find {RobotName} in RoboDK."
    else:
        SuccessMessage += f"\nFound robot '{robot.Name()}' in RoboDK."
        
        # Get the robot's base and tool
        robot_base = robot.Parent()
        tool = robot.getLink(rl.ITEM_TYPE_TOOL)
        
        # Check if the robot base and tool are valid
        if not robot_base.Valid():
            SuccessMessage += "\nError: Robot's base not found."
        else:
            SuccessMessage += f"\nRobot base: {robot_base.Name()}"

        if not tool.Valid():
            SuccessMessage += "\nError: Robot's tool not found."
        else:
            SuccessMessage += f"\nRobot tool: {tool.Name()}"

        # Enable collision detection in RoboDK
        RDK.setCollisionActive(1)

        if not robot_base.Valid() or not tool.Valid():
            SuccessMessage += "\nCannot proceed without valid base and tool."
        else:
            # Set the robot to its home position before starting
            robot.MoveJ(robot.JointsHome())

            # Get the robot base frame pose
            base_pose = robot_base.Pose()

            # Create a new program
            SuccessMessage += "\nCreating program in RoboDK..."
            program_name = "MoveThroughPlanesProgram"
            program = RDK.AddProgram(program_name, robot)
            program.setFrame(robot_base)  # Set the base frame of the robot
            program.setTool(tool)  # Set the tool of the robot

            # Process each plane in PlanesList independently
            for idx, plane in enumerate(PlanesList):
                # Convert plane to RoboDK pose
                target_pose_robot = plane_to_pose(plane)

                # Adjust the target pose with respect to the robot's base frame
                base_pose_inv = base_pose.inv()
                target_pose_relative = base_pose_inv * target_pose_robot

                # Check if the target is reachable
                try:
                    # Check if robot can reach the target pose (simulating this step)
                    robot.MoveJ(target_pose_relative, False)  # Simulation mode, does not execute actual motion
                    SuccessMessage += f"\nPlane {idx+1} reachable."
                except Exception as e:
                    # If an error occurs, consider the target unreachable
                    SuccessMessage += f"\nPlane {idx+1} unreachable. Error: {str(e)}"
                    PlaneExtra.append(plane)  # Add unreachable plane to PlaneExtra for another robot
                    continue  # Skip this plane and move to the next one

                # Store the pose
                TargetPoses.append(target_pose_relative)

                # Format TCP orientation and coordinates for reporting
                milestone = f"Plane {idx+1}"
                TCPOrientations.append(format_tcp_orientation(plane, milestone))
                TargetPointCoordinates.append(format_target_coordinates(plane, milestone))

                # Add the movement target in RoboDK
                target_name = f"Plane_{idx+1}"
                target = RDK.AddTarget(target_name, robot_base, robot)
                target.setAsCartesianTarget()
                target.setPose(target_pose_relative)

                # Add movements to the program independently
                program.MoveJ(target)  # Move to the target

            Program = program_name  # Assign the created program's name to the output
            SuccessMessage += f"\nProgram '{program_name}' created successfully."
# ---------- end python_3_script_8 ----------
plane_3 = Plane(python_3_script_8.PlaneExtra)
robot_3_4 = RemoteReceiver(robot_3)
panel_41 = Panel(python_3_script_8.SuccessMessage)
python_3_script_9 = Python3Script(RobotName=robot_3_4, UpdateRoboDK=Toggle(False), PlanesList=plane_2)  # -> out, SuccessMessage, TargetPoses, Program, TCPOrientations, PlaneExtra; inputs PlanesList: list of Plane
# ---------- python_3_script_9: Python ----------
import robolink as rl    # RoboDK API for controlling and communicating with RoboDK  
import robodk as rdk     # RoboDK tools, such as matrix operations and other utilities
import Rhino.Geometry as rg
import math

# === Inputs ===
# RobotName: Name of the robot in RoboDK (e.g., "UR5")
# UpdateRoboDK: Boolean toggle to execute the script and update RoboDK when True
# PlanesList: List of Rhino Plane objects (each plane contains both target point and orientation)

# Initialize outputs
SuccessMessage = ""
TargetPoses = []  # List of converted poses
Program = ""
TCPOrientations = []
TargetPointCoordinates = []
PlaneExtra = []  # Unreachable planes

# Function to convert Rhino Plane to RoboDK Pose (4x4 matrix)
def plane_to_pose(plane):
    """Converts a Rhino plane to a RoboDK pose (4x4 matrix)."""
    pose = rdk.Mat([
        [plane.XAxis.X, plane.YAxis.X, plane.ZAxis.X, plane.OriginX],
        [plane.XAxis.Y, plane.YAxis.Y, plane.ZAxis.Y, plane.OriginY],
        [plane.XAxis.Z, plane.YAxis.Z, plane.ZAxis.Z, plane.OriginZ],
        [0, 0, 0, 1]
    ])
    return pose

# Function to format the orientation of the TCP as strings for easy reporting
def format_tcp_orientation(plane, milestone):
    """Formats the TCP orientation (X, Y, Z axes) for a given milestone."""
    x_axis = plane.XAxis
    y_axis = plane.YAxis
    z_axis = plane.ZAxis
    return f"TCP orientation at {milestone}:\n  X-axis: {x_axis}\n  Y-axis: {y_axis}\n  Z-axis: {z_axis}"

# Function to format the target point coordinates {x, y, z} for reporting
def format_target_coordinates(plane, milestone):
    """Formats the target point coordinates as a string for a given milestone."""
    return f"{plane.OriginX}, {plane.OriginY}, {plane.OriginZ}"

# Check required inputs before proceeding
if not RobotName:
    SuccessMessage = "Error: RobotName is required."
elif not PlanesList or not isinstance(PlanesList, list):
    SuccessMessage = "Error: PlanesList must be a list of Rhino Plane objects."
elif any(not isinstance(plane, rg.Plane) for plane in PlanesList):
    SuccessMessage = "Error: All elements in PlanesList must be Rhino Plane objects."
elif UpdateRoboDK is None:
    SuccessMessage = "Error: UpdateRoboDK toggle is required."
elif not UpdateRoboDK:
    SuccessMessage = "UpdateRoboDK is set to False. No action taken."
else:
    # Connect to RoboDK only if UpdateRoboDK is True
    RDK = rl.Robolink()  # Initialize RoboDK connection
    SuccessMessage = "Connected to RoboDK."
    
    # Retrieve the robot by name
    robot = RDK.Item(RobotName, rl.ITEM_TYPE_ROBOT)
    
    if not robot.Valid():
        SuccessMessage += f"\nError: Could not find {RobotName} in RoboDK."
    else:
        SuccessMessage += f"\nFound robot '{robot.Name()}' in RoboDK."
        
        # Get the robot's base and tool
        robot_base = robot.Parent()
        tool = robot.getLink(rl.ITEM_TYPE_TOOL)
        
        # Check if the robot base and tool are valid
        if not robot_base.Valid():
            SuccessMessage += "\nError: Robot's base not found."
        else:
            SuccessMessage += f"\nRobot base: {robot_base.Name()}"

        if not tool.Valid():
            SuccessMessage += "\nError: Robot's tool not found."
        else:
            SuccessMessage += f"\nRobot tool: {tool.Name()}"

        # Enable collision detection in RoboDK
        RDK.setCollisionActive(1)

        if not robot_base.Valid() or not tool.Valid():
            SuccessMessage += "\nCannot proceed without valid base and tool."
        else:
            # Set the robot to its home position before starting
            robot.MoveJ(robot.JointsHome())

            # Get the robot base frame pose
            base_pose = robot_base.Pose()

            # Create a new program
            SuccessMessage += "\nCreating program in RoboDK..."
            program_name = "MoveThroughPlanesProgram"
            program = RDK.AddProgram(program_name, robot)
            program.setFrame(robot_base)  # Set the base frame of the robot
            program.setTool(tool)  # Set the tool of the robot

            # Process each plane in PlanesList independently
            for idx, plane in enumerate(PlanesList):
                # Convert plane to RoboDK pose
                target_pose_robot = plane_to_pose(plane)

                # Adjust the target pose with respect to the robot's base frame
                base_pose_inv = base_pose.inv()
                target_pose_relative = base_pose_inv * target_pose_robot

                # Check if the target is reachable
                try:
                    # Check if robot can reach the target pose (simulating this step)
                    robot.MoveJ(target_pose_relative, False)  # Simulation mode, does not execute actual motion
                    SuccessMessage += f"\nPlane {idx+1} reachable."
                except Exception as e:
                    # If an error occurs, consider the target unreachable
                    SuccessMessage += f"\nPlane {idx+1} unreachable. Error: {str(e)}"
                    PlaneExtra.append(plane)  # Add unreachable plane to PlaneExtra
                    continue  # Skip this plane and move to the next one

                # Store the pose
                TargetPoses.append(target_pose_relative)

                # Format TCP orientation and coordinates for reporting
                milestone = f"Plane {idx+1}"
                TCPOrientations.append(format_tcp_orientation(plane, milestone))
                TargetPointCoordinates.append(format_target_coordinates(plane, milestone))

                # Add the movement target in RoboDK
                target_name = f"Plane_{idx+1}"
                target = RDK.AddTarget(target_name, robot_base, robot)
                target.setAsCartesianTarget()
                target.setPose(target_pose_relative)

                # Add movements to the program independently
                program.MoveJ(target)  # Move to the target

            Program = program_name  # Assign the created program's name to the output
            SuccessMessage += f"\nProgram '{program_name}' created successfully."
# ---------- end python_3_script_9 ----------
panel_42 = Panel(python_3_script_9.SuccessMessage)

list_item_16 = ListItem(List=planes, Index=Slider(7, range=0..100), Wrap=True)
plane_4 = Plane(list_item_16)
