# Grasshopper definition script frames robot 2.gh (Grasshopper 1.0.8)
# plug-ins: Aggregations, RhinoCodePluginGH, Robots, Pufferfish

number_slider = Slider(1, range=0..2)

# ---- group: start point
pt = Point(Point(249.466321, -133.3987569, 0))

# ---- group: rigid points
pt_2 = Point([Point(249.466321, -133.3987569, 0), Point(-157.0095328, -133.3898906, 0.0319352034), Point(-563.5683872, -133.3834932, 0.0415148118), Point(-970.1281899, -133.389095, 0.04577497572), Point(249.4846082, -611.5255798, 0.03184347048), Point(249.4993476, -1089.745565, 0.04061380115), Point(249.5079734, -1567.965874, 0.0425283492), Point(249.5116749, -2046.184042, 0.04163521159)])

# ---- group: Full
crv = Curve([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])

# ----
scale = Scale(Geometry=pt_2, Center=Point(0, 0, 0), Factor=number_slider)  # -> Geometry, Transform
scale_2 = Scale(Geometry=crv, Center=Point(0, 0, 0), Factor=number_slider)  # -> Geometry, Transform

py3 = Python3Script(lines=scale_2.Geometry)  # -> P, C, simplify(count), networkx_graph; inputs lines: list of Curve
# ---------- py3: Python ----------
import rhinoscriptsyntax as rs
import Grasshopper as gh
import networkx as nx  # Importing NetworkX

def create_connectivity_graph(lines):
    # Create a list to store unique vertices
    vertices = []
    # Create a dictionary to store connections (graph edges)
    graph = {}
    # Create a dictionary to count edges for each vertex
    edge_counts = {}

    # Create a NetworkX graph
    G = nx.Graph()

    # Loop through all the input lines
    for line in lines:       
        # Get the start and end points of the line (edge)
        start_pt = rs.CurveStartPoint(line)
        end_pt = rs.CurveEndPoint(line)

        # Add start and end points to the vertices list if not already present
        if start_pt not in vertices:
            vertices.append(start_pt)
            graph[len(vertices) - 1] = []  # Initialize the adjacency list for this vertex
            edge_counts[len(vertices) - 1] = 0  # Initialize edge count

        if end_pt not in vertices:
            vertices.append(end_pt)
            graph[len(vertices) - 1] = []  # Initialize the adjacency list for this vertex
            edge_counts[len(vertices) - 1] = 0  # Initialize edge count
        
        # Get indices of start and end points in the vertices list
        start_idx = vertices.index(start_pt)
        end_idx = vertices.index(end_pt)
        
        # Create connectivity graph: adding edges to both vertices
        graph[start_idx].append(end_idx)
        graph[end_idx].append(start_idx)

        # Increment edge count for both vertices
        edge_counts[start_idx] += 1
        edge_counts[end_idx] += 1

        # Add the edge to the NetworkX graph using the point indices
        G.add_edge(start_idx, end_idx)

    # Convert edge counts to a list to match vertex order
    edge_count_list = [edge_counts[i] for i in range(len(vertices))]

    # Create a Grasshopper DataTree for the connectivity graph
    connectivity_tree = gh.DataTree[object]()
    for vertex_idx, connections in graph.items():
        for connection in connections:
            # Add connection to the tree
            connectivity_tree.Add(connection, gh.Kernel.Data.GH_Path(vertex_idx))

    return vertices, connectivity_tree, edge_count_list, G

# Grasshopper inputs
lines = lines  # Input list of lines representing edges

# Create connectivity graph based on input lines
vertices, graph, edge_counts, nx_graph = create_connectivity_graph(lines)

# Output the vertices in the same order as in the connectivity graph
P = vertices            # Vertices
C = graph               # Connectivity graph as a Grasshopper DataTree
count = edge_counts     # Count of edges for each vertex
networkx_graph = nx_graph  # NetworkX graph
# ---------- end py3 ----------
cp = ClosestPoint(Point=scale.Geometry, Cloud=py3.P)  # -> ClosestPoint, CPIndex, Distance
cp_2 = ClosestPoint(Point=pt, Cloud=py3.P)  # -> ClosestPoint, CPIndex, Distance
lng = ListLength(List=py3.P)
dup = DuplicateData(Data=Toggle(False), Number=lng, Order=True)
replace = ReplaceItems(List=dup, Item=Toggle(True), Indices=cp.CPIndex, Wrap=False)
py3_2 = Python3Script(
    graph=py3.networkx_graph,
    rigid_points=replace,
    start_point=cp_2.CPIndex,
    global_weight=Slider(0.5, range=0..1),
    local_weight=Slider(0.5, range=0..1),
    connection_weight=Slider(0.8, range=0..1),
    N=Slider(20, range=0..100))  # -> vertex_order, flatten(edge_order), simplify(edge_branches_rhino), flatten(edge_branches_python); inputs rigid_points: list of Boolean, start_point: Int32
# ---------- py3_2: Python ----------
import networkx as nx
import ghpythonlib.treehelpers as th

def iterative_rigid_connection(graph, rigid_points, start_point, distances, global_weight, local_weight, connection_weight, N):
    # Initialize lists to store the sequence of connected vertices and edges
    connection_sequence = []
    edge_addition_sequence = []  # To store the order of edges added to make a point rigid
    edge_branches = []  # To store edges in branches for each new rigid vertex

    # Ensure the starting point is marked as rigid and added to the connection sequence
    if not rigid_points[start_point]:  # Check if the starting point is rigid
        rigid_points[start_point] = True  # Mark it as rigid
        connection_sequence.append(start_point)  # Add to the sequence

    # Function to check if a vertex can be rigid based on its neighbors
    def can_be_rigid(node):
        neighbors = list(graph.neighbors(node))
        rigid_neighbors_count = sum(1 for n in neighbors if rigid_points[n])
        return rigid_neighbors_count >= 3

    # Iteratively find new rigid points, prioritizing based on global, local distances, and connection potential
    step_count = 0  # To track the number of steps
    while True:
        new_found = False  # Flag to track if any new vertices were found
        
        # Get the most recent point that was made rigid (for local distance calculation)
        last_rigid_point = connection_sequence[-1] if connection_sequence else start_point

        # Calculate local distances from the last rigid point
        local_distances = nx.single_source_shortest_path_length(graph, last_rigid_point)
        
        # Create a list of candidate nodes (non-rigid)
        candidates = [node for node in graph.nodes() if not rigid_points[node]]
        
        # Calculate weighted scores for candidates based on global distance, local distance, and connection potential
        candidates_weighted_score = []
        for node in candidates:
            local_distance = local_distances.get(node, float('inf'))
            potential_connections = sum(1 for n in graph.neighbors(node) if rigid_points[n])
            
            # Calculate the weighted score
            score = (
                global_weight * distances[node] + 
                local_weight * local_distance - 
                connection_weight * potential_connections
            )

            candidates_weighted_score.append((node, score))

        # Sort candidates by their weighted score
        candidates_weighted_score.sort(key=lambda x: x[1])

        # Try to find the next rigid point from the sorted candidates
        for node, score in candidates_weighted_score:
            if can_be_rigid(node):
                # Find the neighbors that are rigid to record the edges
                rigid_neighbors = [n for n in graph.neighbors(node) if rigid_points[n]]

                # Update the rigidity list and add to connection sequence
                rigid_points[node] = True
                connection_sequence.append(node)

                # Create a new branch for this rigid vertex
                branch_edges = []

                # Record the edges added to make this point rigid as tuples (neighbor, node)
                for neighbor in rigid_neighbors:
                    edge_addition_sequence.append((neighbor, node))  # Edge from neighbor to current node
                    branch_edges.append((neighbor, node))  # Add the tuple (neighbor, node)

                edge_branches.append(branch_edges)  # Store the branch corresponding to this new rigid vertex

                new_found = True  # A new point was found
                break  # Break out of the loop to check the new state of the system

        # Update global distances every N steps if N > 0
        if new_found and N > 0:
            step_count += 1  # Increment step count
            if step_count % N == 0:
                distances = compute_distances(graph, connection_sequence[-1])  # Update distances from the last added rigid point

        # Break the loop if no new rigid points were found
        if not new_found:
            break

    # Convert edge branches to Rhino Data Tree format using ghpythonlib
    edge_braches_python = edge_branches
    edge_branches_rhino = th.list_to_tree(edge_branches)

    return connection_sequence, edge_addition_sequence, edge_branches_rhino, edge_braches_python

# Compute distances from the start point to all other points in the graph
def compute_distances(graph, start_point_index):
    distances = nx.single_source_shortest_path_length(graph, start_point_index)
    distance_list = [None] * len(graph.nodes())
    for node in graph.nodes():
        distance_list[node] = distances.get(node, float('inf'))  # inf for unreachable nodes
    return distance_list

# Inputs
graph = graph  # The input NetworkX graph
rigid_points = rigid_points  # Boolean list indicating initial rigid points
start_point = start_point  # The starting point index
global_weight = global_weight  # Scalar multiplier for global distance
local_weight = local_weight  # Scalar multiplier for local distance
connection_weight = connection_weight  # Scalar multiplier for potential connections
N = N  # Step interval for updating global distances

# Get the distances from the start point to all other nodes
distances = compute_distances(graph, start_point)

# Find the step-by-step connections and the order of edges added, considering global, local distances, and connection potential
vertex_order, edge_order, edge_branches_rhino, edge_branches_python = iterative_rigid_connection(graph, rigid_points, start_point, distances, global_weight, local_weight, connection_weight, N)

# Outputs
vertex_order = vertex_order  
edge_order = edge_order  # Flat list of edges
edge_branches_rhino = edge_branches_rhino  #Branched edges in Rhino/GH data tree structure
edge_branches_python = edge_branches_python #Branched edges python can interpret
# ---------- end py3_2 ----------

# ----
# convert data
python_3_script = Python3Script(x_edges=py3_2.edge_branches_python, vertices=py3.P)  # -> out, a, b; inputs x_edges: list, x: list, vertices: list of Point3d
# ---------- python_3_script: Python ----------
import rhinoscriptsyntax as rs
from Grasshopper import DataTree
from Grasshopper.Kernel.Data import GH_Path

x_edges = x_edges
vertices = vertices

gh_lines = []

for branches in x_edges:
    gh_branches = []
    for edge in branches:
        # Get the start and end vertices from the current edge tuple
        start_vertex_edges = edge[0]
        end_vertex_edges = edge[1]

        # Create a line from start to end vertex_edges
        line = rs.AddLine(vertices[start_vertex_edges], vertices[end_vertex_edges])
        if line:  # Check if the line was created successfully
           gh_branches.append(line)
    gh_lines.append(gh_branches)


tree = DataTree[object]()

# Loop through the list and add items to branches
for i, sublist in enumerate(gh_lines):
    path = GH_Path(i)  # Create a new path for each branch
    for item in sublist:
        tree.Add(item, path)  # Add each item to the branch

# Output the tree
a = tree
print (gh_lines)
# ---------- end python_3_script ----------
list_item = ListItem(List=py3.P, Index=py3_2.vertex_order, Wrap=True)

value_list = ValueList({"bottom": 1, "top": 0}, selected="top")

# ----
# local picking order
line = Line(python_3_script.a)
curve_middle = CurveMiddle(Curve=line)
deconstruct = Deconstruct(Point=curve_middle)  # -> XComponent, YComponent, ZComponent
negative = Negative(Value=deconstruct.ZComponent)
stream_filter = StreamFilter(Gate=value_list, Stream0=negative, Stream1=deconstruct.ZComponent)
sort_list = SortList(Keys=stream_filter, ValuesLines=line, ValuesMid_points=curve_middle)  # -> Keys, ValuesLines, ValuesMid_points

# ----
# select group
# midpoints
number_slider_2 = Slider(13, range=0..100)
point = Point(sort_list.ValuesMid_points)
split_list = SplitList(List=flatten(point), Index=number_slider_2)  # -> ListA, ListB
split_list_2 = SplitList(List=flatten(sort_list.ValuesLines), Index=number_slider_2)  # -> ListA, ListB
data = Data(split_list.ListA)
data_2 = Data(split_list_2.ListA)

# ----
# path robot assembly
point_2 = Point(sort_list.ValuesMid_points)
average = Average(Input=point_2)
polyline = PolyLine(Vertices=flatten(average), Closed=False)
smooth_polyline = SmoothPolyline(Polyline=polyline, Strength=1, Times=Slider(10, range=0..10))
smooth_polyline_2 = SmoothPolyline(Polyline=polyline, Strength=1, Times=Slider(5, range=0..10))
custom_curve_preview = CustomCurvePreview(Curve=smooth_polyline, Colour=RGB(255, 0, 247))

tree_branch = TreeBranch(Tree=sort_list.ValuesLines, Path=Slider(4, range=0..10), MaintainPaths=True)
list_item_2 = ListItem(List=tree_branch, Index=Slider(0, range=0..10), Wrap=True)
panel = Panel("""0
1
2
3
4""")

# ---- group: Define the Tool
pt_3 = Point(Point(0, 0, 135))
xy = XYPlane(Origin=pt_3)
prot = RotatePlane(Plane=xy, Angle=degrees(90))
brep = Brep(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)
create_tool = CreateTool(Name="Gripper", TCP=prot, Weight="0.2", Mesh=brep)  # -> Tool, TCP

# ----
# orientation frames
# midpoints
# lines
point_3 = Point(data)
line_2 = Line(data_2)
end_points = EndPoints(Curve=line_2)  # -> graft(Start), graft(End)
negative_2 = Negative(Value="10000")
trim_tree = TrimTree(Tree=end_points.Start, Depth=1)
stream_filter_2 = StreamFilter(Gate=value_list, Stream0="10000", Stream1=negative_2)
unit_z = UnitZ(Factor=stream_filter_2)

# ----
# robot position point
number_slider_3 = Slider(600, range=0..1000)
bounding_box = BoundingBox(Content=flatten(data), Plane=PlaneXY(0, 0, 0), UnionBox=True)  # -> Box, Box_2
python_3_script_2 = Python3Script(points=data, min_dist=number_slider_3, max_dist=Slider(950, range=0..1000))  # -> out, new_point; inputs points: list of Point3d, min_dist: Double, max_dist: Double
# ---------- python_3_script_2: Python ----------
import Rhino.Geometry as rg

# Inputs:
# points: List of Point3d, the point cloud
# min_dist: Float, the minimum distance allowed from the new point
# max_dist: Float, the maximum distance allowed from the new point

def find_new_point(points, min_dist, max_dist):
    # Compute the bounding box of the point cloud to estimate the center
    bbox = rg.BoundingBox(points)
    center_point = bbox.Center
    print(center_point)
    
    # Start testing with the center of the bounding box
    candidate_point = center_point
    
    # Function to check if a point satisfies the distance criteria
    def check_distances(candidate, points, min_dist, max_dist):
        for pt in points:
            dist = candidate.DistanceTo(pt)
            if dist < min_dist or dist > max_dist:
                return False
        return True
    
    # If the center of the bounding box satisfies the distance range, return it
    if check_distances(candidate_point, points, min_dist, max_dist):
        return candidate_point
    
    # Try small perturbations if initial guess does not work
    step_size = 0.1  # You can adjust this based on the scale of the points
    for dx in range(-5, 6):
        for dy in range(-5, 6):
            for dz in range(-5, 6):
                candidate = rg.Point3d(center_point.X + dx * step_size, 
                                       center_point.Y + dy * step_size, 
                                       center_point.Z + dz * step_size)
                if check_distances(candidate, points, min_dist, max_dist):
                    return candidate
    
    # If no valid point is found, return None or raise an error
    return None

# Call the function to find the new point
new_point = find_new_point(points, min_dist, max_dist)
print(new_point)
# ---------- end python_3_script_2 ----------
unit_z_2 = UnitZ(Factor=expr("-x", Slider(620, range=0..1000)))
volume = Volume(Geometry=bounding_box.Box)  # -> Volume, Centroid
panel_2 = Panel(python_3_script_2.new_point)
move = Move(Geometry=volume.Centroid, Motion=unit_z_2)  # -> Geometry, Transform
point_4 = Point(python_3_script_2.new_point)
distance = Distance(PointA=data, PointB=move.Geometry)
sphere = Sphere(Base=move.Geometry, Radius=950)
point_5 = Point(Point(0, 0, 0))
sort_list_2 = SortList(Keys=distance)  # -> Keys, ValuesValuesA

move_2 = Move(Geometry=point_5, Motion=unit_z)  # -> Geometry, Transform
plane_3pt = Plane3Pt(PointA=point_3, PointB=trim_tree, PointC=move_2.Geometry)  # -> flatten(Plane)
rotate_plane_by_axis = RotatePlaneByAxis(Plane=plane_3pt, Axis="x", Angle=90)
plane = Plane(rotate_plane_by_axis)
deconstruct_plane = DeconstructPlane(Plane=plane)  # -> Origin, XAxis, YAxis, ZAxis
amplitude = Amplitude(Vector=deconstruct_plane.ZAxis, Amplitude=50)
vector_display = VectorDisplay(Anchor=deconstruct_plane.Origin, Vector=amplitude)

average_2 = Average(Input=distance)
division = Division(A=average_2, B="2")

panel_3 = Panel(division)

# ----
# approach plane
number_slider_4 = Slider(50, range=0..100)
deconstruct_plane_2 = DeconstructPlane(Plane=plane)  # -> Origin, XAxis, YAxis, ZAxis
amplitude_2 = Amplitude(Vector=deconstruct_plane_2.ZAxis, Amplitude=expr("-x", number_slider_4))
move_3 = Move(Geometry=plane, Motion=amplitude_2)  # -> Geometry, Transform

# ----
# stack
point_6 = Point(point_5)
move_4 = Move(Geometry=point_6, Motion=Vector(400, 0, 50))  # -> Geometry, Transform
xy_plane = XYPlane(Origin=move_4.Geometry)
flip_plane = FlipPlane(Plane=xy_plane, ReverseX=False, ReverseY=False, SwapAxes=True)
lng_2 = ListLength(List=plane)
duplicate_data = DuplicateData(Data=flip_plane, Number=expr("x-1", lng_2), Order=True)  # -> flatten(Data)

# ----
# inbetween plane
number_slider_5 = Slider(445, range=0..1000)
tween_two_planes = TweenTwoPlanes(PlaneA=plane, PlaneB=flip_plane, Factor=0.5, Quaternion=False)
sphere_2 = Sphere(Base=point_5, Radius=number_slider_5)
volume_2 = Volume(Geometry=sphere_2)  # -> Volume, Centroid
distance_2 = Distance(PointA=tween_two_planes, PointB=volume_2.Centroid)
surface_closest_point = SurfaceClosestPoint(Point=tween_two_planes, Surface=sphere_2)  # -> Point, UVPoint, Distance
number_slider_6 = Slider(0, range=0..30)
smaller_than = SmallerThan(FirstNumber=distance_2, SecondNumber=number_slider_5)  # -> SmallerThan, OrEqualTo
plane_origin = PlaneOrigin(Base=tween_two_planes, Origin=surface_closest_point.Point)
list_item_3 = ListItem(List=plane_origin, Index=number_slider_6, Wrap=True)
list_item_4 = ListItem(List=plane, Index=number_slider_6, Wrap=True)
list_item_5 = ListItem(List=flip_plane, Index=number_slider_6, Wrap=True)

weave = Weave(
    Pattern=panel,
    Stream0=duplicate_data,
    Stream1=plane_origin,
    Stream2=move_3.Geometry,
    Stream3=plane,
    Stream4=move_3.Geometry,
    NullGaps=False)  # -> flatten(Weave)

custom_preview = CustomPreview(
    Geometry=[list_item_3, list_item_4, list_item_5],
    Material={diffuse=RGB(221, 160, 221), emission=RGB(66, 48, 66), shine=0.5, specular=RGB(255, 255, 255), transparency=0})

# ---- group: Create the list of movement types (Linear or Joint) in correct order
merge = Merge(Data1="Joint", Data2="Joint", Data3="Linear", Data4="Joint", Data5="Linear")
lng_3 = ListLength(List=weave)
duplicate_data_2 = DuplicateData(Data=merge, Number=expr("x/4", lng_3), Order=True)

# ---- group: Load the robot
list = RobotsLibrary({"AA-KR60", "AA-KR30", "AA-KR60_KR30", "TUDelft-LAMA-UR5"}, selected="TUDelft-LAMA-UR5", Type=0)
loadrobot = LoadRobotSystem(Name=list, Base=point_6)

# ----
point_list = PointList(Points=plane_origin, Size=20)
point_list_2 = PointList(Points=plane, Size=20)

# ---- group: Define the targets and their variables
list_2 = FlagFields({"Shoulder": 1, "Elbow": 2, "Wrist": 4}, selected="Shoulder")
speed_mm_s = Slider(90, range=0..100)
create_target = CreateTarget(Plane=weave, RobConf=list_2, Motion=duplicate_data_2, Tool=create_tool.Tool, Speed=speed_mm_s, IsCartesian=True)

# ---- group: Create the robot program
create_program = CreateProgram(Name="UR5", RobotSystem=loadrobot, Targets=create_target, StepSize=1)  # -> Program, Code, Duration, Warnings, Errors

# ---- group: Simulate the robot program
program_simulation = ProgramSimulation(Program=create_program.Program, Time=0, Normalized=True)  # -> SystemMeshes, JointRotations, Plane, Index, Time, Program, Errors
simple_trail = SimpleTrail(Program=program_simulation.Program, Length=500, MechanicalGroup=0)

# ---- group: Connect and control the robot
boolean_toggle = BooleanToggle(False)  # disabled
button = Button()  # disabled
button_2 = Button()  # disabled
panel_4 = Panel("192.168.1.100")  # disabled
remote_connection = RemoteConnection(Program=create_program.Program, IP=panel_4, Upload=boolean_toggle, Play=button, Pause=button_2)  # disabled

# ----
panel_5 = Panel(create_program.Errors)
list_length = ListLength(List=merge)
evaluate = Evaluate(Expression="(x-1)/y", x=program_simulation.Index, y=list_length)
subtraction = Subtraction(A=program_simulation.Index, B="1")

# ----
# Display
number_slider_7 = Slider(26, range=0..150)
data_3 = Data(evaluate)
split_list_3 = SplitList(Index=data_3)  # -> ListA, ListB
split_list_4 = SplitList(List=flatten(plane), Index=data_3)  # -> ListA, ListB
split_list_5 = SplitList(List=flatten(line_2), Index=data_3)  # -> ListA, ListB
list_item_6 = ListItem(List=weave, Index=Slider(0, range=0..100), Wrap=True)
list_item_7 = ListItem(List=flatten(split_list_5.ListA), Index=-1, Wrap=True)
custom_preview_2 = CustomPreview(
    Geometry=[split_list_4.ListA, split_list_3.ListA],
    Material={diffuse=RGB(221, 160, 221), emission=RGB(66, 48, 66), shine=0.5, specular=RGB(255, 255, 255), transparency=0})
list_item_8 = ListItem(List=split_list_3.ListA, Index=-1, Wrap=True)
list_item_9 = ListItem(List=split_list_4.ListA, Index=-1, Wrap=True)
deconstruct_plane_3 = DeconstructPlane(Plane=list_item_6)  # -> Origin, XAxis, YAxis, ZAxis
deconstruct_plane_4 = DeconstructPlane(Plane=split_list_4.ListA)  # -> Origin, XAxis, YAxis, ZAxis
custom_preview_3 = CustomPreview(
    Geometry=list_item_8,
    Material={diffuse=RGB(111, 0, 255), emission=RGB(33, 0, 76), shine=0.5, specular=RGB(255, 255, 255), transparency=0})
custom_preview_4 = CustomPreview(
    Geometry=list_item_9,
    Material={diffuse=RGB(111, 0, 255), emission=RGB(33, 0, 76), shine=0.5, specular=RGB(255, 255, 255), transparency=0})
custom_preview_5 = CustomPreview(
    Geometry=list_item_7,
    Material={diffuse=RGB(111, 0, 255), emission=RGB(33, 0, 76), shine=0.5, specular=RGB(255, 255, 255), transparency=0})
vector_display_2 = VectorDisplay(Anchor=deconstruct_plane_3.Origin, Vector=deconstruct_plane_3.ZAxis)
vector_display_3 = VectorDisplay(Anchor=deconstruct_plane_4.Origin, Vector=deconstruct_plane_4.ZAxis)

pipe = Pipe(Curve=split_list_5.ListA, Radius=5, Caps=0)

custom_preview_6 = CustomPreview(
    Geometry=pipe,
    Material={diffuse=RGB(221, 160, 221), emission=RGB(66, 48, 66), shine=0.5, specular=RGB(255, 255, 255), transparency=0})
