# Grasshopper definition 211024_RoboticAssembly_Prototype.gh (Grasshopper 1.0.8)
# plug-ins: Aggregations, RhinoCodePluginGH, Pufferfish, Human, MetaHopper, Kangaroo2 Components, Palette, Telepathy

panel = Panel("""absl-py==2.1.0
asttokens==2.4.1
astunparse==1.6.3
attrs==24.2.0
cachetools==5.5.0
certifi==2024.8.30
charset-normalizer==3.3.2
click-plugins==1.1.1
click==8.1.7
cligj==0.7.2
colorama==0.4.6
comm==0.2.2
contourpy==1.3.0
cycler==0.12.1
decorator==5.1.1
dm-tree==0.1.8
docstring-parser==0.16
etils==1.9.4
exceptiongroup==1.2.2
executing==2.1.0
filelock==3.16.0
fiona==1.10.1
flatbuffers==24.3.25
fonttools==4.53.1
fsspec==2024.9.0
gast==0.4.0
geographiclib==2.0
geopandas==1.0.1
geopy==2.4.1
ghhops-server==1.5.5
google-auth-oauthlib==0.4.6
google-auth==2.34.0
google-pasta==0.2.0
grpcio==1.66.1
h5py==3.11.0
idna==3.8
immutabledict==4.2.0
importlib-resources==6.4.5
iopath==0.1.10
ipympl==0.9.4
ipython-genutils==0.2.0
ipython==8.27.0
ipywidgets==8.1.5
jedi==0.19.1
jinja2==3.1.4
jupyterlab-widgets==3.0.13
keras-preprocessing==1.1.2
keras==2.10.0
kiwisolver==1.4.7
libclang==18.1.1
lxml==5.3.0
markdown-it-py==3.0.0
markdown==3.7
markupsafe==2.1.5
matplotlib-inline==0.1.7
matplotlib==3.9.2
mdurl==0.1.2
ml-dtypes==0.4.0
mpmath==1.3.0
namex==0.0.8
networkx==3.2.1
numpy==2.0.2
oauthlib==3.2.2
openexr==3.2.4
opt-einsum==3.3.0
optree==0.12.1
owslib==0.31.0
packaging==24.1
pandas==2.2.2
parso==0.8.4
pillow==10.4.0
pip==24.2
portalocker==2.10.1
promise==2.3
prompt-toolkit==3.0.47
protobuf==3.19.6
psutil==6.0.0
pure-eval==0.2.3
pyarrow==17.0.0
pyasn1-modules==0.4.0
pyasn1==0.6.0
pydot==3.0.1
pygame==2.6.1
pygments==2.18.0
pygraphviz==1.14rc0.dev0
pyogrio==0.10.0
pyopengl-accelerate==3.1.7
pyopengl==3.1.7
pyparsing==3.1.4
pyproj==3.7.0
pyqt5-qt5==5.15.2
pyqt5-sip==12.15.0
pyqt5==5.15.11
pyqtgraph==0.13.7
python-dateutil==2.9.0.post0
pytz==2024.1
pywin32==306
pyyaml==6.0.2
requests-oauthlib==2.0.0
requests==2.32.3
rhino3dm==8.9.0
rich==13.8.0
robodk==5.7.5
rsa==4.9
scipy==1.14.1
setuptools==65.5.0
shapely==2.0.6
simple-parsing==0.1.6
six==1.16.0
stack-data==0.6.3
sympy==1.13.2
tensorboard-data-server==0.6.1
tensorboard-plugin-wit==1.8.1
tensorboard==2.10.1
tensorflow-addons==0.22.0
tensorflow-datasets==4.9.6
tensorflow-estimator==2.10.0
tensorflow-gpu==2.10.1
tensorflow-graphics==2021.12.3
tensorflow-io-gcs-filesystem==0.31.0
tensorflow-metadata==1.15.0
termcolor==2.4.0
toml==0.10.2
torch==2.0.1+cu117
torchaudio==2.0.2+cu117
torchvision==0.15.2+cu117
tqdm==4.66.5
traitlets==5.14.3
trimesh==4.4.9
typeguard==2.13.3
typing-extensions==4.12.2
tzdata==2024.1
urllib3==2.2.2
visual-kinematics==0.2.1
vtk==9.3.1
wcwidth==0.2.13
werkzeug==3.0.4
wheel==0.44.0
widgetsnbextension==4.0.13
wrapt==1.16.0
zipp==3.20.1""")
palette = Palette(
    ModeCustomStandard=Toggle(True),
    Component_Normal_Deselected_Fill_Color=RGB(200, 200, 200),
    Component_Normal_Deselected_Edge_Color=RGB(50, 50, 50),
    Component_Normal_Deselected_Text_Color=RGB(0, 0, 0),
    Component_Normal_Selected_Fill_Color=RGB(130, 215, 50),
    Component_Normal_Selected_Edge_Color=RGB(0, 50, 0),
    Component_Normal_Selected_Text_Color=RGB(0, 25, 0),
    Component_Hidden_Deselected_Fill_Color=RGB(140, 140, 155),
    Component_Hidden_Deselected_Edge_Color=RGB(35, 35, 35),
    Component_Hidden_Deselected_Text_Color=RGB(0, 0, 0),
    Component_Hidden_Selected_Fill_Color=RGB(80, 180, 10),
    Component_Hidden_Selected_Edge_Color=RGB(0, 35, 0),
    Component_Hidden_Selected_Text_Color=RGB(0, 25, 0),
    Component_Disabled_Deselected_Fill_Color=RGB(120, 120, 120),
    Component_Disabled_Deselected_Edge_Color=RGB(90, 90, 90),
    Component_Disabled_Deselected_Text_Color=RGB(70, 70, 70),
    Component_Disabled_Selected_Fill_Color=RGB(110, 150, 115),
    Component_Disabled_Selected_Edge_Color=RGB(40, 70, 40),
    Component_Disabled_Selected_Text_Color=RGB(75, 100, 65),
    Component_Warning_Deselected_Fill_Color=RGB(255, 140, 20),
    Component_Warning_Deselected_Edge_Color=RGB(80, 10, 0),
    Component_Warning_Deselected_Text_Color=RGB(0, 0, 0),
    Component_Warning_Selected_Fill_Color=RGB(185, 205, 0),
    Component_Warning_Selected_Edge_Color=RGB(0, 50, 0),
    Component_Warning_Selected_Text_Color=RGB(0, 0, 0),
    Component_Error_Deselected_Fill_Color=RGB(200, 0, 0),
    Component_Error_Deselected_Edge_Color=RGB(60, 0, 0),
    Component_Error_Deselected_Text_Color=RGB(0, 0, 0),
    Component_Error_Selected_Fill_Color=RGB(125, 155, 0),
    Component_Error_Selected_Edge_Color=RGB(0, 50, 0),
    Component_Error_Selected_Text_Color=RGB(255, 255, 255),
    Component_Label_Deselected_Fill_Color=RGB(50, 50, 50),
    Component_Label_Deselected_Edge_Color=RGB(0, 0, 0),
    Component_Label_Deselected_Text_Color=RGB(255, 255, 255),
    Component_Label_Selected_Fill_Color=RGB(25, 60, 25),
    Component_Label_Selected_Edge_Color=RGB(0, 35, 0),
    Component_Label_Selected_Text_Color=RGB(190, 250, 180),
    Galapagos_Deselected_Fill_Color=RGB(255, 0, 125),
    Galapagos_Deselected_Edge_Color=RGB(100, 0, 50),
    Galapagos_Selected_Fill_Color=RGB(160, 210, 30),
    Galapagos_Selected_Edge_Color=RGB(0, 50, 0),
    Wire_Normal_Color=RGBA(0, 0, 0, 150),
    Wire_Empty_Color=RGBA(255, 60, 0, 180),
    Wire_Selected_Start_Color=RGB(125, 210, 40),
    Wire_Selected_End_Color=RGBA(0, 0, 0, 50),
    Panel_Default_Color=RGB(255, 250, 90),
    Group_Default_Color=RGBA(255, 255, 255, 150),
    Canvas_Background_Color=RGB(84, 84, 84),
    Canvas_Gridline_Color=RGBA(0, 0, 0, 30),
    Canvas_Gridline_Width=150,
    Canvas_Gridline_Height=50,
    Canvas_Edge_Color=RGB(255, 255, 255),
    Canvas_Shadow_Color=RGBA(0, 0, 0, 80),
    Canvas_Shadow_Size=30,
    MonochromaticOnOff=False,
    Monochromatic_Color=RGB(212, 208, 200))

value_list = ValueList({"UR5 A": 0, "UR5 B": 1, "COMAU": 2, "COWORKING": 3}, selected="UR5 A")
value_list_2 = ValueList({"UR5 A": 0, "UR5 B": 1, "COMAU": 2, "COWORKING": 3}, selected="UR5 B")
panel_2 = Panel("""UR5 A
COMAU""")
stream_filter = StreamFilter(Gate=value_list, Stream0="UR5 A", Stream1="UR5 B", Stream2="COMAU", Stream3=panel_2)
stream_filter_2 = StreamFilter(Gate=value_list_2, Stream0="UR5 A", Stream1="UR5 B", Stream2="COMAU", Stream3=panel_2)
robot_1 = RemoteSender(stream_filter)
robot_2 = RemoteSender(stream_filter_2)

# ----
# Robot Setup & Base Sync
value_list_3 = ValueList({"UR5 A": 0, "UR5 B": 1, "COMAU": 2, "COWORKING": 3}, selected="COMAU")
stream_filter_3 = StreamFilter(Gate=value_list_3, Stream0="UR5 A", Stream1="UR5 B", Stream2="COMAU", Stream3=panel_2)
robot_3 = RemoteSender(stream_filter_3)

dynamic_geometry_pipeline = DynamicGeometryPipeline(
    LayerFilter="Structure::Lines",
    TypeFilter="Curve",
    NameFilter="*",
    GroupByLayer=False,
    GroupByType=False,
    IncludeHidden=True,
    IncludeLocked=True,
    enableFullPath=True,
    listenToAttributes=True)  # disabled
dynamic_geometry_pipeline_2 = DynamicGeometryPipeline(
    LayerFilter="Structure::Rigid",
    TypeFilter="Point",
    NameFilter="*",
    GroupByLayer=False,
    GroupByType=False,
    IncludeHidden=True,
    IncludeLocked=True,
    enableFullPath=True,
    listenToAttributes=True)  # disabled
dynamic_geometry_pipeline_3 = DynamicGeometryPipeline(
    LayerFilter="Structure::Start",
    TypeFilter="Point",
    NameFilter="*",
    GroupByLayer=False,
    GroupByType=False,
    IncludeHidden=True,
    IncludeLocked=True,
    enableFullPath=True,
    listenToAttributes=True)  # disabled

# ----
# Prototype Base
number_slider = Slider(200, range=-600..600)
unit_z = UnitZ(Factor=number_slider)
curve = Curve(<curve referenced from the Rhino model>)
extrude = Extrude(Base=curve, Direction=unit_z)
offset_surface = OffsetSurface(Surface=extrude, Distance=Slider(20, range=0..200), BothSides=Toggle(False), CreateSolid=Toggle(True))
custom_preview = CustomPreview(Geometry=offset_surface, Material=ColourSwatch(SwatchColor=RGB(255, 255, 255)))  # disabled
deconstruct_brep = DeconstructBrep(Brep=offset_surface)  # -> flatten(Faces), Edges, Vertices
populate_2d = Populate2D(Region=deconstruct_brep.Faces, Count=Slider(40, range=0..100), Seed=1)  # -> flatten(Population)
point = Point(populate_2d)  # disabled

curve_2 = Curve([<curve referenced from the Rhino model> x3])
curve_3 = Curve([<curve referenced from the Rhino model> x3])
curve_4 = Curve([<curve referenced from the Rhino model> x3])
curve_5 = Curve([<curve referenced from the Rhino model> x4])
curve_6 = Curve([<curve referenced from the Rhino model> x3])
curve_7 = Curve([<curve referenced from the Rhino model> x4])

point_2 = Point([<point referenced from the Rhino model> x3])
py3 = Python3Script(
    in_lines=dynamic_geometry_pipeline,
    in_rigid_points=dynamic_geometry_pipeline_2,
    in_start_point=dynamic_geometry_pipeline_3)  # -> out, assembly_steps, ordered_nodes; inputs in_lines: list of Line, in_rigid_points: list of Point3d, in_start_point: Point3d; disabled
# ---------- py3: Python ----------
# requirements: networkx
# requirements: numpy
import rhinoscriptsyntax as rs
import Grasshopper as gh
import Grasshopper.Kernel as ghk
from Grasshopper.Kernel.Data import GH_Path
import Rhino.Geometry as rg
import networkx as nx
from collections import Counter
import math
import numpy as np
import itertools
from itertools import combinations

class Trussemble:
    def __init__(self, lines, rigid_points, start_point):
        ## inputs
        self.lines = lines
        self.points, self.connection_tree = self.__get_line_connectivity()
        self.rigid_points = rigid_points
        self.rigid_indices = self.__get_rigid_point_indices()
        self.start_point = start_point
        ## outputs
        self.graph = self.__turn_tree_to_graph(self.connection_tree)
        self.assembly_steps = gh.DataTree[object]()
        self.processed_nodes = []
    
    def __average_point(self, pt1, pt2, pt3): 
            # Calculate the average of the x, y, and z coordinates
            avg_x = (pt1.X + pt2.X + pt3.X) / 3
            avg_y = (pt1.Y + pt2.Y + pt3.Y) / 3
            avg_z = (pt1.Z + pt2.Z + pt3.Z) / 3
            
            # Return the average point as a Point3d
            average_point = rg.Point3d(avg_x, avg_y, avg_z)
            return average_point

    def __get_rigid_point_indices(self):
        rigid_indices = []
        points_array = np.array([[pt.X, pt.Y, pt.Z] for pt in self.points])

        for rigid_point in self.rigid_points:
            if rigid_point in self.points:
                rigid_indices.append(self.points.index(rigid_point))
            else:
                rigid_point_array = np.array([rigid_point.X, rigid_point.Y, rigid_point.Z])
                distances = np.linalg.norm(points_array - rigid_point_array, axis=1)
                rigid_idx = np.argmin(distances)
                rigid_indices.append(rigid_idx)
        return rigid_indices

    def __get_line_connectivity(self):
        """
        Create a connectivity tree from a set of lines and return unique points as Point3d and 
        a Grasshopper data structure containing the connectivity information.

        lines: A list of line objects in Rhino.

        Returns a tuple containing a list of unique Point3d and a GH_Structure for connectivity.
        """
        lines = self.lines
        connectivity_tree = gh.DataTree[object]()
        unique_points = {}  # Use a dictionary to map points to their indices


        # Iterate through each line
        for line_index, line in enumerate(lines):
            # Get the start and end points of the line
            start_point = line.From
            end_point = line.To
            
            # Convert to Point3d objects
            start_point3d = rg.Point3d(start_point.X, start_point.Y, start_point.Z)
            end_point3d = rg.Point3d(end_point.X, end_point.Y, end_point.Z)

            # Add points to the unique points dictionary if they don't already exist
            if start_point3d not in unique_points:
                unique_points[start_point3d] = len(unique_points)
            if end_point3d not in unique_points:
                unique_points[end_point3d] = len(unique_points)
            
            # Get the indices of the start and end points
            start_index = unique_points[start_point3d]
            end_index = unique_points[end_point3d]

            # Append the indices to the connectivity tree
            connectivity_tree.EnsurePath(GH_Path(line_index))  # Create a new branch for the line index
            connectivity_tree.AddRange([start_index, end_index], GH_Path(line_index))

        # Convert unique points to a list of Point3d
        unique_points_list = list(unique_points.keys())

        return unique_points_list, connectivity_tree

    def __can_node_be_rigid(self, node):
        if node in self.rigid_indices:
            return True
        else:
            graph = self.graph
            neighbours = list(graph.neighbors(node))
            count_existing_neighbours = sum(1 for neighbour in neighbours if neighbour in self.processed_nodes)
            return count_existing_neighbours >= 3

    def __turn_tree_to_graph(self, connections_tree):
        ## turns connections tree input into networkx graph, connections should be implemented in python (ideally) without use of heteroptera or proximity 2-d
        list_of_tuples = []

        for i in range(connections_tree.BranchCount):
            branch = connections_tree.Branch(i) 
            
            if len(branch) == 2:
                list_of_tuples.append(tuple(branch))
        
        G = nx.Graph()
        G.add_edges_from(list_of_tuples)
        return G

    def __get_first_move(self): 
        start_point = self.start_point
        rigid_ids = self.rigid_indices
        points = self.points
        graph = self.graph

        min_avg_distance_to_start = float('inf')
        neighbours_to_connect_to = []
        first_supports = None

        def find_common_neighbour_combinations(graph, rigid_points_indices):
            valid_combinations = []
            common_neighbors = []
            
            # Generate all combinations of three nodes from rigid_points
            for comb in combinations(rigid_points_indices, 3):
                # Get neighbors for each node in the combination
                neighbors_1 = set(graph.neighbors(comb[0]))
                neighbors_2 = set(graph.neighbors(comb[1]))
                neighbors_3 = set(graph.neighbors(comb[2]))
                
                # Find common neighbors
                common_neighbor = neighbors_1 & neighbors_2 & neighbors_3
                
                # If there is at least one common neighbor, add the combination to the result
                if common_neighbor:
                    valid_combinations.append(comb)
                    common_neighbors.append(list(common_neighbor)[0])

            return valid_combinations, common_neighbors
                
        starting_three_candidates, common_neighbours = find_common_neighbour_combinations(graph, rigid_ids)

        for i, starting_three in enumerate(starting_three_candidates):
            p1 = points[starting_three[0]]
            p2 = points[starting_three[1]]
            p3 = points[starting_three[2]]

            centre = self.__average_point(p1, p2, p3)

            avg_distance = rs.Distance(start_point, centre)
            if avg_distance < min_avg_distance_to_start:
                min_avg_distance_to_start = avg_distance
                first_supports = starting_three
                neighbours_to_connect_to.append(list([common_neighbours[i]]))

        neighbour_to_connect_to = neighbours_to_connect_to[-1][0]

        self.processed_nodes.extend(first_supports)
        self.processed_nodes.append(neighbour_to_connect_to)
        return list(first_supports), neighbour_to_connect_to

    def __check_missing_edges(self, sub_graph_edges):
        graph = self.graph
        edges_to_add = []

        for node1, node2 in combinations(sub_graph_edges, 2):
            if graph.has_edge(node1, node2):
                edges_to_add.append((node1, node2))

        return edges_to_add

    def __find_unprocessed_neighbors_subgraphs(self):
        graph = self.graph
        processed_nodes = self.processed_nodes
        processed_nodes_set = set(processed_nodes)
        points = self.points
        
        # Step 1: Find neighbors of the processed nodes that are not yet processed
        unprocessed_neighbors = set()

        # Get the last processed node and find its neighbors first
        last_node = processed_nodes[-1]
        neighbors_last_node = set(graph.neighbors(last_node))
        unprocessed_neighbors_last_node = neighbors_last_node - processed_nodes_set

        # Find unprocessed neighbors of all other nodes
        for node in processed_nodes_set:
            if node == last_node:
                continue  # Skip the last node as we already processed it
            neighbors = set(graph.neighbors(node))
            unprocessed_neighbors.update(neighbors - processed_nodes_set)

        # Add unprocessed neighbors of the last node to the main unprocessed set
        unprocessed_neighbors.update(unprocessed_neighbors_last_node)

        # Step 2: Create subgraphs by finding connected components
        subgraphs = []
        
        # Subgraph that includes only unprocessed neighbors
        unprocessed_subgraph = graph.subgraph(unprocessed_neighbors)
        
        # Find connected components in the unprocessed subgraph
        for component in nx.connected_components(unprocessed_subgraph):
            subgraphs.append(list(component))
        
        # Step 3: Ensure the subgraph connected to the last node in processed_nodes comes first
        subgraphs_sorted = []
        
        # Subgraph connected to the last processed node
        subgraph_last_node = [comp for comp in subgraphs if any(node in unprocessed_neighbors_last_node for node in comp)]
        
        # Remaining subgraphs (not connected to the last node)
        other_subgraphs = [comp for comp in subgraphs if comp not in subgraph_last_node]
        
        # Sort the final output
        if subgraph_last_node:
            subgraphs_sorted.extend(subgraph_last_node)
            subgraphs_sorted.extend(other_subgraphs)
            return subgraphs_sorted[0]
        else:
            closest_distance = float('inf')
            first_comp = None
            for comp in subgraphs:
                for node in comp:
                    distance = (points[last_node] - points[node]).Length
                    if distance < closest_distance:
                        first_comp = comp
                        closest_distance = distance
            return first_comp

    def __get_possible_connections(self, node):
        graph = self.graph
        can_connect_to = [neighbour for neighbour in graph.neighbors(node) if neighbour in self.processed_nodes]
        return can_connect_to

    def __sort_rigid_candidates(self, candidates):
        origin = self.processed_nodes[-1]
        points = self.points

        def distance_to_origin(c):
            return (points[origin] - points[c]).Length

        sorted_candidates = sorted(candidates, key=distance_to_origin)
        return sorted_candidates

    def __get_sorted_supports(self, candidate, supports):
        support_combinations = list(itertools.combinations([x for x in range(len(supports))], 3))
        score_per_combination = {}
        result_supports = []

        def get_combined_distance_to_supports(supports):
            support_coords = np.array([[pt.X, pt.Y, pt.Z] for pt in supports])
            num_supports = len(support_coords)
            diff = support_coords[:, np.newaxis, :] - support_coords[np.newaxis, :, :]
            distances = np.linalg.norm(diff, axis=2)
            # Avoid multiplying by zero by adding small epsilon
            distances += np.eye(num_supports) * 1e-8
            combined_distance = np.prod(distances)
            return combined_distance

        def triangle_area(rs_pointA, rs_pointB, rs_pointC):
            A = np.array([rs_pointA.X, rs_pointA.Y, rs_pointA.Z])
            B = np.array([rs_pointB.X, rs_pointB.Y, rs_pointB.Z])
            C = np.array([rs_pointC.X, rs_pointC.Y, rs_pointC.Z])
            area = 0.5 * np.linalg.norm(np.cross(B - A, C - A))
            return area

        for c in support_combinations:
            supports_list = [supports[c[0]], supports[c[1]], supports[c[2]]]

            combined_distance = float(get_combined_distance_to_supports(supports_list))
            area = float(triangle_area(supports_list[0], supports_list[1], supports_list[2]))
            if area == 0.0:
                score = combined_distance
            else:
                score = combined_distance / area
            score_per_combination[c] = score
        
        score_per_combination = dict(sorted(score_per_combination.items(), key=lambda item: item[1]))

        support_combinations = list(score_per_combination.keys())
        for support_combination in support_combinations:
            result_support = list(support_combination)
            for i, support in enumerate(supports):

                if i not in support_combination:
                    result_support.append(i)

                result_supports.append(result_support)

        return result_supports[0]

    def __check_if_door(self, support_nodes, load_node):
        support_points = [self.points[x] for x in support_nodes]
        load_point = self.points[load_node]
        combination = []

        def point_plane_distance(plane_pts, test_pt):
            A, B, C = plane_pts
            AB = B - A
            AC = C - A
            normal_vector = rg.Vector3d.CrossProduct(AB, AC)
            if normal_vector.IsZero:
                return 0.0
            normal_vector.Unitize()
            D = - (normal_vector.X * A.X + normal_vector.Y * A.Y + normal_vector.Z * A.Z)
            numerator = abs(normal_vector.X * test_pt.X + normal_vector.Y * test_pt.Y + normal_vector.Z * test_pt.Z + D)
            distance = numerator  # Since normal_vector is unitized, denominator is 1
            return distance

        def distance_to_centroid(pts, test_pt):
            centroid = rg.Point3d((pts[0].X + pts[1].X + pts[2].X) / 3,
                                  (pts[0].Y + pts[1].Y + pts[2].Y) / 3,
                                  (pts[0].Z + pts[1].Z + pts[2].Z) / 3)
            distance = (test_pt - centroid).Length
            return distance

        def is_door(three_supports, load_point, span_height_ratio=0.25):
            distance = point_plane_distance(three_supports, load_point)
            effective_span = distance_to_centroid(three_supports, load_point)
            if effective_span == 0:
                return False
            ratio = distance / effective_span
            return ratio <= span_height_ratio

        first_three = support_points[:3]
        if not is_door(first_three, load_point):
            return support_points
        else:
            for comb in combinations(support_points, 3):
                if not is_door(list(comb), load_point):
                    combination.extend(list(comb))
                    missing = [x for x in support_points if x not in list(comb)]
                    if missing:
                        combination.extend(missing)
                    return combination
            return True

    def assemble(self):
        graph = self.graph
        points = self.points
        assembly_steps = self.assembly_steps

        while True:
            if len(self.processed_nodes) == 0:
                first_supports, first_neighbour = self.__get_first_move()
                lines_to_add = []

                for support in first_supports:
                    p1 = points[support]
                    p2 = points[first_neighbour]

                    line = rs.AddLine(p1, p2)
                    lines_to_add.append(line)
                
                missing_edges = self.__check_missing_edges(first_supports)
                for missing_edge in missing_edges:
                    p1 = points[missing_edge[0]]
                    p2 = points[missing_edge[1]]

                    line = rs.AddLine(p1,p2)
                    lines_to_add.append(line)

                path = GH_Path(0)
                assembly_steps.AddRange(lines_to_add, path)

            elif len(self.processed_nodes) < len(points):
                non_rigid_candidates = self.__find_unprocessed_neighbors_subgraphs()
                rigid_candidates = [candidate for candidate in non_rigid_candidates if self.__can_node_be_rigid(candidate)]
                sorted_rigid_candidates = self.__sort_rigid_candidates(rigid_candidates)

                for candidate in sorted_rigid_candidates:
                    lines_to_add = []
                    nodes_to_connect_to = self.__get_possible_connections(candidate)

                    if len(nodes_to_connect_to) == 1 and nodes_to_connect_to[0] in self.rigid_indices:
                        continue
                    ## if candidate is rigid point
                    if len(nodes_to_connect_to) < 3:
                        for node in nodes_to_connect_to:
                            line = rs.AddLine(points[candidate], points[node])
                            lines_to_add.append(line)

                        self.processed_nodes.append(candidate)
                        path = GH_Path(assembly_steps.BranchCount)
                        assembly_steps.AddRange(lines_to_add, path)

                    else:
                        nodes_sorted_indices = self.__get_sorted_supports(points[candidate], [points[x] for x in nodes_to_connect_to])
                        sorted_support_nodes = [nodes_to_connect_to[x] for x in nodes_sorted_indices]

                        ## check if it is door
                        if self.__check_if_door(sorted_support_nodes, candidate) == True:

                            ## if it is and cant be resolved, continue to next candidate
                            continue
                        else:
                            ## if it can be resolved return the ordered supports
                            sorted_support_points = self.__check_if_door(sorted_support_nodes, candidate)

                        for point in sorted_support_points:
                            line = rs.AddLine(points[candidate], point)
                            lines_to_add.append(line)
                            
                        self.processed_nodes.append(candidate)
                        path = GH_Path(assembly_steps.BranchCount)
                        assembly_steps.AddRange(lines_to_add, path)
            else:
                return assembly_steps

if not in_lines:
    raise ValueError('silly billy, no lines input')

if not in_rigid_points:
    raise ValueError('silly billy, no rigid points input')

if not in_start_point:
    raise ValueError('silly billy, no start point input')

my_truss = Trussemble(in_lines, in_rigid_points, in_start_point)
assembly_steps = my_truss.assemble()
processed_nodes = my_truss.processed_nodes
nodes = my_truss.points
processed_points = nodes
ordered_nodes = processed_points
# ---------- end py3 ----------
curve_8 = Curve(<curve referenced from the Rhino model>)
entwine = Entwine(
    Branch00=curve_4,
    Branch01=curve_5,
    Branch02=curve_2,
    Branch03=curve_3,
    Branch04=curve_6,
    Branch05=curve_7,
    FlattenInputs=True)  # -> simplify(Result)
base_edges = RemoteSender(curve_8)
null_item = NullItem(Item=entwine)  # -> NullFlags, InvalidFlags, Description

number_slider_2 = Slider(4, range=1..2182)  # disabled
assembly_steps = Data(py3.assembly_steps)  # disabled

cull_pattern = CullPattern(List=entwine, CullPattern=invert(null_item.NullFlags))
partition_list = PartitionList(List=cull_pattern, Size="3")

series = Series(Start=0, Step=1, Count=number_slider_2)  # disabled
tstat = TreeStatistics(Tree=assembly_steps)  # -> Paths, Length, Count; disabled
item = ListItem(List=tstat.Paths, Index=series, Wrap=True)  # disabled
branch = TreeBranch(Tree=assembly_steps, Path=item, MaintainPaths=True)  # disabled

number_slider_3 = Slider(0, range=0..4)  # disabled
swatch = ColourSwatch(SwatchColor=RGB(117, 117, 117))  # disabled
previewlw = CustomPreviewLineweights(Geometry=dynamic_geometry_pipeline, Shader=swatch, Thickness=number_slider_3, Absolute=False)  # disabled
curve_9 = Curve(branch)  # disabled

division = Division(A="850", B="2")

dom = ConstructDomain(DomainStart=1, DomainEnd=expr("x+1", tstat.Count))  # disabled
connected = GetConnectedObjects(Objects=number_slider_2)  # disabled
set_slider = SetSliderProperties(Slider=connected, Range=dom, Type=1)  # disabled

number_slider_4 = Slider(4, range=0..10)  # disabled
swatch_2 = ColourSwatch(SwatchColor=RGB(0, 51, 255))  # disabled
previewlw_2 = CustomPreviewLineweights(Geometry=branch, Shader=swatch_2, Thickness=number_slider_4, Absolute=False)  # disabled

trigger = Trigger(Interval=2000, TimerInterval=2000, Target=[ur5_setup, python_3_script])

robot_1_2 = RemoteReceiver(robot_1)
robot_2_2 = RemoteReceiver(robot_2)
robot_3_2 = RemoteReceiver(robot_3)
ur5_setup = Python3Script(RobotName=robot_1_2)  # -> out, RobotPosition, X_Axis, Y_Axis, Z_Axis, JointPoints, JointLines, SuccessMessage
# ---------- ur5_setup: Python ----------
import robolink as rl  # RoboDK API
import robodk as rdk
import Rhino.Geometry as rg
import math
import numpy as np

# === Inputs ===
# RobotName: Name of the robot in RoboDK (e.g., "UR5")

# Initialize outputs
RobotPosition = None
X_Axis = None
Y_Axis = None
Z_Axis = None
JointPoints = []
JointLines = []
SuccessMessage = ""

# Initialize RoboDK connection
RDK = rl.Robolink()

# Get the robot by name
robot = RDK.Item(RobotName, rl.ITEM_TYPE_ROBOT)

if not robot.Valid():
    SuccessMessage = f"Error: Could not find {RobotName} in RoboDK."
else:
    SuccessMessage = f"Connected to {RobotName} in RoboDK."

    # Get the robot's base pose
    robot_base = robot.Parent()
    if robot_base.Valid():
        base_pose = robot_base.Pose()
    else:
        base_pose = rdk.Mat()

    # Get the robot's current joint angles (degrees)
    joints_deg = robot.Joints().list()
    # Convert joint angles to radians
    joints_rad = [math.radians(angle) for angle in joints_deg]

    # UR5 standard DH parameters (in millimeters)
    d1 = 89.159
    a2 = -425.00
    a3 = -392.25
    d4 = 109.15
    d5 = 94.65
    d6 = 82.3

    alpha = [math.pi/2, 0, 0, math.pi/2, -math.pi/2, 0]
    a = [0, a2, a3, 0, 0, 0]
    d = [d1, 0, 0, d4, d5, d6]
    theta = [
        joints_rad[0],
        joints_rad[1],
        joints_rad[2],
        joints_rad[3],
        joints_rad[4],
        joints_rad[5],
    ]

    # Initialize the base transformation matrix
    T_base = np.array(base_pose.rows)
    # Ensure T_base is a 4x4 matrix
    if T_base.shape != (4, 4):
        SuccessMessage += " Error: Base pose matrix is not 4x4."
    else:
        # Initialize the transformation matrix
        T = T_base

        # Initialize joint positions list
        JointPoints = []

        # Store transformation matrices for each joint
        T_matrices = []

        for i in range(6):  # Six joints
            # DH parameters for current joint
            ai = a[i]
            alphai = alpha[i]
            di = d[i]
            thetai = theta[i]

            # Compute transformation matrix using DH parameters
            cos_theta = math.cos(thetai)
            sin_theta = math.sin(thetai)
            cos_alpha = math.cos(alphai)
            sin_alpha = math.sin(alphai)

            T_joint = np.array([
                [cos_theta, -sin_theta * cos_alpha,  sin_theta * sin_alpha, ai * cos_theta],
                [sin_theta,  cos_theta * cos_alpha, -cos_theta * sin_alpha, ai * sin_theta],
                [0,          sin_alpha,              cos_alpha,             di],
                [0,          0,                      0,                     1]
            ])

            # Update the overall transformation matrix
            T = np.dot(T, T_joint)

            # Save the transformation matrix for this joint
            T_matrices.append(T.copy())

            # Extract the position of the current joint
            position = T[:3, 3]

            # No conversion needed since we're working in millimeters
            joint_point = rg.Point3d(position[0], position[1], position[2])
            JointPoints.append(joint_point)

        # Create lines connecting the joints
        JointLines = []
        for i in range(1, len(JointPoints)):
            line = rg.Line(JointPoints[i - 1], JointPoints[i])
            JointLines.append(line)

        # Optionally, connect the base to the first joint
        if JointPoints:
            base_position = T_base[:3, 3]
            base_point = rg.Point3d(base_position[0], base_position[1], base_position[2])
            line = rg.Line(base_point, JointPoints[0])
            JointLines.insert(0, line)

        # Fetch the robot's pose relative to its base
        robot_pose = robot.Pose()

        # Compute the absolute pose of the TCP in the world coordinate system
        absolute_pose = base_pose * robot_pose

        # Extract position from the absolute pose
        position = absolute_pose.Pos()  # [x, y, z]

        # Create Rhino point for the robot's TCP position
        RobotPosition = rg.Point3d(position[0], position[1], position[2])

        # Extract orientation vectors from the rotation matrix of the absolute pose
        x_vector = rg.Vector3d(absolute_pose[0,0], absolute_pose[1,0], absolute_pose[2,0])
        y_vector = rg.Vector3d(absolute_pose[0,1], absolute_pose[1,1], absolute_pose[2,1])
        z_vector = rg.Vector3d(absolute_pose[0,2], absolute_pose[1,2], absolute_pose[2,2])

        # Scale vectors for visualization purposes
        scale_factor = 200  # Adjust as needed
        x_vector *= scale_factor
        y_vector *= scale_factor
        z_vector *= scale_factor

        # Create lines representing the robot's TCP axes
        X_Axis = rg.Line(RobotPosition, x_vector)
        Y_Axis = rg.Line(RobotPosition, y_vector)
        Z_Axis = rg.Line(RobotPosition, z_vector)

        # Optionally, connect the last joint to the TCP
        if JointPoints and RobotPosition:
            line = rg.Line(JointPoints[-1], RobotPosition)
            JointLines.append(line)
# ---------- end ur5_setup ----------
ur5_setup_2 = Python3Script(RobotName=robot_2_2)  # -> out, RobotPosition, X_Axis, Y_Axis, Z_Axis, JointPoints, JointLines, SuccessMessage; disabled; same code as ur5_setup
python_3_script = Python3Script(RobotName=robot_3_2)  # -> X_Axis, Y_Axis, Z_Axis, RobotPosition, JointPoints, JointLines
# ---------- python_3_script: Python ----------
import robolink as rl  # RoboDK API
import robodk as rdk
import Rhino.Geometry as rg
import math
import numpy as np

# === Inputs ===
# RobotName: Name of the robot in RoboDK (e.g., "COMAU NJ 60-2.2")

# Initialize outputs
RobotPosition = None
X_Axis = None
Y_Axis = None
Z_Axis = None
JointPoints = []
JointLines = []
SuccessMessage = ""

# Initialize RoboDK connection
RDK = rl.Robolink()

# Get the robot by name
robot = RDK.Item(RobotName, rl.ITEM_TYPE_ROBOT)

if not robot.Valid():
    SuccessMessage = f"Error: Could not find {RobotName} in RoboDK."
else:
    SuccessMessage = f"Connected to {RobotName} in RoboDK."

    # Get the robot's base pose
    robot_base = robot.Parent()
    if robot_base.Valid():
        base_pose = robot_base.Pose()
    else:
        base_pose = rdk.Mat()

    # Get the robot's current joint angles (degrees)
    joints_deg = robot.Joints().list()
    # Convert joint angles to radians
    joints_rad = [math.radians(angle) for angle in joints_deg]

    # COMAU NJ 60-2.2 DH parameters (in millimeters and radians)
    d1 = 740
    a2 = 600
    a3 = 1200
    d4 = 1350
    d6 = 260

    # DH parameters for COMAU NJ 60-2.2
    alpha = [math.pi/2, 0, 0, math.pi/2, -math.pi/2, 0]
    a = [0, a2, a3, 0, 0, 0]
    d = [d1, 0, 0, d4, 0, d6]
    theta = [
        joints_rad[0],
        joints_rad[1],
        joints_rad[2],
        joints_rad[3],
        joints_rad[4],
        joints_rad[5],
    ]

    # Initialize the base transformation matrix
    T_base = np.array(base_pose.rows)
    # Ensure T_base is a 4x4 matrix
    if T_base.shape != (4, 4):
        SuccessMessage += " Error: Base pose matrix is not 4x4."
    else:
        # Initialize the transformation matrix
        T = T_base

        # Initialize joint positions list
        JointPoints = []

        # Store transformation matrices for each joint
        T_matrices = []

        for i in range(6):  # Six joints
            # DH parameters for current joint
            ai = a[i]
            alphai = alpha[i]
            di = d[i]
            thetai = theta[i]

            # Compute transformation matrix using DH parameters
            cos_theta = math.cos(thetai)
            sin_theta = math.sin(thetai)
            cos_alpha = math.cos(alphai)
            sin_alpha = math.sin(alphai)

            T_joint = np.array([
                [cos_theta, -sin_theta * cos_alpha,  sin_theta * sin_alpha, ai * cos_theta],
                [sin_theta,  cos_theta * cos_alpha, -cos_theta * sin_alpha, ai * sin_theta],
                [0,          sin_alpha,              cos_alpha,             di],
                [0,          0,                      0,                     1]
            ])

            # Update the overall transformation matrix
            T = np.dot(T, T_joint)

            # Save the transformation matrix for this joint
            T_matrices.append(T.copy())

            # Extract the position of the current joint
            position = T[:3, 3]

            # No conversion needed since we're working in millimeters
            joint_point = rg.Point3d(position[0], position[1], position[2])
            JointPoints.append(joint_point)

        # Create lines connecting the joints
        JointLines = []
        for i in range(1, len(JointPoints)):
            line = rg.Line(JointPoints[i - 1], JointPoints[i])
            JointLines.append(line)

        # Optionally, connect the base to the first joint
        if JointPoints:
            base_position = T_base[:3, 3]
            base_point = rg.Point3d(base_position[0], base_position[1], base_position[2])
            line = rg.Line(base_point, JointPoints[0])
            JointLines.insert(0, line)

        # Fetch the robot's pose relative to its base
        robot_pose = robot.Pose()

        # Compute the absolute pose of the TCP in the world coordinate system
        absolute_pose = base_pose * robot_pose

        # Extract position from the absolute pose
        position = absolute_pose.Pos()  # [x, y, z]

        # Create Rhino point for the robot's TCP position
        RobotPosition = rg.Point3d(position[0], position[1], position[2])

        # Extract orientation vectors from the rotation matrix of the absolute pose
        x_vector = rg.Vector3d(absolute_pose[0,0], absolute_pose[1,0], absolute_pose[2,0])
        y_vector = rg.Vector3d(absolute_pose[0,1], absolute_pose[1,1], absolute_pose[2,1])
        z_vector = rg.Vector3d(absolute_pose[0,2], absolute_pose[1,2], absolute_pose[2,2])

        # Scale vectors for visualization purposes
        scale_factor = 200  # Adjust as needed
        x_vector *= scale_factor
        y_vector *= scale_factor
        z_vector *= scale_factor

        # Create lines representing the robot's TCP axes
        X_Axis = rg.Line(RobotPosition, rg.Point3d(RobotPosition.X + x_vector.X, RobotPosition.Y + x_vector.Y, RobotPosition.Z + x_vector.Z))
        Y_Axis = rg.Line(RobotPosition, rg.Point3d(RobotPosition.X + y_vector.X, RobotPosition.Y + y_vector.Y, RobotPosition.Z + y_vector.Z))
        Z_Axis = rg.Line(RobotPosition, rg.Point3d(RobotPosition.X + z_vector.X, RobotPosition.Y + z_vector.Y, RobotPosition.Z + z_vector.Z))

        # Optionally, connect the last joint to the TCP
        if JointPoints and RobotPosition:
            line = rg.Line(JointPoints[-1], RobotPosition)
            JointLines.append(line)
# ---------- end python_3_script ----------

# ----
# base lines
polyline = PolyLine(Vertices=point_2, Closed=True)
explode = Explode(Curve=base_edges, Recursive=True)  # -> flatten(Segments), Vertices

# ----
# Real-Time Visualization
panel_3 = Panel(ur5_setup.Z_Axis)
panel_4 = Panel(ur5_setup.JointLines)
panel_5 = Panel(ur5_setup.SuccessMessage)
panel_6 = Panel(ur5_setup.RobotPosition)
panel_7 = Panel(ur5_setup.X_Axis)
panel_8 = Panel(ur5_setup.Y_Axis)
panel_9 = Panel(ur5_setup.JointPoints)

list_item = ListItem(List=[python_3_script.X_Axis, ur5_setup.X_Axis], Index=0, Wrap=True)  # -> Item, Item1
list_item_2 = ListItem(List=[ur5_setup.Y_Axis, python_3_script.Y_Axis], Index=0, Wrap=True)  # -> Item, Item1
list_item_3 = ListItem(List=[ur5_setup.Z_Axis, python_3_script.Z_Axis], Index=0, Wrap=True)  # -> Item, Item1

custom_preview_lineweights = CustomPreviewLineweights(
    Geometry=ur5_setup.JointLines,
    Shader=ColourSwatch(SwatchColor=RGB(184, 184, 184)),
    Thickness=Slider(0.5, range=0..200),
    Absolute=False)

colour_swatch = ColourSwatch(SwatchColor=RGB(255, 0, 0))
colour_swatch_2 = ColourSwatch(SwatchColor=RGB(82, 255, 3))
colour_swatch_3 = ColourSwatch(SwatchColor=RGB(17, 101, 145))
entwine_2 = Entwine(
    Branch00=list_item.Item,
    Branch01=list_item_2.Item,
    Branch02=list_item_3.Item,
    Branch03=list_item.Item1,
    Branch04=list_item_2.Item1,
    Branch05=list_item_3.Item1,
    FlattenInputs=True)
entwine_3 = Entwine(
    Branch00=colour_swatch,
    Branch01=colour_swatch_2,
    Branch02=colour_swatch_3,
    Branch03=colour_swatch,
    Branch04=colour_swatch_2,
    Branch05=colour_swatch_3,
    Branch06=colour_swatch,
    Branch07=colour_swatch_2,
    Branch08=colour_swatch_3,
    FlattenInputs=True)
custom_preview_lineweights_2 = CustomPreviewLineweights(Geometry=entwine_2, Shader=entwine_3, Thickness=Slider(4, range=0..10), Absolute=False)

robot_1_3 = RemoteReceiver(robot_1)
curve_middle = CurveMiddle(Curve=curve_9)  # disabled

# ----
# Physical Calibration
number_slider_5 = Slider(20, range=0..100)
tablepoints = Point([<point referenced from the Rhino model> x1683])
point_3 = Point([<point referenced from the Rhino model> x3672])
tablepointscomau = RemoteSender(point_3)
unit_z_2 = UnitZ(Factor="20")
tablepointsur5 = RemoteSender(tablepoints)
move = Move(Geometry=tablepointscomau, Motion=unit_z_2)  # -> Geometry, Transform
unit_z_3 = UnitZ(Factor=number_slider_5)
move_2 = Move(Geometry=tablepointsur5, Motion=unit_z_3)  # -> Geometry, Transform
point_list = PointList(Points=move_2.Geometry, Size=Slider(10, range=1..10))  # disabled
point_list_2 = PointList(Points=move.Geometry, Size=Slider(10, range=1..10))  # disabled
tablepointscomau_2 = RemoteReceiver(tablepointscomau)
tablepointsur5_2 = RemoteReceiver(tablepointsur5)
deconstruct = Deconstruct(Point=tablepointscomau_2)  # -> XComponent, YComponent, ZComponent
deconstruct_2 = Deconstruct(Point=tablepointsur5_2)  # -> XComponent, YComponent, ZComponent
concatenate = Concatenate(
    FragmentA="{",
    FragmentB=deconstruct_2.XComponent,
    FragmentA_2=",",
    FragmentB_2=deconstruct_2.YComponent,
    FragmentA_3=",",
    FragmentA_4=deconstruct_2.ZComponent,
    FragmentA_5="}")  # -> flatten(Result)
concatenate_2 = Concatenate(
    FragmentA="{",
    FragmentB=deconstruct.XComponent,
    FragmentA_2=",",
    FragmentB_2=deconstruct.YComponent,
    FragmentA_3=",",
    FragmentA_4=deconstruct.ZComponent,
    FragmentA_5="}")  # -> flatten(Result)

number_slider_6 = Slider(1176, range=0..3672)
data_dam = DataDam(DataDataA=Slider(1654, range=0..1683), BufferDelay=10000000, BufferMode=0)
data_dam_2 = DataDam(DataDataA=Slider(549, range=0..1683), BufferDelay=10000000, BufferMode=0)
data_dam_3 = DataDam(DataDataA=Slider(90, range=-360..360), BufferDelay=10000000, BufferMode=0)
robot_1_4 = RemoteReceiver(robot_1)
robot_2_3 = RemoteReceiver(robot_2)
robot_3_3 = RemoteReceiver(robot_3)
python_3_script_2 = Python3Script(
    TablePoints=concatenate,
    RobotName=robot_1_4,
    PointIndex=data_dam,
    SetBase=Toggle(True),
    RotationZ=Slider(0, range=-360..360))  # -> out, BasePosition, SuccessMessage; inputs TablePoints: list of Point3d, PointIndex: Int32, RotationZ: Double
# ---------- python_3_script_2: Python ----------
import robolink as rl        # RoboDK API for communication 
import robodk as rdk         # RoboDK robotic simulation environment
import Rhino.Geometry as rg  # Rhino geometry for working with 3D points
import math                  # Math module for calculations

# Initialize RoboDK link
RDK = rl.Robolink()
# Ensure that RobotName is defined correctly from Grasshopper
if 'RobotName' not in globals() or not RobotName:
    raise NameError("RobotName is not defined or empty.")

# Fetch robot item by name
robot = RDK.Item(RobotName, rl.ITEM_TYPE_ROBOT)

# Ensure the robot is found in RoboDK
if not robot.Valid():
    raise NameError(f"Error: Could not find robot '{RobotName}' in RoboDK.")

# Define functions
def connect_to_robot(robot_name) -> str:
    """
    Connect to the robot using its name and return a success or error message.

    :param robot_name: The name of the robot in RoboDK.
    :return: A message indicating success or error.
    """
    robot = RDK.Item(robot_name, rl.ITEM_TYPE_ROBOT)
    if not robot.Valid():
        return f"Error: Could not find robot '{robot_name}' in RoboDK."
    else:
        return f"Connected to robot '{robot_name}' in RoboDK."


def set_robot_base(robot, x, y, z, rz_deg) -> str:
    """
    Set the robot's base at a specific point (x, y, z) with a rotation along the Z-axis.

    :param robot: The robot item in RoboDK.
    :param x: X coordinate for the base position.
    :param y: Y coordinate for the base position.
    :param z: Z coordinate for the base position.
    :param rz_deg: Rotation angle around the Z-axis in degrees.
    :return: A success or error message regarding the base setting.
    """
    rz_rad = math.radians(rz_deg)  # Convert degrees to radians
    rotation_matrix = rdk.rotz(rz_rad)  # Create a rotation matrix
    translation_matrix = rdk.transl(x, y, z)  # Create a translation matrix
    base_pose = translation_matrix * rotation_matrix  # Combine translation and rotation

    robot_base = robot.Parent()  # Get the robot's base (parent in RoboDK)

    if robot_base.Valid():
        robot_base.setPose(base_pose)  # Set the base pose
        return f"Robot '{RobotName}' base set at Point {PointIndex} with RotationZ={rz_deg} degrees successfully."
    else:
        return "Error: Could not find or access the robot base."


def get_current_base_position(robot) -> str:
    """
    Retrieve the current base position and rotation of the robot.

    :param robot: The robot item in RoboDK.
    :return: A string containing the current base position and rotation details.
    """
    robot_base = robot.Parent()  # Get the robot's base

    if robot_base.Valid():
        current_base_pose = robot_base.Pose()  # Get the current pose of the base
        current_position = current_base_pose.Pos()  # Extract position (X, Y, Z)
        rx_rad, ry_rad, rz_rad = rdk.pose_2_xyzrpy(current_base_pose)[3:]  # Get rotation angles
        rz_deg = math.degrees(rz_rad)  # Convert Z-axis rotation to degrees
        return f"Current base position: X={current_position[0]}, Y={current_position[1]}, Z={current_position[2]}, RotationZ={rz_deg} degrees"
    else:
        return "Error: Could not retrieve base position."


def validate_point_index(point_index, points_list) -> bool:
    """
    Validate whether the point index is within the bounds of the points list.

    :param point_index: The index of the point to check.
    :param points_list: The list of points.
    :return: True if the index is valid, False otherwise.
    """
    return 0 <= point_index < len(points_list)


# Function to transform Rhino Z-axis values for RoboDK
def rhino_to_robodk_coordinates(point):
    """
    Transform a Rhino point to RoboDK-compatible coordinates, ensuring correct height (Z) adjustment.
    
    :param point: A Rhino point (with X, Y, Z values).
    :return: Transformed X, Y, Z coordinates.
    """
    # Assuming that Rhino Z needs to map directly to RoboDK Z and no additional transformation is needed.
    # If a transformation is needed (for example, flipping the Z axis), apply it here.
    return point.X, point.Y, point.Z

# Main script logic
SuccessMessage = connect_to_robot(RobotName)  # Connect to the robot
if "Error" not in SuccessMessage:
    # Validate the point index
    if not validate_point_index(PointIndex, TablePoints):
        SuccessMessage = f"Error: Point index {PointIndex} is out of bounds."
    else:
        point = TablePoints[PointIndex]  # Get the point at the specified index
        x, y, z = rhino_to_robodk_coordinates(point)  # Transform Rhino coordinates to RoboDK coordinates

        # Set the base if SetBase is true, otherwise retrieve current base position
        if SetBase:
            rz_deg = RotationZ  # Get the rotation value for the base
            SuccessMessage = set_robot_base(robot, x, y, z, rz_deg)
            BasePosition = f"Base set at: X={x}, Y={y}, Z={z}, RotationZ={rz_deg} degrees"
        else:
            BasePosition = get_current_base_position(robot)
else:
    BasePosition = ""

# Output the messages
print(SuccessMessage)
print(BasePosition)
# ---------- end python_3_script_2 ----------
python_3_script_3 = Python3Script(TablePoints=concatenate, RobotName=robot_2_3, PointIndex=data_dam_2, SetBase=Toggle(False), RotationZ=data_dam_3)  # -> out, BasePosition, SuccessMessage; inputs TablePoints: list of Point3d, PointIndex: Int32, RotationZ: Double; disabled
# ---------- python_3_script_3: Python ----------
import robolink as rl       
import robodk as rdk        
import Rhino.Geometry as rg 
import math                 
SuccessMessage = ""   
BasePosition = ""     
JointPoints = []      
JointLines = []       


RDK = rl.Robolink()
robot = RDK.Item(RobotName, rl.ITEM_TYPE_ROBOT)
if not robot.Valid():
    
    SuccessMessage = f"Error: Could not find robot '{RobotName}' in RoboDK."
else:
    
    SuccessMessage = f"Connected to robot '{RobotName}' in RoboDK."

    
    if PointIndex >= len(TablePoints) or PointIndex < 0:
        SuccessMessage = f"Error: Point index {PointIndex} is out of bounds."
    else:
        
        point = TablePoints[PointIndex]
        
        
        x = float(point.X)
        y = float(point.Y)
        z = float(point.Z)
        
        
        if SetBase:
           

            
            rz_deg = RotationZ  

            
            rz_rad = math.radians(rz_deg)

           
            rotation_matrix = rdk.rotz(rz_rad)

           
            translation_matrix = rdk.transl(x, y, z)

            
            base_pose = translation_matrix * rotation_matrix

            # === End of Code for RotationZ ===

            # Get the robot's base (parent item in RoboDK)
            robot_base = robot.Parent()

            # Check if robot base is valid before setting pose
            if robot_base.Valid():
                # Set the robot base pose in RoboDK
                robot_base.setPose(base_pose)

                
                BasePosition = f"Base set at: X={x}, Y={y}, Z={z}, RotationZ={rz_deg} degrees"
                SuccessMessage = f"Robot '{RobotName}' base set at Point {PointIndex} with RotationZ={rz_deg} degrees successfully."
            else:
                
                SuccessMessage = "Error: Could not find or access the robot base."
                BasePosition = ""
        else:
            
            robot_base = robot.Parent()
            if robot_base.Valid():
                
                current_base_pose = robot_base.Pose()
                # Extract the translation components (position)
                current_position = current_base_pose.Pos()
                # Extract rotation angles around X, Y, Z axes (in radians)
                rx_rad, ry_rad, rz_rad = rdk.pose_2_xyzrpy(current_base_pose)[3:]  # Angles in radians
                # Convert rotation around Z-axis from radians to degrees
                rz_deg = math.degrees(rz_rad)
                # Update the BasePosition output with current position and rotation
                BasePosition = f"Current base position: X={current_position[0]}, Y={current_position[1]}, Z={current_position[2]}, RotationZ={rz_deg} degrees"
            else:
                # If robot base is not valid, update the BasePosition output
                BasePosition = "Error: Could not retrieve base position."
# ---------- end python_3_script_3 ----------
python_3_script_4 = Python3Script(
    TablePoints=tablepointscomau_2,
    RobotName=robot_3_3,
    PointIndex=number_slider_6,
    SetBase=Toggle(True),
    RotationZ=Slider(0, range=-360..360))  # -> out, BasePosition, SuccessMessage; inputs TablePoints: list of Point3d, PointIndex: Int32, RotationZ: Double; same code as python_3_script_2
panel_10 = Panel(python_3_script_2.BasePosition)
panel_11 = Panel(python_3_script_2.SuccessMessage)
panel_12 = Panel(python_3_script_3.BasePosition)
panel_13 = Panel(python_3_script_3.SuccessMessage)
panel_14 = Panel(python_3_script_4.BasePosition)
panel_15 = Panel(python_3_script_4.SuccessMessage)

list_item_4 = ListItem(List=tablepointscomau_2, Index=number_slider_6, Wrap=True)
list_item_5 = ListItem(List=tablepointsur5_2, Index=data_dam, Wrap=True)
comaubase = RemoteSender(list_item_4)
ur5base = RemoteSender(list_item_5)

# ----
# base point
panel_16 = Panel("2350")
division_2 = Division(A=panel_16, B="2")
comaubase_2 = RemoteReceiver(comaubase)
ur5base_2 = RemoteReceiver(ur5base)
unit_z_4 = UnitZ(Factor=division)
unit_z_5 = UnitZ(Factor=division_2)
point_4 = Point(ur5base_2)
point_5 = Point(comaubase_2)
move_3 = Move(Geometry=point_4, Motion=unit_z_4)  # -> Geometry, Transform
move_4 = Move(Geometry=point_5, Motion=unit_z_5)  # -> Geometry, Transform
orientation_point_a = RemoteSender(move_3.Geometry)
orientation_point_b = RemoteSender(move_4.Geometry)

list_item_6 = ListItem(List=[python_3_script.RobotPosition, ur5_setup.RobotPosition], Index=0, Wrap=True)  # -> Item, Item1
point_6 = Point([list_item_6.Item, list_item_6.Item1, comaubase, ur5base])
sphere = Sphere(Base=point_6, Radius=Slider(5, range=0..100))
custom_preview_2 = CustomPreview(Geometry=sphere, Material=ColourSwatch(SwatchColor=RGB(0, 0, 0)))

# ----
# pick_up_planes_B
distance_from_base = Slider(800, range=0..1000)
distance_between_slots = Slider(60, range=0..100)
pickup_slots = Slider(6, range=0..10)
comaubase_3 = RemoteReceiver(comaubase)
xy_plane = XYPlane(Origin=comaubase_3)
multiplication = Multiplication(A=distance_between_slots, B=pickup_slots)
division_3 = Division(A=multiplication, B=2)
rotate_plane_by_axis = RotatePlaneByAxis(Plane=xy_plane, Axis="z", Angle=90)
deconstruct_plane = DeconstructPlane(Plane=rotate_plane_by_axis)  # -> Origin, XAxis, YAxis, ZAxis
amplitude = Amplitude(Vector=deconstruct_plane.YAxis, Amplitude=distance_from_base)
amplitude_2 = Amplitude(Vector=deconstruct_plane.YAxis, Amplitude=expr("-x", division_3))
move_5 = Move(Geometry=rotate_plane_by_axis, Motion=amplitude)  # -> Geometry, Transform
move_6 = Move(Geometry=move_5.Geometry, Motion=amplitude_2)  # -> Geometry, Transform
amplitude_3 = Amplitude(Vector=deconstruct_plane.YAxis, Amplitude=distance_between_slots)
linear_array = LinearArray(Geometry=move_6.Geometry, Direction=amplitude_3, Count=pickup_slots)  # -> Geometry, Transform
flip_plane = FlipPlane(Plane=linear_array.Geometry, ReverseX=False, ReverseY=False, SwapAxes=True)
pick_up_planes_b = RemoteSender(flip_plane)

# ----
# select group
number_slider_7 = Slider(6, range=0..9)
construct_domain = ConstructDomain(DomainStart=0, DomainEnd=number_slider_7)
range = Range(Domain=construct_domain, Steps=number_slider_7)  # -> flatten(Range)

concatenate_3 = Concatenate(Fragment_A="{", Fragment_B=range, A=";*}")

split_tree = SplitTree(Data=partition_list, Masks=flatten(concatenate_3))  # -> Positive, Negative
curve_middle_2 = CurveMiddle(Curve=split_tree.Positive)
line = Line(split_tree.Positive)

# ----
# task allocation robots
orientation_point_a_2 = RemoteReceiver(orientation_point_a)
orientation_point_b_2 = RemoteReceiver(orientation_point_b)
python_3_script_5 = Python3Script(EdgesTree=line, RobotPointA=orientation_point_a_2, RobotPointB=orientation_point_b_2)  # -> out, assembly_order, task_allocation; inputs EdgesTree: tree of Line, RobotPointA: Point3d, RobotPointB: Point3d
# ---------- python_3_script_5: Python ----------
import Rhino.Geometry as rg
from Grasshopper import DataTree
from Grasshopper.Kernel.Data import GH_Path

# Inputs:
# EdgesTree - DataTree of Line objects representing truss edges
# RobotPointA - Point3d representing Robot A's base location
# RobotPointB - Point3d representing Robot B's base location

# Initialize outputs
assembly_order = DataTree[object]()
task_allocation = DataTree[str]()

# Collect all distances to determine the maximum distance for each robot
distances_A = []
distances_B = []

for path in EdgesTree.Paths:
    edges = EdgesTree.Branch(path)
    for edge in edges:
        mid_point = edge.PointAt(0.5)
        dist_to_A = mid_point.DistanceTo(RobotPointA)
        dist_to_B = mid_point.DistanceTo(RobotPointB)
        distances_A.append(dist_to_A)
        distances_B.append(dist_to_B)

max_dist_A = max(distances_A) if distances_A else 1.0
max_dist_B = max(distances_B) if distances_B else 1.0

# Process each branch
for path in EdgesTree.Paths:
    edges = EdgesTree.Branch(path)
    num_edges = len(edges)
    assembly_branch = []
    allocation_branch = []

    # Collect edge data
    edge_data = []
    for idx, edge in enumerate(edges):
        mid_point = edge.PointAt(0.5)
        dist_to_A = mid_point.DistanceTo(RobotPointA)
        dist_to_B = mid_point.DistanceTo(RobotPointB)
        rel_dist_to_A = dist_to_A / max_dist_A
        rel_dist_to_B = dist_to_B / max_dist_B
        edge_data.append({
            'index': idx,
            'edge': edge,
            'dist_to_A': dist_to_A,
            'dist_to_B': dist_to_B,
            'rel_dist_to_A': rel_dist_to_A,
            'rel_dist_to_B': rel_dist_to_B
        })

    if path.Indices[-1] == 0:
        # Branch {*;0}
        # Determine which robot is closer to the total of all edges
        total_rel_dist_A = sum(e['rel_dist_to_A'] for e in edge_data)
        total_rel_dist_B = sum(e['rel_dist_to_B'] for e in edge_data)
        if total_rel_dist_A <= total_rel_dist_B:
            closer_robot = '0'
            farther_robot = '1'
        else:
            closer_robot = '1'
            farther_robot = '0'

        # Assign edges to robots
        # Closer robot gets two edges (farthest from its base point)
        # Farther robot gets one edge (closest to its base point)
        if closer_robot == '0':
            edge_data.sort(key=lambda e: e['dist_to_A'], reverse=True)
            closer_edges = edge_data[:2]
            farther_edges = [e for e in edge_data if e not in closer_edges]
            farther_edge = min(farther_edges, key=lambda e: e['dist_to_B'])
        else:
            edge_data.sort(key=lambda e: e['dist_to_B'], reverse=True)
            closer_edges = edge_data[:2]
            farther_edges = [e for e in edge_data if e not in closer_edges]
            farther_edge = min(farther_edges, key=lambda e: e['dist_to_A'])

        # Assign to assembly order and task allocation
        assigned_edges = []
        for e in closer_edges:
            assigned_edges.append((e['index'], closer_robot, e['edge']))
        assigned_edges.append((farther_edge['index'], farther_robot, farther_edge['edge']))

        # Arrange edges to alternate for the first two edges
        assigned_edges.sort(key=lambda x: x[0])  # Sort by original index
        if assigned_edges[0][1] == assigned_edges[1][1]:
            # If first two edges are assigned to the same robot, swap the second with the third
            assigned_edges[1], assigned_edges[2] = assigned_edges[2], assigned_edges[1]

        # Add to outputs
        for idx, robot, edge in assigned_edges:
            assembly_branch.append(edge)
            allocation_branch.append(robot)
    else:
        # Branch {*;1}
        # Assign each edge to the relative closest robot
        for e in edge_data:
            idx = e['index']
            edge = e['edge']
            if e['rel_dist_to_A'] <= e['rel_dist_to_B']:
                robot = '0'
            else:
                robot = '1'
            assembly_branch.append(edge)
            allocation_branch.append(robot)

        # For each robot, sort their assigned edges by decreasing absolute distance
        # Since we need to maintain assembly order, we can sort the entire branch if necessary
        # For now, we keep the order as is, assuming the original order is acceptable

    # Add branches to outputs
    assembly_order.AddRange(assembly_branch, path)
    task_allocation.AddRange(allocation_branch, path)

# Outputs:
# AssemblyOrder - DataTree of edges in assembly order
# TaskAllocation - DataTree of strings indicating which robot ('0' or '1') is assigned to each edge
# ---------- end python_3_script_5 ----------
assembly_order = RemoteSender(python_3_script_5.assembly_order)
task_allocation = RemoteSender(python_3_script_5.task_allocation)

# ----
# orientation to truss
# average point of the 5 closest lines in the current state of assambly
flatten_tree = FlattenTree(Tree=python_3_script_5.assembly_order, Path="{0}")
list_indices = ListIndices(List=flatten_tree)
split_list = SplitList(List=flatten_tree, Index=graft(list_indices))  # -> simplify(ListA), ListB
insert_items = InsertItems(List=split_list.ListA, Item=explode.Segments, Indices=0, Wrap=False)
number_slider_8 = Slider(5, range=0..10)
curve_middle_3 = CurveMiddle(Curve=insert_items)
list_item_7 = ListItem(List=curve_middle_3, Index="-1", Wrap=True)
construct_domain_2 = ConstructDomain(DomainStart=0, DomainEnd=number_slider_8)
distance = Distance(PointA=curve_middle_3, PointB=list_item_7)
sort_list = SortList(Keys=distance, ValuesValuesA=curve_middle_3)  # -> Keys, ValuesValuesA
range_2 = Range(Domain=construct_domain_2, Steps=number_slider_8)
line_2 = Line(flatten_tree)
curve_middle_4 = CurveMiddle(Curve=line_2)
end_points = EndPoints(Curve=line_2)  # -> Start, End
list_item_8 = ListItem(List=sort_list.ValuesValuesA, Index=range_2, Wrap=True)
average = Average(Input=list_item_8)  # -> flatten(ArithmeticMean)
plane_3pt = Plane3Pt(PointA=curve_middle_4, PointB=end_points.Start, PointC=average)
rotate_plane_by_axis_2 = RotatePlaneByAxis(Plane=plane_3pt, Axis="x", Angle=270)
assembly_order_2 = RemoteReceiver(assembly_order)
task_allocation_2 = RemoteReceiver(task_allocation)
flip_plane_2 = FlipPlane(Plane=rotate_plane_by_axis_2, ReverseX=False, ReverseY=False, SwapAxes=False)
number_slider_9 = Slider(0.5, range=0..1)
unflatten_tree = UnflattenTree(Tree=flip_plane_2, Guide=assembly_order_2)
dispatch = Dispatch(List=unflatten_tree, DispatchPattern=task_allocation_2)  # -> ListA, ListB

# ----
# orientation frames Robot A
orientation_point_a_3 = RemoteReceiver(orientation_point_a)
assembly_order_3 = RemoteReceiver(assembly_order)
task_allocation_3 = RemoteReceiver(task_allocation)
dispatch_2 = Dispatch(List=assembly_order_3, DispatchPattern=task_allocation_3)  # -> ListA, ListB
line_3 = Line(dispatch_2.ListA)
curve_middle_5 = CurveMiddle(Curve=line_3)
end_points_2 = EndPoints(Curve=line_3)  # -> Start, End
point_7 = Point(orientation_point_a_3)
plane_3pt_2 = Plane3Pt(PointA=curve_middle_5, PointB=end_points_2.Start, PointC=point_7)
rotate_plane_by_axis_3 = RotatePlaneByAxis(Plane=plane_3pt_2, Axis="x", Angle=90)
flip_plane_3 = FlipPlane(Plane=rotate_plane_by_axis_3, ReverseX=False, ReverseY=False, SwapAxes=False)
plane = Plane(flip_plane_3)

# ----
# orientation frames Robot B
# target angle tuning
orientation_point_b_3 = RemoteReceiver(orientation_point_b)
assembly_order_4 = RemoteReceiver(assembly_order)
task_allocation_4 = RemoteReceiver(task_allocation)
dispatch_3 = Dispatch(List=assembly_order_4, DispatchPattern=task_allocation_4)  # -> ListA, ListB
line_4 = Line(dispatch_3.ListB)
curve_middle_6 = CurveMiddle(Curve=line_4)
end_points_3 = EndPoints(Curve=line_4)  # -> Start, End
point_8 = Point(orientation_point_b_3)
plane_3pt_3 = Plane3Pt(PointA=curve_middle_6, PointB=end_points_3.Start, PointC=point_8)
rotate_plane_by_axis_4 = RotatePlaneByAxis(Plane=plane_3pt_3, Axis="x", Angle=90)
flip_plane_4 = FlipPlane(Plane=rotate_plane_by_axis_4, ReverseX=False, ReverseY=False, SwapAxes=False)
plane_2 = Plane(flip_plane_4)

# ----
# Display
# Step
number_slider_10 = Slider(32, range=0..32)
assembly_order_5 = RemoteReceiver(assembly_order)
task_allocation_5 = RemoteReceiver(task_allocation)
split_list_2 = SplitList(List=flatten(assembly_order_5), Index=number_slider_10)  # -> ListA, ListB
split_list_3 = SplitList(List=flatten(task_allocation_5), Index=number_slider_10)  # -> ListA, ListB
dispatch_4 = Dispatch(List=split_list_2.ListA, DispatchPattern=split_list_3.ListA)  # -> ListA, ListB
pipe = Pipe(Curve=dispatch_4.ListA, Radius=5, Caps=0)
pipe_2 = Pipe(Curve=dispatch_4.ListB, Radius=5, Caps=0)
custom_preview_3 = CustomPreview(
    Geometry=pipe,
    Material={diffuse=RGB(255, 0, 0), emission=RGB(76, 0, 0), shine=0.5, specular=RGB(255, 255, 255), transparency=0})  # disabled
custom_preview_4 = CustomPreview(
    Geometry=pipe_2,
    Material={diffuse=RGB(0, 76, 255), emission=RGB(0, 23, 76), shine=0.5, specular=RGB(255, 255, 255), transparency=0})  # disabled

# ----
# select group
number_slider_11 = Slider(9, range=0..20)  # disabled
construct_domain_3 = ConstructDomain(DomainStart=0, DomainEnd=number_slider_11)  # disabled
range_3 = Range(Domain=construct_domain_3, Steps=number_slider_11)  # -> flatten(Range); disabled

panel_17 = Panel("3")  # disabled
partition_list_2 = PartitionList(List=assembly_steps, Size=panel_17)  # disabled
panel_18 = Panel("{")  # disabled
panel_19 = Panel(";*}")  # disabled
concatenate_4 = Concatenate(Fragment_A=panel_18, Fragment_B=range_3, A=panel_19)  # disabled

split_tree_2 = SplitTree(Data=partition_list_2, Masks=flatten(concatenate_4))  # -> Positive, Negative; disabled
curve_middle_7 = CurveMiddle(Curve=split_tree_2.Positive)  # disabled
line_5 = Line(split_tree_2.Positive)  # disabled

# ----
# script v3
xy_plane_2 = XYPlane(Origin=Point(500, 500, 0))  # disabled
xy_plane_3 = XYPlane(Origin=Point(0, 0, 0))  # disabled
panel_20 = Panel("waiting")  # disabled
panel_21 = Panel("pause")  # disabled
null_placeholder = NullPlaceholder()  # disabled
python_3_script_6 = Python3Script(
    LinesTree=line_5,
    pick_up_plane_A=xy_plane_3,
    pick_up_plane_B=xy_plane_2,
    waiting_command=panel_20,
    pause_command=panel_21)  # -> out, RobotA_Command, RobotB_Command, RobotA_Status, RobotB_Status; inputs LinesTree: tree of Line; disabled
# ---------- python_3_script_6: Python ----------
import Rhino.Geometry as rg
from Grasshopper import DataTree
from Grasshopper.Kernel.Data import GH_Path

# Inputs:
# LinesTree - DataTree of Line objects
# pick_up_plane_A - pick up plane for Robot A (input parameter)
# pick_up_plane_B - pick up plane for Robot B (input parameter)
# pause_command - command for pauses (input parameter)
# waiting_command - command when waiting for other robot (input parameter)

# Initialize output data trees
robotA_commands = DataTree[object]()
robotB_commands = DataTree[object]()
robotA_status = DataTree[str]()
robotB_status = DataTree[str]()

# Collect all heights to determine the middle height of the truss
heights = []
for branch in LinesTree.Branches:
    for line in branch:
        start_pt = line.From
        end_pt = line.To
        avg_height = (start_pt.Z + end_pt.Z) / 2.0
        heights.append(avg_height)

min_height = min(heights)
max_height = max(heights)
middle_height = (min_height + max_height) / 2.0

# Process each branch
for b, branch in enumerate(LinesTree.Branches):
    path = LinesTree.Paths[b]
    # Identify if subbranch is {-;0} or {-;1}
    if path.Indices[-1] == 0:
        # Subbranch {-;0} - special processing
        edges = branch
        if len(edges) != 3:
            # Handle the case where there are not exactly 3 edges
            # For simplicity, assume there are 3 edges
            pass
        else:
            edge1, edge2, edge3 = edges[0], edges[1], edges[2]
            steps = []
            
            # Step 1: Robot A moves to pick up
            step = {'RobotA': {'status': 'Move to pick up', 'command': pick_up_plane_A},
                    'RobotB': {'status': 'Waiting for other robot', 'command': waiting_command}}
            steps.append(step)
            
            # Step 2: Robot A closes gripper
            step = {'RobotA': {'status': 'Close gripper', 'command': 'gripper = 1'},
                    'RobotB': {'status': steps[-1]['RobotB']['status'], 'command': steps[-1]['RobotB']['command']}}
            steps.append(step)
            
            # Step 3: Robot A moves to target (edge1)
            step = {'RobotA': {'status': 'Move to target 1', 'command': edge1},
                    'RobotB': {'status': 'Waiting for other robot', 'command': waiting_command}}
            steps.append(step)
            
            # Step 4: Robot B moves to pick up
            step = {'RobotA': {'status': 'Waiting for other robot', 'command': waiting_command},
                    'RobotB': {'status': 'Move to pick up', 'command': pick_up_plane_B}}
            steps.append(step)
            
            # Step 5: Robot B closes gripper
            step = {'RobotA': {'status': steps[-1]['RobotA']['status'], 'command': steps[-1]['RobotA']['command']},
                    'RobotB': {'status': 'Close gripper', 'command': 'gripper = 1'}}
            steps.append(step)
            
            # Step 6: Robot B moves to target (edge2)
            step = {'RobotA': {'status': 'Waiting for other robot', 'command': waiting_command},
                    'RobotB': {'status': 'Move to target 2', 'command': edge2}}
            steps.append(step)
            
            # Step 7: Both robots pause for connection
            step = {'RobotA': {'status': 'Pause for connection', 'command': pause_command},
                    'RobotB': {'status': 'Pause for connection', 'command': pause_command}}
            steps.append(step)
            
            # Step 8: Robot A opens gripper
            step = {'RobotA': {'status': 'Open gripper', 'command': 'gripper = 0'},
                    'RobotB': {'status': steps[-1]['RobotB']['status'], 'command': steps[-1]['RobotB']['command']}}
            steps.append(step)
            
            # Step 9: Robot A moves to pick up
            step = {'RobotA': {'status': 'Move to pick up', 'command': pick_up_plane_A},
                    'RobotB': {'status': 'Waiting for other robot', 'command': waiting_command}}
            steps.append(step)
            
            # Step 10: Robot A closes gripper
            step = {'RobotA': {'status': 'Close gripper', 'command': 'gripper = 1'},
                    'RobotB': {'status': steps[-1]['RobotB']['status'], 'command': steps[-1]['RobotB']['command']}}
            steps.append(step)
            
            # Step 11: Robot A moves to target (edge3)
            step = {'RobotA': {'status': 'Move to target 3', 'command': edge3},
                    'RobotB': {'status': 'Waiting for other robot', 'command': waiting_command}}
            steps.append(step)
            
            # Step 12: Both robots pause for connection
            step = {'RobotA': {'status': 'Pause for connection', 'command': pause_command},
                    'RobotB': {'status': 'Pause for connection', 'command': pause_command}}
            steps.append(step)
            
            # Step 13: Both robots open gripper
            step = {'RobotA': {'status': 'Open gripper', 'command': 'gripper = 0'},
                    'RobotB': {'status': 'Open gripper', 'command': 'gripper = 0'}}
            steps.append(step)
            
            # Add the steps to the output data trees
            for step in steps:
                robotA_commands.Add(step['RobotA']['command'], path)
                robotA_status.Add(step['RobotA']['status'], path)
                robotB_commands.Add(step['RobotB']['command'], path)
                robotB_status.Add(step['RobotB']['status'], path)
    else:
        # Subbranch {-;1} - process edges assigned to robots, repeating the pattern
        edges = branch
        line_heights = []
        for line in edges:
            start_pt = line.From
            end_pt = line.To
            avg_height = (start_pt.Z + end_pt.Z) / 2.0
            line_heights.append((line, avg_height))
        
        # Sort edges based on their distance from middle height
        line_heights_sorted = sorted(line_heights, key=lambda x: abs(x[1] - middle_height))
        
        # Assign edges to robots based on average height
        robotA_edges = []
        robotB_edges = []
        for line, avg_height in line_heights_sorted:
            if avg_height <= middle_height:
                robotA_edges.append(line)
            else:
                robotB_edges.append(line)
        
        steps = []
        i = 0  # index for Robot A's edges
        j = 0  # index for Robot B's edges
        edge_counter_A = 1
        edge_counter_B = 1
        while i < len(robotA_edges) or j < len(robotB_edges):
            if i < len(robotA_edges):
                # Robot A processes an edge
                # Step: Robot A moves to pick up
                step = {'RobotA': {'status': 'Move to pick up', 'command': pick_up_plane_A},
                        'RobotB': {'status': 'Waiting for other robot', 'command': waiting_command}}
                steps.append(step)
                
                # Step: Robot A closes gripper
                step = {'RobotA': {'status': 'Close gripper', 'command': 'gripper = 1'},
                        'RobotB': {'status': steps[-1]['RobotB']['status'], 'command': steps[-1]['RobotB']['command']}}
                steps.append(step)
                
                # Step: Robot A moves to target
                step = {'RobotA': {'status': f'Move to target {edge_counter_A}', 'command': robotA_edges[i]},
                        'RobotB': {'status': 'Waiting for other robot', 'command': waiting_command}}
                steps.append(step)
                
                # Step: Pause for connection
                step = {'RobotA': {'status': 'Pause for connection', 'command': pause_command},
                        'RobotB': {'status': 'Pause for connection', 'command': pause_command}}
                steps.append(step)
                
                # Step: Robot A opens gripper
                step = {'RobotA': {'status': 'Open gripper', 'command': 'gripper = 0'},
                        'RobotB': {'status': steps[-1]['RobotB']['status'], 'command': steps[-1]['RobotB']['command']}}
                steps.append(step)
                
                i += 1
                edge_counter_A += 1
                
            if j < len(robotB_edges):
                # Robot B processes an edge
                # Step: Robot B moves to pick up
                step = {'RobotA': {'status': 'Waiting for other robot', 'command': waiting_command},
                        'RobotB': {'status': 'Move to pick up', 'command': pick_up_plane_B}}
                steps.append(step)
                
                # Step: Robot B closes gripper
                step = {'RobotA': {'status': steps[-1]['RobotA']['status'], 'command': steps[-1]['RobotA']['command']},
                        'RobotB': {'status': 'Close gripper', 'command': 'gripper = 1'}}
                steps.append(step)
                
                # Step: Robot B moves to target
                step = {'RobotA': {'status': 'Waiting for other robot', 'command': waiting_command},
                        'RobotB': {'status': f'Move to target {edge_counter_B}', 'command': robotB_edges[j]}}
                steps.append(step)
                
                # Step: Pause for connection
                step = {'RobotA': {'status': 'Pause for connection', 'command': pause_command},
                        'RobotB': {'status': 'Pause for connection', 'command': pause_command}}
                steps.append(step)
                
                # Step: Robot B opens gripper
                step = {'RobotA': {'status': steps[-1]['RobotA']['status'], 'command': steps[-1]['RobotA']['command']},
                        'RobotB': {'status': 'Open gripper', 'command': 'gripper = 0'}}
                steps.append(step)
                
                j += 1
                edge_counter_B += 1
                
        # Remove unnecessary double pauses
        optimized_steps = []
        prev_step = None
        for step in steps:
            if prev_step:
                if (prev_step['RobotA']['status'] == 'Pause for connection' and
                    step['RobotA']['status'] == 'Pause for connection'):
                    # Skip this step
                    continue
            optimized_steps.append(step)
            prev_step = step
            
        # Add the steps to the output data trees
        for step in optimized_steps:
            robotA_commands.Add(step['RobotA']['command'], path)
            robotA_status.Add(step['RobotA']['status'], path)
            robotB_commands.Add(step['RobotB']['command'], path)
            robotB_status.Add(step['RobotB']['status'], path)
    
# Set the outputs
RobotA_Command = robotA_commands
RobotB_Command = robotB_commands
RobotA_Status = robotA_status
RobotB_Status = robotB_status
# ---------- end python_3_script_6 ----------

# ----
# Robot_B
# Robot_A
# Command
# Status
# Status
# Command
panel_22 = Panel(python_3_script_6.RobotA_Command)  # disabled
panel_23 = Panel(python_3_script_6.RobotA_Status)  # disabled
panel_24 = Panel(python_3_script_6.RobotB_Command)  # disabled
panel_25 = Panel(python_3_script_6.RobotB_Status)  # disabled

sphere_2 = Sphere(Base=ur5_setup.JointPoints, Radius=Slider(20.8, range=0..100))
custom_preview_5 = CustomPreview(Geometry=sphere_2, Material=ColourSwatch(SwatchColor=RGB(201, 201, 201)))
panel_26 = Panel("{0;1}")
panel_27 = Panel("""J0
J1
J2
J3
J4
J5""")

entwine_4 = Entwine(Branch00=list_item.Item, Branch01=list_item.Item1, FlattenInputs=True)
end_points_4 = EndPoints(Curve=entwine_4)  # -> Start, End
text_tag = TextTag(Location=end_points_4.End, Text="x")

entwine_5 = Entwine(Branch00=list_item_2.Item, Branch01=list_item_2.Item1, FlattenInputs=True)
entwine_6 = Entwine(Branch00=list_item_3.Item, Branch01=list_item_3.Item1, FlattenInputs=True)
data = Data(sphere_2)

end_points_5 = EndPoints(Curve=entwine_5)  # -> Start, End
end_points_6 = EndPoints(Curve=entwine_6)  # -> Start, End
text_tag_2 = TextTag(Location=end_points_5.End, Text="y")
text_tag_3 = TextTag(Location=end_points_6.End, Text="z")

panel_28 = Panel(data)
area = Area(Geometry=data)  # -> Area, Centroid

tree_branch = TreeBranch(Tree=area.Centroid, Path="{0;0}", MaintainPaths=True)  # -> flatten(Branch)
panel_29 = Panel(tree_branch)

text_tag_4 = TextTag(Location=tree_branch, Text=panel_27, Colour=ColourSwatch(SwatchColor=RGB(255, 0, 0)))  # disabled

divide_curve = DivideCurve(Curve=curve_9, Count=10, Kinks=False)  # -> Points, Tangents, Parameters; disabled
point_9 = Point(divide_curve.Points)  # disabled
list_item_9 = ListItem(List=ur5base, Index=0, Wrap=True)
point_10 = Point(list_item_9)
number_slider_12 = Slider(54, range=0..142)  # disabled
panel_30 = Panel("1471")  # disabled
boolean_toggle = BooleanToggle(True)  # disabled
list_item_10 = ListItem(List=tablepointsur5, Index=panel_30, Wrap=True)  # disabled
number_slider_13 = Slider(7, range=0..100)  # disabled

# ----
# orientation frames
# midpoints
# lines
end_points_7 = EndPoints(Curve=curve_9)  # -> graft(Start), graft(End); disabled
panel_31 = Panel("10000")  # disabled
negative = Negative(Value=panel_31)  # disabled
trim_tree = TrimTree(Tree=end_points_7.Start, Depth=1)  # disabled
stream_filter_4 = StreamFilter(Gate=0, Stream0=panel_31, Stream1=negative)  # disabled
unit_z_6 = UnitZ(Factor=stream_filter_4)  # disabled
move_7 = Move(Geometry=point_10, Motion=unit_z_6)  # -> Geometry, Transform; disabled
plane_3pt_4 = Plane3Pt(PointA=curve_middle, PointB=trim_tree, PointC=move_7.Geometry)  # -> flatten(Plane); disabled
rotate_plane_by_axis_5 = RotatePlaneByAxis(Plane=plane_3pt_4, Axis="x", Angle=90)  # disabled
plane_3 = Plane(rotate_plane_by_axis_5)  # disabled
deconstruct_plane_2 = DeconstructPlane(Plane=plane_3)  # -> Origin, XAxis, YAxis, ZAxis; disabled
amplitude_4 = Amplitude(Vector=deconstruct_plane_2.ZAxis, Amplitude=50)  # disabled
vector_display = VectorDisplay(Anchor=deconstruct_plane_2.Origin, Vector=amplitude_4)  # disabled

# ----
# approach plane
number_slider_14 = Slider(50, range=0..100)  # disabled
deconstruct_plane_3 = DeconstructPlane(Plane=plane_3)  # -> Origin, XAxis, YAxis, ZAxis; disabled
amplitude_5 = Amplitude(Vector=deconstruct_plane_3.ZAxis, Amplitude=expr("-x", number_slider_14))  # disabled
move_8 = Move(Geometry=plane_3, Motion=amplitude_5)  # -> Geometry, Transform; disabled

# ----
# stack
xy_plane_4 = XYPlane(Origin=list_item_10)  # disabled
flip_plane_5 = FlipPlane(Plane=xy_plane_4, ReverseX=False, ReverseY=False, SwapAxes=True)  # disabled
list_length = ListLength(List=plane_3)  # disabled
duplicate_data = DuplicateData(Data=flip_plane_5, Number=expr("x-1", list_length), Order=True)  # -> flatten(Data); disabled

# ----
# inbetween plane
number_slider_15 = Slider(400, range=0..1000)
sphere_3 = Sphere(Base=point_10, Radius=number_slider_15)  # disabled
tween_two_planes = TweenTwoPlanes(PlaneA=plane_3, PlaneB=flip_plane_5, Factor=0.5, Quaternion=boolean_toggle)  # disabled
volume = Volume(Geometry=sphere_3)  # -> Volume, Centroid; disabled
distance_2 = Distance(PointA=tween_two_planes, PointB=volume.Centroid)  # disabled
surface_closest_point = SurfaceClosestPoint(Point=tween_two_planes, Surface=sphere_3)  # -> Point, UVPoint, Distance; disabled
number_slider_16 = Slider(0, range=0..30)  # disabled
smaller_than = SmallerThan(FirstNumber=distance_2, SecondNumber=number_slider_15)  # -> SmallerThan, OrEqualTo; disabled
plane_origin = PlaneOrigin(Base=tween_two_planes, Origin=surface_closest_point.Point)  # disabled
list_item_11 = ListItem(List=plane_origin, Index=number_slider_16, Wrap=True)  # disabled
list_item_12 = ListItem(List=plane_3, Index=number_slider_16, Wrap=True)  # disabled
list_item_13 = ListItem(List=flip_plane_5, Index=number_slider_16, Wrap=True)  # disabled
custom_preview_6 = CustomPreview(
    Geometry=[list_item_11, list_item_12, list_item_13],
    Material={diffuse=RGB(221, 160, 221), emission=RGB(66, 48, 66), shine=0.5, specular=RGB(255, 255, 255), transparency=0})  # disabled

panel_32 = Panel("""0
1
2
3""")  # disabled
weave = Weave(
    Pattern=panel_32,
    Stream0=duplicate_data,
    Stream1=move_8.Geometry,
    Stream2=plane_3,
    Stream3=move_8.Geometry,
    NullGaps=False)  # -> flatten(Weave); disabled
panel_33 = Panel(weave)  # disabled
panel_34 = Panel("10")  # disabled
split_list_4 = SplitList(List=weave, Index=panel_34)  # -> ListA, ListB; disabled
planes = RemoteSender(split_list_4.ListA)  # disabled

list_item_14 = ListItem(List=planes, Index=number_slider_13, Wrap=True)  # disabled
plane_4 = Plane(list_item_14)  # disabled

# ----
# target planes
tween_two_planes_2 = TweenTwoPlanes(PlaneA=flatten(plane), PlaneB=flatten(dispatch.ListA), Factor=number_slider_9, Quaternion=True)  # -> flatten(Tween)
tween_two_planes_3 = TweenTwoPlanes(PlaneA=flatten(plane_2), PlaneB=flatten(dispatch.ListB), Factor=number_slider_9, Quaternion=True)  # -> flatten(Tween)
task_allocation_6 = RemoteReceiver(flatten(task_allocation))
assembly_order_6 = RemoteReceiver(assembly_order)
weave_2 = Weave(Pattern=task_allocation_6, Stream0=tween_two_planes_3, Stream1=tween_two_planes_2, NullGaps=False)
unflatten_tree_2 = UnflattenTree(Tree=weave_2, Guide=assembly_order_6)
target_planes = RemoteSender(unflatten_tree_2)

# ----
# 3D model
overlap_node = Slider(20, range=0..50)  # disabled
hub_size = Slider(14, range=0..50)  # disabled
node_size = Slider(60, range=0..200)  # disabled
element_size = Slider(18, range=0..30)  # disabled
assembly_order_7 = RemoteReceiver(assembly_order)  # disabled
assembly_order_8 = RemoteReceiver(assembly_order)  # disabled
target_planes_2 = RemoteReceiver(target_planes)  # disabled
crv = Curve(flatten(assembly_order_7))  # disabled
subtraction = Subtraction(A=node_size, B=overlap_node)  # disabled
explode_2 = Explode(Curve=crv, Recursive=True)  # -> Segments, Vertices; disabled
negative_2 = Negative(Value=subtraction)  # disabled
cullpt = CullDuplicates(Points=flatten(explode_2.Vertices), Tolerance=1, CullMode=3)  # -> Points, Indices, Valence; disabled
extend_curve = ExtendCurve(Curve=assembly_order_8, Type=0, Start=negative_2, End=negative_2)  # disabled
sph = Sphere(Base=cullpt.Points, Radius=node_size)  # disabled
trim = TrimWithBreps(Curve=crv, Brep=sph)  # -> flatten(Inside), Outside; disabled
curve_10 = Curve(trim.Inside)  # disabled
amplitude_6 = Amplitude(Vector=target_planes_2, Amplitude=expr("x*2.5", hub_size))  # -> flatten(Vector); disabled
mp = MultiPipe(Curves=trim.Inside, NodeSize=hub_size, EndOffset=1, StrutSize=1, Segment=0, KinkAngle=0.6, CubeFit=0, Caps=2)  # -> graft(Pipe); disabled
amplitude_7 = Amplitude(Vector=target_planes_2, Amplitude=element_size)  # -> flatten(Vector); disabled
offset_curve = OffsetCurve(
    Curve=flatten(extend_curve),
    Plane=flatten(target_planes_2),
    Distance=expr("x/2", element_size),
    BothSides=expr("-x/2", element_size),
    Kinks=0,
    CapType=1)  # disabled
deconstruct_brep_2 = DeconstructBrep(Brep=mp)  # -> Faces, Edges, Vertices; disabled
extrude_2 = Extrude(Base=flatten(offset_curve), Direction=flatten(amplitude_6))  # disabled
extrude_3 = Extrude(Base=flatten(offset_curve), Direction=flatten(amplitude_7))  # disabled
brep_join = BrepJoin(Breps=deconstruct_brep_2.Faces)  # -> Breps, Closed; disabled
cap_holes = CapHoles(Brep=extrude_2)  # disabled
cap_holes_2 = CapHoles(Brep=extrude_3)  # disabled
move_9 = Move(Geometry=cap_holes, Motion=expr("-x/2", amplitude_6))  # -> Geometry, Transform; disabled
move_10 = Move(Geometry=cap_holes_2, Motion=expr("-x/2", amplitude_7))  # -> Geometry, Transform; disabled
solid_difference = SolidDifference(BrepsA=graft(brep_join.Breps), BrepsB=flatten(move_9.Geometry))  # disabled
custom_preview_materials = CustomPreviewMaterials(Geometry=solid_difference, DiffuseColor=RGB(84, 84, 84))  # disabled
custom_preview_materials_2 = CustomPreviewMaterials(Geometry=move_10.Geometry, DiffuseColor=RGB(250, 199, 70))  # disabled

flip_plane_6 = FlipPlane(Plane=unflatten_tree_2, ReverseX=False, ReverseY=True, SwapAxes=False)

# ----
# preview plane A
deconstruct_plane_4 = DeconstructPlane(Plane=tween_two_planes_2)  # -> Origin, XAxis, YAxis, ZAxis
amplitude_8 = Amplitude(Vector=deconstruct_plane_4.ZAxis, Amplitude=50)
custom_preview_7 = CustomPreview(
    Geometry=tween_two_planes_2,
    Material={diffuse=RGB(255, 0, 0), emission=RGB(76, 0, 0), shine=0.5, specular=RGB(255, 255, 255), transparency=0})  # disabled
vector_display_2 = VectorDisplay(Anchor=deconstruct_plane_4.Origin, Vector=amplitude_8)  # disabled

# ----
# preview plane B
deconstruct_plane_5 = DeconstructPlane(Plane=tween_two_planes_3)  # -> Origin, XAxis, YAxis, ZAxis
amplitude_9 = Amplitude(Vector=deconstruct_plane_5.ZAxis, Amplitude=50)
custom_preview_8 = CustomPreview(
    Geometry=tween_two_planes_3,
    Material={diffuse=RGB(0, 30, 255), emission=RGB(0, 9, 76), shine=0.5, specular=RGB(255, 255, 255), transparency=0})  # disabled
vector_display_3 = VectorDisplay(Anchor=deconstruct_plane_5.Origin, Vector=amplitude_9)  # disabled

flip_plane_7 = FlipPlane(Plane=flip_plane_6)

plane_5 = Plane(flip_plane_7)

# ----
# approach planes
number_slider_17 = Slider(-200, range=-1000..1000)
deconstruct_plane_6 = DeconstructPlane(Plane=plane_5)  # -> Origin, XAxis, YAxis, ZAxis
amplitude_10 = Amplitude(Vector=deconstruct_plane_6.ZAxis, Amplitude=number_slider_17)
move_11 = Move(Geometry=plane_5, Motion=expr("-x", amplitude_10))  # -> Geometry, Transform
plane_6 = Plane(move_11.Geometry)

# ----
# script v6
pick_up_planes_b_2 = RemoteReceiver(pick_up_planes_b)
task_allocation_7 = RemoteReceiver(task_allocation)
panel_35 = Panel("waiting")
panel_36 = Panel("pause")
panel_37 = Panel("gripper = 0")
panel_38 = Panel("gripper = 1")

boolean = Boolean(invert(task_allocation_7))
integer = Integer(boolean)

# ----
# pick_up_planes_A
pickup_slots_2 = Slider(6, range=0..10)
distance_from_base_2 = Slider(-600, range=-1000..1000)
distance_between_slots_2 = Slider(60, range=0..100)
ur5base_3 = RemoteReceiver(ur5base)
xy_plane_5 = XYPlane(Origin=ur5base_3)
multiplication_2 = Multiplication(A=distance_between_slots_2, B=pickup_slots_2)
division_4 = Division(A=multiplication_2, B=2)
rotate_plane_by_axis_6 = RotatePlaneByAxis(Plane=xy_plane_5, Axis="z", Angle=90)
deconstruct_plane_7 = DeconstructPlane(Plane=rotate_plane_by_axis_6)  # -> Origin, XAxis, YAxis, ZAxis
amplitude_11 = Amplitude(Vector=deconstruct_plane_7.YAxis, Amplitude=distance_from_base_2)
amplitude_12 = Amplitude(Vector=deconstruct_plane_7.YAxis, Amplitude=expr("-x", division_4))
move_12 = Move(Geometry=rotate_plane_by_axis_6, Motion=amplitude_11)  # -> Geometry, Transform
move_13 = Move(Geometry=move_12.Geometry, Motion=amplitude_12)  # -> Geometry, Transform; disabled
amplitude_13 = Amplitude(Vector=deconstruct_plane_7.YAxis, Amplitude=distance_between_slots_2)
linear_array_2 = LinearArray(Geometry=move_13.Geometry, Direction=amplitude_13, Count=pickup_slots_2)  # -> Geometry, Transform; disabled

linear_array_3 = LinearArray(Geometry=move_12.Geometry, Direction=Vector(0, 0, 0), Count=6)  # -> Geometry, Transform

flip_plane_8 = FlipPlane(Plane=linear_array_3.Geometry, ReverseX=True, ReverseY=True, SwapAxes=True)
pick_up_planes_a = RemoteSender(flip_plane_8)

pick_up_planes_a_2 = RemoteReceiver(pick_up_planes_a)
python_3_script_7 = Python3Script(
    target_planes=plane_5,
    task_allocation=integer,
    approach_planes=plane_6,
    pick_up_planes_A=pick_up_planes_a_2,
    pick_up_planes_B=pick_up_planes_b_2)  # -> out, robotA_commands, robotB_commands, robotA_status, robotB_status; inputs target_planes: tree, task_allocation: tree of Int32, approach_planes: tree of Plane, pick_up_planes_A: list of Plane, pick_up_planes_B: list of Plane
# ---------- python_3_script_7: Python ----------
import Rhino.Geometry as rg
import Grasshopper
from Grasshopper.Kernel.Data import GH_Path

# Inputs:
# target_planes - DataTree of Planes in assembly order
# approach_planes - DataTree of Planes corresponding to target_planes (optional)
# task_allocation - DataTree of integers (0 or 1) indicating robot assignment (0 for A, 1 for B)
# pick_up_planes_A - List of Planes for Robot A's pick-up points
# pick_up_planes_B - List of Planes for Robot B's pick-up points
# pause_command - Command to pause the robot (optional)
# waiting_command - Command for waiting state (optional)
# home_plane_A - Plane for Robot A's home position (optional)
# home_plane_B - Plane for Robot B's home position (optional)

# Ensure inputs are set to the correct access and type hints in the Grasshopper Python component

# Initialize output data trees
robotA_commands = Grasshopper.DataTree[object]()
robotB_commands = Grasshopper.DataTree[object]()
robotA_status = Grasshopper.DataTree[str]()
robotB_status = Grasshopper.DataTree[str]()

# Initialize gripper states and last edge counters
gripper_state = {'A': 0, 'B': 0}
last_edge_counter = {'A': None, 'B': None}

# Initialize edge counter
edge_counter = 0

# Initialize pickup plane indices for each robot
pickup_index = {'A': 0, 'B': 0}

# Get the total number of pickup planes for each robot
num_pickup_planes_A = len(pick_up_planes_A) if pick_up_planes_A else 1
num_pickup_planes_B = len(pick_up_planes_B) if pick_up_planes_B else 1

# Process each branch
for path in target_planes.Paths:
    planes = target_planes.Branch(path)
    approaches = approach_planes.Branch(path) if approach_planes and approach_planes.PathExists(path) else [None]*len(planes)
    allocations = task_allocation.Branch(path)
    num_edges = len(planes)
    
    # Check if the branch is {*;0}
    if path.Indices[-1] == 0:
        # Special handling for branch {*;0}
        
        # Collect indices of edges placed by each robot
        indices_by_robot = {'A': [], 'B': []}
        for idx, alloc in enumerate(allocations):
            robot_name = 'A' if alloc == 0 else 'B'
            indices_by_robot[robot_name].append(idx)
        
        # Prepare variables to keep track of steps
        max_steps = 0  # To synchronize steps between robots
        # Lists to store actions per robot
        actions_A = []
        actions_B = []
        
        # Process the first two edges
        for idx in range(2):
            edge_counter += 1
            plane = planes[idx]
            approach = approaches[idx] if idx < len(approaches) else None
            robot = allocations[idx]
            assigned_robot = 'A' if robot == 0 else 'B'
            other_robot = 'B' if assigned_robot == 'A' else 'A'
            last_edge_counter[assigned_robot] = edge_counter
            
            # Select the pickup plane for the assigned robot
            if assigned_robot == 'A':
                pickup_plane_list = pick_up_planes_A
                num_pickup_planes = num_pickup_planes_A
                if num_pickup_planes > 0:
                    pickup_plane = pickup_plane_list[pickup_index['A'] % num_pickup_planes]
                else:
                    pickup_plane = None  # Handle empty list case
                pickup_index['A'] += 1
            else:
                pickup_plane_list = pick_up_planes_B
                num_pickup_planes = num_pickup_planes_B
                if num_pickup_planes > 0:
                    pickup_plane = pickup_plane_list[pickup_index['B'] % num_pickup_planes]
                else:
                    pickup_plane = None  # Handle empty list case
                pickup_index['B'] += 1
            
            # Steps for the assigned robot
            steps_robot = []
            # Step 1: Move to pick up
            if pickup_plane is not None:
                steps_robot.append(("Move to pick up", pickup_plane))
            else:
                steps_robot.append(("Move to pick up", "No pickup plane provided"))
            # Step 2: Close gripper
            steps_robot.append(("Close gripper", gripper_close_command))
            gripper_state[assigned_robot] = 1
            # Step 3: Move to approach plane (if provided)
            if approach is not None:
                steps_robot.append((f"Move to approach plane {edge_counter}", approach))
            # Step 4: Move to target plane
            steps_robot.append((f"Move to target {edge_counter}", plane))
            # Step 5 onwards: Holding edge
            steps_robot.append((f"Holding edge {edge_counter}", waiting_command))
            # Add steps to robot's action list
            if assigned_robot == 'A':
                actions_A.extend(steps_robot)
            else:
                actions_B.extend(steps_robot)
            
            # For the other robot, add waiting steps to synchronize
            num_steps = len(steps_robot)
            waiting_status = f"Holding edge {last_edge_counter[other_robot]}" if gripper_state[other_robot] == 1 else "Waiting for other robot"
            waiting_steps = [(waiting_status, waiting_command)] * num_steps
            if other_robot == 'A':
                actions_A.extend(waiting_steps)
            else:
                actions_B.extend(waiting_steps)
            
            max_steps = max(max_steps, len(actions_A), len(actions_B))
        
        # After first two edges, both robots pause for connection
        if pause_command is not None:
            pause_step = ("Pause for connection", pause_command)
            actions_A.append(pause_step)
            actions_B.append(pause_step)
            max_steps += 1
        
        # Process the third edge if it exists
        if num_edges > 2:
            idx = 2  # Index of the third edge
            edge_counter += 1
            plane = planes[idx]
            approach = approaches[idx] if idx < len(approaches) else None
            robot = allocations[idx]
            assigned_robot = 'A' if robot == 0 else 'B'
            other_robot = 'B' if assigned_robot == 'A' else 'A'
            last_edge_counter[assigned_robot] = edge_counter
            
            # Select the pickup plane for the assigned robot
            if assigned_robot == 'A':
                pickup_plane_list = pick_up_planes_A
                num_pickup_planes = num_pickup_planes_A
                if num_pickup_planes > 0:
                    pickup_plane = pickup_plane_list[pickup_index['A'] % num_pickup_planes]
                else:
                    pickup_plane = None
                pickup_index['A'] += 1
            else:
                pickup_plane_list = pick_up_planes_B
                num_pickup_planes = num_pickup_planes_B
                if num_pickup_planes > 0:
                    pickup_plane = pickup_plane_list[pickup_index['B'] % num_pickup_planes]
                else:
                    pickup_plane = None
                pickup_index['B'] += 1
            
            # Steps for the assigned robot
            steps_robot = []
            # Step 1: Move to pick up
            if pickup_plane is not None:
                steps_robot.append(("Move to pick up", pickup_plane))
            else:
                steps_robot.append(("Move to pick up", "No pickup plane provided"))
            # Step 2: Close gripper
            steps_robot.append(("Close gripper", gripper_close_command))
            gripper_state[assigned_robot] = 1
            # Step 3: Move to approach plane (if provided)
            if approach is not None:
                steps_robot.append((f"Move to approach plane {edge_counter}", approach))
            # Step 4: Move to target plane
            steps_robot.append((f"Move to target {edge_counter}", plane))
            # Step 5: Pause for connection
            if pause_command is not None:
                steps_robot.append(("Pause for connection", pause_command))
            # Step 6: Open gripper
            steps_robot.append(("Open gripper", gripper_open_command))
            gripper_state[assigned_robot] = 0
            # Step 7: Move back to approach plane (if provided)
            if approach is not None:
                steps_robot.append((f"Move to approach plane {edge_counter}", approach))
            # Step 8: Move to home plane (if provided)
            home_plane = home_plane_A if assigned_robot == 'A' else home_plane_B
            if home_plane is not None:
                steps_robot.append(("Moving to home plane", home_plane))
            # Add steps to robot's action list
            if assigned_robot == 'A':
                actions_A.extend(steps_robot)
            else:
                actions_B.extend(steps_robot)
            
            # For the other robot, continue holding edge until pause for connection
            other_steps = []
            for i, (step, cmd) in enumerate(steps_robot):
                if step == "Pause for connection" and pause_command is not None:
                    other_steps.append(("Pause for connection", pause_command))
                else:
                    if gripper_state[other_robot] == 1:
                        other_steps.append((f"Holding edge {last_edge_counter[other_robot]}", waiting_command))
                    else:
                        other_steps.append(("Waiting for other robot", waiting_command))
            if other_robot == 'A':
                actions_A.extend(other_steps)
            else:
                actions_B.extend(other_steps)
            
            max_steps = max(max_steps, len(actions_A), len(actions_B))
        
        # After the third edge and pause, both robots can open grippers and move home
        # Open gripper for the robot that was holding edge
        for robot in ['A', 'B']:
            if gripper_state[robot] == 1:
                gripper_state[robot] = 0
                steps = []
                # Open gripper
                steps.append(("Open gripper", gripper_open_command))
                # Move back to approach plane (if provided)
                if indices_by_robot[robot]:
                    last_edge_idx = indices_by_robot[robot][-1]
                    approach = approaches[last_edge_idx] if last_edge_idx < len(approaches) else None
                    if approach is not None:
                        steps.append((f"Move to approach plane {last_edge_counter[robot]}", approach))
                else:
                    # The robot did not place any edges in this branch
                    approach = None
                # Move to home plane (if provided)
                home_plane = home_plane_A if robot == 'A' else home_plane_B
                if home_plane is not None:
                    steps.append(("Moving to home plane", home_plane))
                # Add steps to robot's action list
                if robot == 'A':
                    actions_A.extend(steps)
                else:
                    actions_B.extend(steps)
                max_steps = max(max_steps, len(actions_A), len(actions_B))
        
        # Synchronize steps between robots
        total_steps = max(len(actions_A), len(actions_B))
        for i in range(total_steps):
            sub_path = GH_Path(path)
            sub_path = sub_path.AppendElement(i)
            # Robot A actions
            if i < len(actions_A):
                status_A, command_A = actions_A[i]
            else:
                status_A = "Waiting for other robot"
                command_A = waiting_command
            robotA_status.Add(status_A, sub_path)
            robotA_commands.Add(command_A, sub_path)
            # Robot B actions
            if i < len(actions_B):
                status_B, command_B = actions_B[i]
            else:
                status_B = "Waiting for other robot"
                command_B = waiting_command
            robotB_status.Add(status_B, sub_path)
            robotB_commands.Add(command_B, sub_path)
    else:
        # Handle other branches as before
        for idx in range(num_edges):
            plane = planes[idx]
            approach = approaches[idx] if idx < len(approaches) else None
            robot = allocations[idx]
            assigned_robot = 'A' if robot == 0 else 'B'
            other_robot = 'B' if assigned_robot == 'A' else 'A'
            edge_counter += 1
            last_edge_counter[assigned_robot] = edge_counter
            
            # Select the pickup plane for the assigned robot
            if assigned_robot == 'A':
                pickup_plane_list = pick_up_planes_A
                num_pickup_planes = num_pickup_planes_A
                if num_pickup_planes > 0:
                    pickup_plane = pickup_plane_list[pickup_index['A'] % num_pickup_planes]
                else:
                    pickup_plane = None
                pickup_index['A'] += 1
            else:
                pickup_plane_list = pick_up_planes_B
                num_pickup_planes = num_pickup_planes_B
                if num_pickup_planes > 0:
                    pickup_plane = pickup_plane_list[pickup_index['B'] % num_pickup_planes]
                else:
                    pickup_plane = None
                pickup_index['B'] += 1
            
            # Steps for the assigned robot
            steps_robot = []
            # Step 1: Move to pick up
            if pickup_plane is not None:
                steps_robot.append(("Move to pick up", pickup_plane))
            else:
                steps_robot.append(("Move to pick up", "No pickup plane provided"))
            # Step 2: Close gripper
            steps_robot.append(("Close gripper", gripper_close_command))
            gripper_state[assigned_robot] = 1
            # Step 3: Move to approach plane (if provided)
            if approach is not None:
                steps_robot.append((f"Move to approach plane {edge_counter}", approach))
            # Step 4: Move to target plane
            steps_robot.append((f"Move to target {edge_counter}", plane))
            # Step 5: Pause for connection (if provided)
            if pause_command is not None:
                steps_robot.append(("Pause for connection", pause_command))
            # Step 6: Open gripper
            steps_robot.append(("Open gripper", gripper_open_command))
            gripper_state[assigned_robot] = 0
            # Step 7: Move back to approach plane (if provided)
            if approach is not None:
                steps_robot.append((f"Move to approach plane {edge_counter}", approach))
            # Step 8: Move to home plane (if provided)
            home_plane = home_plane_A if assigned_robot == 'A' else home_plane_B
            if home_plane is not None:
                steps_robot.append(("Moving to home plane", home_plane))
            
            # Steps for the other robot
            other_steps = []
            for step, cmd in steps_robot:
                if step == "Pause for connection" and pause_command is not None:
                    other_steps.append(("Pause for connection", pause_command))
                else:
                    if gripper_state[other_robot] == 1:
                        other_steps.append((f"Holding edge {last_edge_counter[other_robot]}", waiting_command))
                    else:
                        other_steps.append(("Waiting for other robot", waiting_command))
            
            # Add steps to data trees
            for i in range(len(steps_robot)):
                sub_path = GH_Path(path)
                sub_path = sub_path.AppendElement(idx)
                sub_path = sub_path.AppendElement(i)
                # Assigned robot
                if assigned_robot == 'A':
                    robotA_status.Add(steps_robot[i][0], sub_path)
                    robotA_commands.Add(steps_robot[i][1], sub_path)
                    robotB_status.Add(other_steps[i][0], sub_path)
                    robotB_commands.Add(other_steps[i][1], sub_path)
                else:
                    robotB_status.Add(steps_robot[i][0], sub_path)
                    robotB_commands.Add(steps_robot[i][1], sub_path)
                    robotA_status.Add(other_steps[i][0], sub_path)
                    robotA_commands.Add(other_steps[i][1], sub_path)

# Outputs:
RobotA_Command = robotA_commands
RobotB_Command = robotB_commands
RobotA_Status = robotA_status
RobotB_Status = robotB_status
# ---------- end python_3_script_7 ----------
path_mapper = PathMapper(python_3_script_7.robotA_commands, source=["{A;B;C}", "{A;B;C;D}"], target=["{A}", "{A}"])
path_mapper_2 = PathMapper(python_3_script_7.robotB_commands, source=["{A;B;C}", "{A;B;C;D}"], target=["{A}", "{A}"])
path_mapper_3 = PathMapper(python_3_script_7.robotA_status, source=["{A;B;C}", "{A;B;C;D}"], target=["{A}", "{A}"])
path_mapper_4 = PathMapper(python_3_script_7.robotB_status, source=["{A;B;C}", "{A;B;C;D}"], target=["{A}", "{A}"])
null_item_2 = NullItem(Item=path_mapper)  # -> NullFlags, InvalidFlags, Description
null_item_3 = NullItem(Item=path_mapper_2)  # -> NullFlags, InvalidFlags, Description
cull_pattern_2 = CullPattern(List=path_mapper, CullPattern=invert(null_item_2.NullFlags))
cull_pattern_3 = CullPattern(List=path_mapper_2, CullPattern=invert(null_item_3.NullFlags))
commands_a = RemoteSender(cull_pattern_2)
commands_b = RemoteSender(cull_pattern_3)
status_a = RemoteSender(path_mapper_3)
status_b = RemoteSender(path_mapper_4)

commands_a_2 = RemoteReceiver(commands_a)
plane_7 = Plane(commands_a_2)
explode_tree = ExplodeTree(Data=plane_7)  # -> Branch0, Branch1, Branch2, Branch3, Branch4, Branch5
list_item_15 = ListItem(List=explode_tree.Branch0, Index=Slider(0, range=0..3), Wrap=False)
plane_8 = Plane(explode_tree.Branch0)
plane_9 = Plane(plane_8)
python_3_script_8 = Python3Script(RobotName=robot_1_3, UpdateRoboDK=Toggle(False), PlanesList=plane_9)  # -> out, SuccessMessage, TargetPoses, Program, TCPOrientations, PlaneExtra; inputs PlanesList: list of Plane
# ---------- python_3_script_8: Python ----------
import robolink as rl    # RoboDK API for controlling and communicating with RoboDK   
import robodk as rdk     # RoboDK tools, such as matrix operations and other utilities
import Rhino.Geometry as rg  # Import Rhino.Geometry module as rg
import math

# === Inputs ===
# RobotName: Name of the robot in RoboDK (e.g., "UR5")
# UpdateRoboDK: Boolean toggle to execute the script and update RoboDK when True
# PlanesList: List of Rhino Plane objects (each plane contains both target point and orientation)

# Initialize outputs
SuccessMessage = ""
TargetPoses = []  # List of converted poses
Program = ""
TCPOrientations = []
TargetPointCoordinates = []
PlaneExtra = []  # Unreachable planes for other robots to attempt

# Function to convert Rhino Plane to RoboDK Pose (4x4 matrix)
def plane_to_pose(plane):
    """Converts a Rhino plane to a RoboDK pose (4x4 matrix)."""
    pose = rdk.Mat([
        [plane.XAxis.X, plane.YAxis.X, plane.ZAxis.X, plane.OriginX],
        [plane.XAxis.Y, plane.YAxis.Y, plane.ZAxis.Y, plane.OriginY],
        [plane.XAxis.Z, plane.YAxis.Z, plane.ZAxis.Z, plane.OriginZ],
        [0, 0, 0, 1]
    ])
    return pose

# Function to format the orientation of the TCP as strings for easy reporting
def format_tcp_orientation(plane, milestone):
    """Formats the TCP orientation (X, Y, Z axes) for a given milestone."""
    x_axis = plane.XAxis
    y_axis = plane.YAxis
    z_axis = plane.ZAxis
    return f"TCP orientation at {milestone}:\n  X-axis: {x_axis}\n  Y-axis: {y_axis}\n  Z-axis: {z_axis}"

# Function to format the target point coordinates {x, y, z} for reporting
def format_target_coordinates(plane, milestone):
    """Formats the target point coordinates as a string for a given milestone."""
    return f"{plane.OriginX}, {plane.OriginY}, {plane.OriginZ}"

# Check required inputs before proceeding
if not RobotName:
    SuccessMessage = "Error: RobotName is required."
elif not PlanesList or not isinstance(PlanesList, list):
    SuccessMessage = "Error: PlanesList must be a list of Rhino Plane objects."
elif any(not isinstance(plane, rg.Plane) for plane in PlanesList):
    SuccessMessage = "Error: All elements in PlanesList must be Rhino Plane objects."
elif UpdateRoboDK is None:
    SuccessMessage = "Error: UpdateRoboDK toggle is required."
elif not UpdateRoboDK:
    SuccessMessage = "UpdateRoboDK is set to False. No action taken."
else:
    # Connect to RoboDK only if UpdateRoboDK is True
    RDK = rl.Robolink()  # Initialize RoboDK connection
    SuccessMessage = "Connected to RoboDK."
    
    # Retrieve the robot by name
    robot = RDK.Item(RobotName, rl.ITEM_TYPE_ROBOT)
    
    if not robot.Valid():
        SuccessMessage += f"\nError: Could not find {RobotName} in RoboDK."
    else:
        SuccessMessage += f"\nFound robot '{robot.Name()}' in RoboDK."
        
        # Get the robot's base and tool
        robot_base = robot.Parent()
        tool = robot.getLink(rl.ITEM_TYPE_TOOL)
        
        # Check if the robot base and tool are valid
        if not robot_base.Valid():
            SuccessMessage += "\nError: Robot's base not found."
        else:
            SuccessMessage += f"\nRobot base: {robot_base.Name()}"

        if not tool.Valid():
            SuccessMessage += "\nError: Robot's tool not found."
        else:
            SuccessMessage += f"\nRobot tool: {tool.Name()}"

        # Enable collision detection in RoboDK
        RDK.setCollisionActive(1)

        if not robot_base.Valid() or not tool.Valid():
            SuccessMessage += "\nCannot proceed without valid base and tool."
        else:
            # Set the robot to its home position before starting
            robot.MoveJ(robot.JointsHome())

            # Get the robot base frame pose
            base_pose = robot_base.Pose()

            # Create a new program
            SuccessMessage += "\nCreating program in RoboDK..."
            program_name = "MoveThroughPlanesProgram"
            program = RDK.AddProgram(program_name, robot)
            program.setFrame(robot_base)  # Set the base frame of the robot
            program.setTool(tool)  # Set the tool of the robot

            # Process each plane in PlanesList independently
            for idx, plane in enumerate(PlanesList):
                # Convert plane to RoboDK pose
                target_pose_robot = plane_to_pose(plane)

                # Adjust the target pose with respect to the robot's base frame
                base_pose_inv = base_pose.inv()
                target_pose_relative = base_pose_inv * target_pose_robot

                # Try a linear movement first
                linear_movement_success = False
                try:
                    robot.MoveL(target_pose_relative, False)  # Simulation mode, does not execute actual motion
                    linear_movement_success = True
                    SuccessMessage += f"\nPlane {idx+1} reachable with linear movement."
                except Exception as e:
                    SuccessMessage += f"\nPlane {idx+1} unreachable with linear movement. Error: {str(e)}"
                    
                    # Attempt a joint movement if linear movement fails
                    try:
                        robot.MoveJ(target_pose_relative, False)  # Simulation mode, does not execute actual motion
                        SuccessMessage += f"\nPlane {idx+1} reachable with joint movement."
                    except Exception as e:
                        SuccessMessage += f"\nPlane {idx+1} unreachable with both linear and joint movements. Error: {str(e)}"
                        PlaneExtra.append(plane)  # Add unreachable plane to PlaneExtra for another robot
                        continue  # Skip this plane and move to the next one

                # Store the pose
                TargetPoses.append(target_pose_relative)

                # Format TCP orientation and coordinates for reporting
                milestone = f"Plane {idx+1}"
                TCPOrientations.append(format_tcp_orientation(plane, milestone))
                TargetPointCoordinates.append(format_target_coordinates(plane, milestone))

                # Add the movement target in RoboDK
                target_name = f"Plane_{idx+1}"
                target = RDK.AddTarget(target_name, robot_base, robot)
                target.setAsCartesianTarget()
                target.setPose(target_pose_relative)

                # Add the correct type of movement to the program
                if linear_movement_success:
                    program.MoveL(target)  # Add the successful linear movement to the program
                else:
                    program.MoveJ(target)  # Add the fallback joint movement to the program

            Program = program_name  # Assign the created program's name to the output
            SuccessMessage += f"\nProgram '{program_name}' created successfully."
# ---------- end python_3_script_8 ----------
panel_39 = Panel(python_3_script_8.PlaneExtra)
plane_10 = Plane(python_3_script_8.PlaneExtra)  # disabled
list_item_16 = ListItem(List=python_3_script_8.PlaneExtra, Index=0, Wrap=True)  # disabled
plane_11 = Plane(list_item_15)
panel_40 = Panel(plane_11)
commands_b_2 = RemoteReceiver(commands_b)
deconstruct_plane_8 = DeconstructPlane(Plane=plane_11)  # -> Origin, XAxis, YAxis, ZAxis
amplitude_14 = Amplitude(Vector=deconstruct_plane_8.ZAxis, Amplitude=50)
custom_preview_9 = CustomPreview(
    Geometry=plane_11,
    Material={diffuse=RGB(0, 30, 255), emission=RGB(0, 9, 76), shine=0.5, specular=RGB(255, 255, 255), transparency=0})
vector_display_4 = VectorDisplay(Anchor=deconstruct_plane_8.Origin, Vector=amplitude_14)

# ----
# Status
# Command
# UR5
# COMAU
panel_41 = Panel(commands_a_2)
panel_42 = Panel(commands_b_2)
status_a_2 = RemoteReceiver(status_a)
status_b_2 = RemoteReceiver(status_b)
panel_43 = Panel(status_a_2)
panel_44 = Panel(status_b_2)
assembly_order_9 = RemoteReceiver(assembly_order)
task_allocation_8 = RemoteReceiver(task_allocation)
panel_45 = Panel(task_allocation_8)
panel_46 = Panel(assembly_order_9)
