# Grasshopper definition 241024_RoboticAssembly_Prototype.gh (Grasshopper 1.0.8)
# plug-ins: Aggregations, RhinoCodePluginGH, Pufferfish, Human, Palette, Telepathy

panel = Panel("""absl-py==2.1.0
asttokens==2.4.1
astunparse==1.6.3
attrs==24.2.0
cachetools==5.5.0
certifi==2024.8.30
charset-normalizer==3.3.2
click-plugins==1.1.1
click==8.1.7
cligj==0.7.2
colorama==0.4.6
comm==0.2.2
contourpy==1.3.0
cycler==0.12.1
decorator==5.1.1
dm-tree==0.1.8
docstring-parser==0.16
etils==1.9.4
exceptiongroup==1.2.2
executing==2.1.0
filelock==3.16.0
fiona==1.10.1
flatbuffers==24.3.25
fonttools==4.53.1
fsspec==2024.9.0
gast==0.4.0
geographiclib==2.0
geopandas==1.0.1
geopy==2.4.1
ghhops-server==1.5.5
google-auth-oauthlib==0.4.6
google-auth==2.34.0
google-pasta==0.2.0
grpcio==1.66.1
h5py==3.11.0
idna==3.8
immutabledict==4.2.0
importlib-resources==6.4.5
iopath==0.1.10
ipympl==0.9.4
ipython-genutils==0.2.0
ipython==8.27.0
ipywidgets==8.1.5
jedi==0.19.1
jinja2==3.1.4
jupyterlab-widgets==3.0.13
keras-preprocessing==1.1.2
keras==2.10.0
kiwisolver==1.4.7
libclang==18.1.1
lxml==5.3.0
markdown-it-py==3.0.0
markdown==3.7
markupsafe==2.1.5
matplotlib-inline==0.1.7
matplotlib==3.9.2
mdurl==0.1.2
ml-dtypes==0.4.0
mpmath==1.3.0
namex==0.0.8
networkx==3.2.1
numpy==2.0.2
oauthlib==3.2.2
openexr==3.2.4
opt-einsum==3.3.0
optree==0.12.1
owslib==0.31.0
packaging==24.1
pandas==2.2.2
parso==0.8.4
pillow==10.4.0
pip==24.2
portalocker==2.10.1
promise==2.3
prompt-toolkit==3.0.47
protobuf==3.19.6
psutil==6.0.0
pure-eval==0.2.3
pyarrow==17.0.0
pyasn1-modules==0.4.0
pyasn1==0.6.0
pydot==3.0.1
pygame==2.6.1
pygments==2.18.0
pygraphviz==1.14rc0.dev0
pyogrio==0.10.0
pyopengl-accelerate==3.1.7
pyopengl==3.1.7
pyparsing==3.1.4
pyproj==3.7.0
pyqt5-qt5==5.15.2
pyqt5-sip==12.15.0
pyqt5==5.15.11
pyqtgraph==0.13.7
python-dateutil==2.9.0.post0
pytz==2024.1
pywin32==306
pyyaml==6.0.2
requests-oauthlib==2.0.0
requests==2.32.3
rhino3dm==8.9.0
rich==13.8.0
robodk==5.7.5
rsa==4.9
scipy==1.14.1
setuptools==65.5.0
shapely==2.0.6
simple-parsing==0.1.6
six==1.16.0
stack-data==0.6.3
sympy==1.13.2
tensorboard-data-server==0.6.1
tensorboard-plugin-wit==1.8.1
tensorboard==2.10.1
tensorflow-addons==0.22.0
tensorflow-datasets==4.9.6
tensorflow-estimator==2.10.0
tensorflow-gpu==2.10.1
tensorflow-graphics==2021.12.3
tensorflow-io-gcs-filesystem==0.31.0
tensorflow-metadata==1.15.0
termcolor==2.4.0
toml==0.10.2
torch==2.0.1+cu117
torchaudio==2.0.2+cu117
torchvision==0.15.2+cu117
tqdm==4.66.5
traitlets==5.14.3
trimesh==4.4.9
typeguard==2.13.3
typing-extensions==4.12.2
tzdata==2024.1
urllib3==2.2.2
visual-kinematics==0.2.1
vtk==9.3.1
wcwidth==0.2.13
werkzeug==3.0.4
wheel==0.44.0
widgetsnbextension==4.0.13
wrapt==1.16.0
zipp==3.20.1""")
palette = Palette(
    ModeCustomStandard=Toggle(True),
    Component_Normal_Deselected_Fill_Color=RGB(200, 200, 200),
    Component_Normal_Deselected_Edge_Color=RGB(50, 50, 50),
    Component_Normal_Deselected_Text_Color=RGB(0, 0, 0),
    Component_Normal_Selected_Fill_Color=RGB(130, 215, 50),
    Component_Normal_Selected_Edge_Color=RGB(0, 50, 0),
    Component_Normal_Selected_Text_Color=RGB(0, 25, 0),
    Component_Hidden_Deselected_Fill_Color=RGB(140, 140, 155),
    Component_Hidden_Deselected_Edge_Color=RGB(35, 35, 35),
    Component_Hidden_Deselected_Text_Color=RGB(0, 0, 0),
    Component_Hidden_Selected_Fill_Color=RGB(80, 180, 10),
    Component_Hidden_Selected_Edge_Color=RGB(0, 35, 0),
    Component_Hidden_Selected_Text_Color=RGB(0, 25, 0),
    Component_Disabled_Deselected_Fill_Color=RGB(120, 120, 120),
    Component_Disabled_Deselected_Edge_Color=RGB(90, 90, 90),
    Component_Disabled_Deselected_Text_Color=RGB(70, 70, 70),
    Component_Disabled_Selected_Fill_Color=RGB(110, 150, 115),
    Component_Disabled_Selected_Edge_Color=RGB(40, 70, 40),
    Component_Disabled_Selected_Text_Color=RGB(75, 100, 65),
    Component_Warning_Deselected_Fill_Color=RGB(255, 140, 20),
    Component_Warning_Deselected_Edge_Color=RGB(80, 10, 0),
    Component_Warning_Deselected_Text_Color=RGB(0, 0, 0),
    Component_Warning_Selected_Fill_Color=RGB(185, 205, 0),
    Component_Warning_Selected_Edge_Color=RGB(0, 50, 0),
    Component_Warning_Selected_Text_Color=RGB(0, 0, 0),
    Component_Error_Deselected_Fill_Color=RGB(200, 0, 0),
    Component_Error_Deselected_Edge_Color=RGB(60, 0, 0),
    Component_Error_Deselected_Text_Color=RGB(0, 0, 0),
    Component_Error_Selected_Fill_Color=RGB(125, 155, 0),
    Component_Error_Selected_Edge_Color=RGB(0, 50, 0),
    Component_Error_Selected_Text_Color=RGB(255, 255, 255),
    Component_Label_Deselected_Fill_Color=RGB(50, 50, 50),
    Component_Label_Deselected_Edge_Color=RGB(0, 0, 0),
    Component_Label_Deselected_Text_Color=RGB(255, 255, 255),
    Component_Label_Selected_Fill_Color=RGB(25, 60, 25),
    Component_Label_Selected_Edge_Color=RGB(0, 35, 0),
    Component_Label_Selected_Text_Color=RGB(190, 250, 180),
    Galapagos_Deselected_Fill_Color=RGB(255, 0, 125),
    Galapagos_Deselected_Edge_Color=RGB(100, 0, 50),
    Galapagos_Selected_Fill_Color=RGB(160, 210, 30),
    Galapagos_Selected_Edge_Color=RGB(0, 50, 0),
    Wire_Normal_Color=RGBA(0, 0, 0, 150),
    Wire_Empty_Color=RGBA(255, 60, 0, 180),
    Wire_Selected_Start_Color=RGB(125, 210, 40),
    Wire_Selected_End_Color=RGBA(0, 0, 0, 50),
    Panel_Default_Color=RGB(255, 250, 90),
    Group_Default_Color=RGBA(255, 255, 255, 150),
    Canvas_Background_Color=RGB(84, 84, 84),
    Canvas_Gridline_Color=RGBA(0, 0, 0, 30),
    Canvas_Gridline_Width=150,
    Canvas_Gridline_Height=50,
    Canvas_Edge_Color=RGB(255, 255, 255),
    Canvas_Shadow_Color=RGBA(0, 0, 0, 80),
    Canvas_Shadow_Size=30,
    MonochromaticOnOff=False,
    Monochromatic_Color=RGB(212, 208, 200))

value_list = ValueList({"UR5 A": 0, "UR5 B": 1, "COMAU": 2, "COWORKING": 3}, selected="UR5 A")
value_list_2 = ValueList({"UR5 A": 0, "UR5 B": 1, "COMAU": 2, "COWORKING": 3}, selected="UR5 B")
panel_2 = Panel("""UR5 A
COMAU""")
stream_filter = StreamFilter(Gate=value_list, Stream0="UR5 A", Stream1="UR5 B", Stream2="COMAU", Stream3=panel_2)
stream_filter_2 = StreamFilter(Gate=value_list_2, Stream0="UR5 A", Stream1="UR5 B", Stream2="COMAU", Stream3=panel_2)
robot_1 = RemoteSender(stream_filter)
robot_2 = RemoteSender(stream_filter_2)

# ----
# Robot Setup & Base Sync
value_list_3 = ValueList({"UR5 A": 0, "UR5 B": 1, "COMAU": 2, "COWORKING": 3}, selected="COMAU")
stream_filter_3 = StreamFilter(Gate=value_list_3, Stream0="UR5 A", Stream1="UR5 B", Stream2="COMAU", Stream3=panel_2)
robot_3 = RemoteSender(stream_filter_3)

# ----
# Prototype Base
number_slider = Slider(200, range=-600..600)
unit_z = UnitZ(Factor=number_slider)
curve = Curve(<curve referenced from the Rhino model>)
extrude = Extrude(Base=curve, Direction=unit_z)
offset_surface = OffsetSurface(Surface=extrude, Distance=Slider(20, range=0..200), BothSides=Toggle(False), CreateSolid=Toggle(True))
custom_preview = CustomPreview(Geometry=offset_surface, Material=ColourSwatch(SwatchColor=RGB(255, 255, 255)))  # disabled
deconstruct_brep = DeconstructBrep(Brep=offset_surface)  # -> flatten(Faces), Edges, Vertices
populate_2d = Populate2D(Region=deconstruct_brep.Faces, Count=Slider(40, range=0..100), Seed=1)  # -> flatten(Population)
point = Point(populate_2d)  # disabled

point_2 = Point([<point referenced from the Rhino model> x3])
curve_2 = Curve(<curve referenced from the Rhino model>)

curve_3 = Curve([<curve referenced from the Rhino model> x3])
curve_4 = Curve([<curve referenced from the Rhino model> x3])
curve_5 = Curve([<curve referenced from the Rhino model> x3])
curve_6 = Curve([<curve referenced from the Rhino model> x4])
curve_7 = Curve([<curve referenced from the Rhino model> x3])
curve_8 = Curve([<curve referenced from the Rhino model> x4])

entwine = Entwine(
    Branch00=curve_7,
    Branch01=curve_8,
    Branch02=curve_3,
    Branch03=curve_4,
    Branch04=curve_5,
    Branch05=curve_6,
    FlattenInputs=True)  # -> simplify(Result)
base_edges = RemoteSender(curve_2)
division = Division(A="850", B="2")
trigger = Trigger(Interval=2000, TimerInterval=2000, Target=[ur5_setup, python_3_script])

robot_1_2 = RemoteReceiver(robot_1)
robot_2_2 = RemoteReceiver(robot_2)
robot_3_2 = RemoteReceiver(robot_3)
ur5_setup = Python3Script(RobotName=robot_1_2)  # -> out, RobotPosition, X_Axis, Y_Axis, Z_Axis, JointPoints, JointLines, SuccessMessage
# ---------- ur5_setup: Python ----------
import robolink as rl  # RoboDK API
import robodk as rdk
import Rhino.Geometry as rg
import math
import numpy as np

# === Inputs ===
# RobotName: Name of the robot in RoboDK (e.g., "UR5")

# Initialize outputs
RobotPosition = None
X_Axis = None
Y_Axis = None
Z_Axis = None
JointPoints = []
JointLines = []
SuccessMessage = ""

# Initialize RoboDK connection
RDK = rl.Robolink()

# Get the robot by name
robot = RDK.Item(RobotName, rl.ITEM_TYPE_ROBOT)

if not robot.Valid():
    SuccessMessage = f"Error: Could not find {RobotName} in RoboDK."
else:
    SuccessMessage = f"Connected to {RobotName} in RoboDK."

    # Get the robot's base pose
    robot_base = robot.Parent()
    if robot_base.Valid():
        base_pose = robot_base.Pose()
    else:
        base_pose = rdk.Mat()

    # Get the robot's current joint angles (degrees)
    joints_deg = robot.Joints().list()
    # Convert joint angles to radians
    joints_rad = [math.radians(angle) for angle in joints_deg]

    # UR5 standard DH parameters (in millimeters)
    d1 = 89.159
    a2 = -425.00
    a3 = -392.25
    d4 = 109.15
    d5 = 94.65
    d6 = 82.3

    alpha = [math.pi/2, 0, 0, math.pi/2, -math.pi/2, 0]
    a = [0, a2, a3, 0, 0, 0]
    d = [d1, 0, 0, d4, d5, d6]
    theta = [
        joints_rad[0],
        joints_rad[1],
        joints_rad[2],
        joints_rad[3],
        joints_rad[4],
        joints_rad[5],
    ]

    # Initialize the base transformation matrix
    T_base = np.array(base_pose.rows)
    # Ensure T_base is a 4x4 matrix
    if T_base.shape != (4, 4):
        SuccessMessage += " Error: Base pose matrix is not 4x4."
    else:
        # Initialize the transformation matrix
        T = T_base

        # Initialize joint positions list
        JointPoints = []

        # Store transformation matrices for each joint
        T_matrices = []

        for i in range(6):  # Six joints
            # DH parameters for current joint
            ai = a[i]
            alphai = alpha[i]
            di = d[i]
            thetai = theta[i]

            # Compute transformation matrix using DH parameters
            cos_theta = math.cos(thetai)
            sin_theta = math.sin(thetai)
            cos_alpha = math.cos(alphai)
            sin_alpha = math.sin(alphai)

            T_joint = np.array([
                [cos_theta, -sin_theta * cos_alpha,  sin_theta * sin_alpha, ai * cos_theta],
                [sin_theta,  cos_theta * cos_alpha, -cos_theta * sin_alpha, ai * sin_theta],
                [0,          sin_alpha,              cos_alpha,             di],
                [0,          0,                      0,                     1]
            ])

            # Update the overall transformation matrix
            T = np.dot(T, T_joint)

            # Save the transformation matrix for this joint
            T_matrices.append(T.copy())

            # Extract the position of the current joint
            position = T[:3, 3]

            # No conversion needed since we're working in millimeters
            joint_point = rg.Point3d(position[0], position[1], position[2])
            JointPoints.append(joint_point)

        # Create lines connecting the joints
        JointLines = []
        for i in range(1, len(JointPoints)):
            line = rg.Line(JointPoints[i - 1], JointPoints[i])
            JointLines.append(line)

        # Optionally, connect the base to the first joint
        if JointPoints:
            base_position = T_base[:3, 3]
            base_point = rg.Point3d(base_position[0], base_position[1], base_position[2])
            line = rg.Line(base_point, JointPoints[0])
            JointLines.insert(0, line)

        # Fetch the robot's pose relative to its base
        robot_pose = robot.Pose()

        # Compute the absolute pose of the TCP in the world coordinate system
        absolute_pose = base_pose * robot_pose

        # Extract position from the absolute pose
        position = absolute_pose.Pos()  # [x, y, z]

        # Create Rhino point for the robot's TCP position
        RobotPosition = rg.Point3d(position[0], position[1], position[2])

        # Extract orientation vectors from the rotation matrix of the absolute pose
        x_vector = rg.Vector3d(absolute_pose[0,0], absolute_pose[1,0], absolute_pose[2,0])
        y_vector = rg.Vector3d(absolute_pose[0,1], absolute_pose[1,1], absolute_pose[2,1])
        z_vector = rg.Vector3d(absolute_pose[0,2], absolute_pose[1,2], absolute_pose[2,2])

        # Scale vectors for visualization purposes
        scale_factor = 200  # Adjust as needed
        x_vector *= scale_factor
        y_vector *= scale_factor
        z_vector *= scale_factor

        # Create lines representing the robot's TCP axes
        X_Axis = rg.Line(RobotPosition, x_vector)
        Y_Axis = rg.Line(RobotPosition, y_vector)
        Z_Axis = rg.Line(RobotPosition, z_vector)

        # Optionally, connect the last joint to the TCP
        if JointPoints and RobotPosition:
            line = rg.Line(JointPoints[-1], RobotPosition)
            JointLines.append(line)
# ---------- end ur5_setup ----------
ur5_setup_2 = Python3Script(RobotName=robot_2_2)  # -> out, RobotPosition, X_Axis, Y_Axis, Z_Axis, JointPoints, JointLines, SuccessMessage; disabled; same code as ur5_setup
python_3_script = Python3Script(RobotName=robot_3_2)  # -> X_Axis, Y_Axis, Z_Axis, RobotPosition, JointPoints, JointLines
# ---------- python_3_script: Python ----------
import robolink as rl  # RoboDK API
import robodk as rdk
import Rhino.Geometry as rg
import math
import numpy as np

# === Inputs ===
# RobotName: Name of the robot in RoboDK (e.g., "COMAU NJ 60-2.2")

# Initialize outputs
RobotPosition = None
X_Axis = None
Y_Axis = None
Z_Axis = None
JointPoints = []
JointLines = []
SuccessMessage = ""

# Initialize RoboDK connection
RDK = rl.Robolink()

# Get the robot by name
robot = RDK.Item(RobotName, rl.ITEM_TYPE_ROBOT)

if not robot.Valid():
    SuccessMessage = f"Error: Could not find {RobotName} in RoboDK."
else:
    SuccessMessage = f"Connected to {RobotName} in RoboDK."

    # Get the robot's base pose
    robot_base = robot.Parent()
    if robot_base.Valid():
        base_pose = robot_base.Pose()
    else:
        base_pose = rdk.Mat()

    # Get the robot's current joint angles (degrees)
    joints_deg = robot.Joints().list()
    # Convert joint angles to radians
    joints_rad = [math.radians(angle) for angle in joints_deg]

    # COMAU NJ 60-2.2 DH parameters (in millimeters and radians)
    d1 = 740
    a2 = 600
    a3 = 1200
    d4 = 1350
    d6 = 260

    # DH parameters for COMAU NJ 60-2.2
    alpha = [math.pi/2, 0, 0, math.pi/2, -math.pi/2, 0]
    a = [0, a2, a3, 0, 0, 0]
    d = [d1, 0, 0, d4, 0, d6]
    theta = [
        joints_rad[0],
        joints_rad[1],
        joints_rad[2],
        joints_rad[3],
        joints_rad[4],
        joints_rad[5],
    ]

    # Initialize the base transformation matrix
    T_base = np.array(base_pose.rows)
    # Ensure T_base is a 4x4 matrix
    if T_base.shape != (4, 4):
        SuccessMessage += " Error: Base pose matrix is not 4x4."
    else:
        # Initialize the transformation matrix
        T = T_base

        # Initialize joint positions list
        JointPoints = []

        # Store transformation matrices for each joint
        T_matrices = []

        for i in range(6):  # Six joints
            # DH parameters for current joint
            ai = a[i]
            alphai = alpha[i]
            di = d[i]
            thetai = theta[i]

            # Compute transformation matrix using DH parameters
            cos_theta = math.cos(thetai)
            sin_theta = math.sin(thetai)
            cos_alpha = math.cos(alphai)
            sin_alpha = math.sin(alphai)

            T_joint = np.array([
                [cos_theta, -sin_theta * cos_alpha,  sin_theta * sin_alpha, ai * cos_theta],
                [sin_theta,  cos_theta * cos_alpha, -cos_theta * sin_alpha, ai * sin_theta],
                [0,          sin_alpha,              cos_alpha,             di],
                [0,          0,                      0,                     1]
            ])

            # Update the overall transformation matrix
            T = np.dot(T, T_joint)

            # Save the transformation matrix for this joint
            T_matrices.append(T.copy())

            # Extract the position of the current joint
            position = T[:3, 3]

            # No conversion needed since we're working in millimeters
            joint_point = rg.Point3d(position[0], position[1], position[2])
            JointPoints.append(joint_point)

        # Create lines connecting the joints
        JointLines = []
        for i in range(1, len(JointPoints)):
            line = rg.Line(JointPoints[i - 1], JointPoints[i])
            JointLines.append(line)

        # Optionally, connect the base to the first joint
        if JointPoints:
            base_position = T_base[:3, 3]
            base_point = rg.Point3d(base_position[0], base_position[1], base_position[2])
            line = rg.Line(base_point, JointPoints[0])
            JointLines.insert(0, line)

        # Fetch the robot's pose relative to its base
        robot_pose = robot.Pose()

        # Compute the absolute pose of the TCP in the world coordinate system
        absolute_pose = base_pose * robot_pose

        # Extract position from the absolute pose
        position = absolute_pose.Pos()  # [x, y, z]

        # Create Rhino point for the robot's TCP position
        RobotPosition = rg.Point3d(position[0], position[1], position[2])

        # Extract orientation vectors from the rotation matrix of the absolute pose
        x_vector = rg.Vector3d(absolute_pose[0,0], absolute_pose[1,0], absolute_pose[2,0])
        y_vector = rg.Vector3d(absolute_pose[0,1], absolute_pose[1,1], absolute_pose[2,1])
        z_vector = rg.Vector3d(absolute_pose[0,2], absolute_pose[1,2], absolute_pose[2,2])

        # Scale vectors for visualization purposes
        scale_factor = 200  # Adjust as needed
        x_vector *= scale_factor
        y_vector *= scale_factor
        z_vector *= scale_factor

        # Create lines representing the robot's TCP axes
        X_Axis = rg.Line(RobotPosition, rg.Point3d(RobotPosition.X + x_vector.X, RobotPosition.Y + x_vector.Y, RobotPosition.Z + x_vector.Z))
        Y_Axis = rg.Line(RobotPosition, rg.Point3d(RobotPosition.X + y_vector.X, RobotPosition.Y + y_vector.Y, RobotPosition.Z + y_vector.Z))
        Z_Axis = rg.Line(RobotPosition, rg.Point3d(RobotPosition.X + z_vector.X, RobotPosition.Y + z_vector.Y, RobotPosition.Z + z_vector.Z))

        # Optionally, connect the last joint to the TCP
        if JointPoints and RobotPosition:
            line = rg.Line(JointPoints[-1], RobotPosition)
            JointLines.append(line)
# ---------- end python_3_script ----------

# ----
# base lines
polyline = PolyLine(Vertices=point_2, Closed=True)
explode = Explode(Curve=base_edges, Recursive=True)  # -> flatten(Segments), Vertices

# ----
# Real-Time Visualization
panel_3 = Panel(ur5_setup.Z_Axis)
panel_4 = Panel(ur5_setup.JointLines)
panel_5 = Panel(ur5_setup.SuccessMessage)
panel_6 = Panel(ur5_setup.RobotPosition)
panel_7 = Panel(ur5_setup.X_Axis)
panel_8 = Panel(ur5_setup.Y_Axis)
panel_9 = Panel(ur5_setup.JointPoints)

list_item = ListItem(List=[python_3_script.X_Axis, ur5_setup.X_Axis], Index=0, Wrap=True)  # -> Item, Item1
list_item_2 = ListItem(List=[ur5_setup.Y_Axis, python_3_script.Y_Axis], Index=0, Wrap=True)  # -> Item, Item1
list_item_3 = ListItem(List=[ur5_setup.Z_Axis, python_3_script.Z_Axis], Index=0, Wrap=True)  # -> Item, Item1

custom_preview_lineweights = CustomPreviewLineweights(
    Geometry=ur5_setup.JointLines,
    Shader=ColourSwatch(SwatchColor=RGB(184, 184, 184)),
    Thickness=Slider(0.5, range=0..200),
    Absolute=False)

colour_swatch = ColourSwatch(SwatchColor=RGB(255, 0, 0))
colour_swatch_2 = ColourSwatch(SwatchColor=RGB(82, 255, 3))
colour_swatch_3 = ColourSwatch(SwatchColor=RGB(17, 101, 145))
entwine_2 = Entwine(
    Branch00=list_item.Item,
    Branch01=list_item_2.Item,
    Branch02=list_item_3.Item,
    Branch03=list_item.Item1,
    Branch04=list_item_2.Item1,
    Branch05=list_item_3.Item1,
    FlattenInputs=True)
entwine_3 = Entwine(
    Branch00=colour_swatch,
    Branch01=colour_swatch_2,
    Branch02=colour_swatch_3,
    Branch03=colour_swatch,
    Branch04=colour_swatch_2,
    Branch05=colour_swatch_3,
    Branch06=colour_swatch,
    Branch07=colour_swatch_2,
    Branch08=colour_swatch_3,
    FlattenInputs=True)
custom_preview_lineweights_2 = CustomPreviewLineweights(Geometry=entwine_2, Shader=entwine_3, Thickness=Slider(4, range=0..10), Absolute=False)

# ----
# target angle tuning A
# robot base
number_slider_2 = Slider(0.35, range=0..1)
# target angle tuning B
number_slider_3 = Slider(0.4, range=0..1)
plane = Plane()
robot_1_3 = RemoteReceiver(robot_1)
python_3_script_2 = Python3Script(RobotName=robot_1_3, UpdateRoboDK=Toggle(False), PlanesList=plane)  # -> out, SuccessMessage, TargetPoses, Program, TCPOrientations, PlaneExtra; inputs PlanesList: list of Plane
# ---------- python_3_script_2: Python ----------
import robolink as rl    # RoboDK API for controlling and communicating with RoboDK   
import robodk as rdk     # RoboDK tools, such as matrix operations and other utilities
import Rhino.Geometry as rg  # Import Rhino.Geometry module as rg
import math

# === Inputs ===
# RobotName: Name of the robot in RoboDK (e.g., "UR5")
# UpdateRoboDK: Boolean toggle to execute the script and update RoboDK when True
# PlanesList: List of Rhino Plane objects (each plane contains both target point and orientation)

# Initialize outputs
SuccessMessage = ""
TargetPoses = []  # List of converted poses
Program = ""
TCPOrientations = []
TargetPointCoordinates = []
PlaneExtra = []  # Unreachable planes for other robots to attempt

# Function to convert Rhino Plane to RoboDK Pose (4x4 matrix)
def plane_to_pose(plane):
    """Converts a Rhino plane to a RoboDK pose (4x4 matrix)."""
    pose = rdk.Mat([
        [plane.XAxis.X, plane.YAxis.X, plane.ZAxis.X, plane.OriginX],
        [plane.XAxis.Y, plane.YAxis.Y, plane.ZAxis.Y, plane.OriginY],
        [plane.XAxis.Z, plane.YAxis.Z, plane.ZAxis.Z, plane.OriginZ],
        [0, 0, 0, 1]
    ])
    return pose

# Function to format the orientation of the TCP as strings for easy reporting
def format_tcp_orientation(plane, milestone):
    """Formats the TCP orientation (X, Y, Z axes) for a given milestone."""
    x_axis = plane.XAxis
    y_axis = plane.YAxis
    z_axis = plane.ZAxis
    return f"TCP orientation at {milestone}:\n  X-axis: {x_axis}\n  Y-axis: {y_axis}\n  Z-axis: {z_axis}"

# Function to format the target point coordinates {x, y, z} for reporting
def format_target_coordinates(plane, milestone):
    """Formats the target point coordinates as a string for a given milestone."""
    return f"{plane.OriginX}, {plane.OriginY}, {plane.OriginZ}"

# Check required inputs before proceeding
if not RobotName:
    SuccessMessage = "Error: RobotName is required."
elif not PlanesList or not isinstance(PlanesList, list):
    SuccessMessage = "Error: PlanesList must be a list of Rhino Plane objects."
elif any(not isinstance(plane, rg.Plane) for plane in PlanesList):
    SuccessMessage = "Error: All elements in PlanesList must be Rhino Plane objects."
elif UpdateRoboDK is None:
    SuccessMessage = "Error: UpdateRoboDK toggle is required."
elif not UpdateRoboDK:
    SuccessMessage = "UpdateRoboDK is set to False. No action taken."
else:
    # Connect to RoboDK only if UpdateRoboDK is True
    RDK = rl.Robolink()  # Initialize RoboDK connection
    SuccessMessage = "Connected to RoboDK."
    
    # Retrieve the robot by name
    robot = RDK.Item(RobotName, rl.ITEM_TYPE_ROBOT)
    
    if not robot.Valid():
        SuccessMessage += f"\nError: Could not find {RobotName} in RoboDK."
    else:
        SuccessMessage += f"\nFound robot '{robot.Name()}' in RoboDK."
        
        # Get the robot's base and tool
        robot_base = robot.Parent()
        tool = robot.getLink(rl.ITEM_TYPE_TOOL)
        
        # Check if the robot base and tool are valid
        if not robot_base.Valid():
            SuccessMessage += "\nError: Robot's base not found."
        else:
            SuccessMessage += f"\nRobot base: {robot_base.Name()}"

        if not tool.Valid():
            SuccessMessage += "\nError: Robot's tool not found."
        else:
            SuccessMessage += f"\nRobot tool: {tool.Name()}"

        # Enable collision detection in RoboDK
        RDK.setCollisionActive(1)

        if not robot_base.Valid() or not tool.Valid():
            SuccessMessage += "\nCannot proceed without valid base and tool."
        else:
            # Set the robot to its home position before starting
            robot.MoveJ(robot.JointsHome())

            # Get the robot base frame pose
            base_pose = robot_base.Pose()

            # Create a new program
            SuccessMessage += "\nCreating program in RoboDK..."
            program_name = "MoveThroughPlanesProgram"
            program = RDK.AddProgram(program_name, robot)
            program.setFrame(robot_base)  # Set the base frame of the robot
            program.setTool(tool)  # Set the tool of the robot

            # Process each plane in PlanesList independently
            for idx, plane in enumerate(PlanesList):
                # Convert plane to RoboDK pose
                target_pose_robot = plane_to_pose(plane)

                # Adjust the target pose with respect to the robot's base frame
                base_pose_inv = base_pose.inv()
                target_pose_relative = base_pose_inv * target_pose_robot

                # Try a linear movement first
                linear_movement_success = False
                try:
                    robot.MoveL(target_pose_relative, False)  # Simulation mode, does not execute actual motion
                    linear_movement_success = True
                    SuccessMessage += f"\nPlane {idx+1} reachable with linear movement."
                except Exception as e:
                    SuccessMessage += f"\nPlane {idx+1} unreachable with linear movement. Error: {str(e)}"
                    
                    # Attempt a joint movement if linear movement fails
                    try:
                        robot.MoveJ(target_pose_relative, False)  # Simulation mode, does not execute actual motion
                        SuccessMessage += f"\nPlane {idx+1} reachable with joint movement."
                    except Exception as e:
                        SuccessMessage += f"\nPlane {idx+1} unreachable with both linear and joint movements. Error: {str(e)}"
                        PlaneExtra.append(plane)  # Add unreachable plane to PlaneExtra for another robot
                        continue  # Skip this plane and move to the next one

                # Store the pose
                TargetPoses.append(target_pose_relative)

                # Format TCP orientation and coordinates for reporting
                milestone = f"Plane {idx+1}"
                TCPOrientations.append(format_tcp_orientation(plane, milestone))
                TargetPointCoordinates.append(format_target_coordinates(plane, milestone))

                # Add the movement target in RoboDK
                target_name = f"Plane_{idx+1}"
                target = RDK.AddTarget(target_name, robot_base, robot)
                target.setAsCartesianTarget()
                target.setPose(target_pose_relative)

                # Add the correct type of movement to the program
                if linear_movement_success:
                    program.MoveL(target)  # Add the successful linear movement to the program
                else:
                    program.MoveJ(target)  # Add the fallback joint movement to the program

            Program = program_name  # Assign the created program's name to the output
            SuccessMessage += f"\nProgram '{program_name}' created successfully."
# ---------- end python_3_script_2 ----------
panel_10 = Panel(python_3_script_2.PlaneExtra)
plane_2 = Plane(python_3_script_2.PlaneExtra)  # disabled
list_item_4 = ListItem(List=python_3_script_2.PlaneExtra, Index=0, Wrap=True)  # disabled

# ----
# Physical Calibration
number_slider_4 = Slider(20, range=0..100)
tablepoints = Point([<point referenced from the Rhino model> x1683])
point_3 = Point([<point referenced from the Rhino model> x3672])
tablepointscomau = RemoteSender(point_3)
unit_z_2 = UnitZ(Factor="20")
tablepointsur5 = RemoteSender(tablepoints)
move = Move(Geometry=tablepointscomau, Motion=unit_z_2)  # -> Geometry, Transform
unit_z_3 = UnitZ(Factor=number_slider_4)
move_2 = Move(Geometry=tablepointsur5, Motion=unit_z_3)  # -> Geometry, Transform
point_list = PointList(Points=move_2.Geometry, Size=Slider(10, range=1..10))  # disabled
point_list_2 = PointList(Points=move.Geometry, Size=Slider(10, range=1..10))  # disabled
tablepointscomau_2 = RemoteReceiver(tablepointscomau)
tablepointsur5_2 = RemoteReceiver(tablepointsur5)
deconstruct = Deconstruct(Point=tablepointscomau_2)  # -> XComponent, YComponent, ZComponent
deconstruct_2 = Deconstruct(Point=tablepointsur5_2)  # -> XComponent, YComponent, ZComponent
concatenate = Concatenate(
    FragmentA="{",
    FragmentB=deconstruct_2.XComponent,
    FragmentA_2=",",
    FragmentB_2=deconstruct_2.YComponent,
    FragmentA_3=",",
    FragmentA_4=deconstruct_2.ZComponent,
    FragmentA_5="}")  # -> flatten(Result)
concatenate_2 = Concatenate(
    FragmentA="{",
    FragmentB=deconstruct.XComponent,
    FragmentA_2=",",
    FragmentB_2=deconstruct.YComponent,
    FragmentA_3=",",
    FragmentA_4=deconstruct.ZComponent,
    FragmentA_5="}")  # -> flatten(Result)

number_slider_5 = Slider(1176, range=0..3672)
data_dam = DataDam(DataDataA=Slider(1654, range=0..1683), BufferDelay=10000000, BufferMode=0)
data_dam_2 = DataDam(DataDataA=Slider(549, range=0..1683), BufferDelay=10000000, BufferMode=0)
data_dam_3 = DataDam(DataDataA=Slider(90, range=-360..360), BufferDelay=10000000, BufferMode=0)
robot_1_4 = RemoteReceiver(robot_1)
robot_2_3 = RemoteReceiver(robot_2)
robot_3_3 = RemoteReceiver(robot_3)
python_3_script_3 = Python3Script(
    TablePoints=concatenate,
    RobotName=robot_1_4,
    PointIndex=data_dam,
    SetBase=Toggle(True),
    RotationZ=Slider(0, range=-360..360))  # -> out, BasePosition, SuccessMessage; inputs TablePoints: list of Point3d, PointIndex: Int32, RotationZ: Double
# ---------- python_3_script_3: Python ----------
import robolink as rl        # RoboDK API for communication 
import robodk as rdk         # RoboDK robotic simulation environment
import Rhino.Geometry as rg  # Rhino geometry for working with 3D points
import math                  # Math module for calculations

# Initialize RoboDK link
RDK = rl.Robolink()
# Ensure that RobotName is defined correctly from Grasshopper
if 'RobotName' not in globals() or not RobotName:
    raise NameError("RobotName is not defined or empty.")

# Fetch robot item by name
robot = RDK.Item(RobotName, rl.ITEM_TYPE_ROBOT)

# Ensure the robot is found in RoboDK
if not robot.Valid():
    raise NameError(f"Error: Could not find robot '{RobotName}' in RoboDK.")

# Define functions
def connect_to_robot(robot_name) -> str:
    """
    Connect to the robot using its name and return a success or error message.

    :param robot_name: The name of the robot in RoboDK.
    :return: A message indicating success or error.
    """
    robot = RDK.Item(robot_name, rl.ITEM_TYPE_ROBOT)
    if not robot.Valid():
        return f"Error: Could not find robot '{robot_name}' in RoboDK."
    else:
        return f"Connected to robot '{robot_name}' in RoboDK."


def set_robot_base(robot, x, y, z, rz_deg) -> str:
    """
    Set the robot's base at a specific point (x, y, z) with a rotation along the Z-axis.

    :param robot: The robot item in RoboDK.
    :param x: X coordinate for the base position.
    :param y: Y coordinate for the base position.
    :param z: Z coordinate for the base position.
    :param rz_deg: Rotation angle around the Z-axis in degrees.
    :return: A success or error message regarding the base setting.
    """
    rz_rad = math.radians(rz_deg)  # Convert degrees to radians
    rotation_matrix = rdk.rotz(rz_rad)  # Create a rotation matrix
    translation_matrix = rdk.transl(x, y, z)  # Create a translation matrix
    base_pose = translation_matrix * rotation_matrix  # Combine translation and rotation

    robot_base = robot.Parent()  # Get the robot's base (parent in RoboDK)

    if robot_base.Valid():
        robot_base.setPose(base_pose)  # Set the base pose
        return f"Robot '{RobotName}' base set at Point {PointIndex} with RotationZ={rz_deg} degrees successfully."
    else:
        return "Error: Could not find or access the robot base."


def get_current_base_position(robot) -> str:
    """
    Retrieve the current base position and rotation of the robot.

    :param robot: The robot item in RoboDK.
    :return: A string containing the current base position and rotation details.
    """
    robot_base = robot.Parent()  # Get the robot's base

    if robot_base.Valid():
        current_base_pose = robot_base.Pose()  # Get the current pose of the base
        current_position = current_base_pose.Pos()  # Extract position (X, Y, Z)
        rx_rad, ry_rad, rz_rad = rdk.pose_2_xyzrpy(current_base_pose)[3:]  # Get rotation angles
        rz_deg = math.degrees(rz_rad)  # Convert Z-axis rotation to degrees
        return f"Current base position: X={current_position[0]}, Y={current_position[1]}, Z={current_position[2]}, RotationZ={rz_deg} degrees"
    else:
        return "Error: Could not retrieve base position."


def validate_point_index(point_index, points_list) -> bool:
    """
    Validate whether the point index is within the bounds of the points list.

    :param point_index: The index of the point to check.
    :param points_list: The list of points.
    :return: True if the index is valid, False otherwise.
    """
    return 0 <= point_index < len(points_list)


# Function to transform Rhino Z-axis values for RoboDK
def rhino_to_robodk_coordinates(point):
    """
    Transform a Rhino point to RoboDK-compatible coordinates, ensuring correct height (Z) adjustment.
    
    :param point: A Rhino point (with X, Y, Z values).
    :return: Transformed X, Y, Z coordinates.
    """
    # Assuming that Rhino Z needs to map directly to RoboDK Z and no additional transformation is needed.
    # If a transformation is needed (for example, flipping the Z axis), apply it here.
    return point.X, point.Y, point.Z

# Main script logic
SuccessMessage = connect_to_robot(RobotName)  # Connect to the robot
if "Error" not in SuccessMessage:
    # Validate the point index
    if not validate_point_index(PointIndex, TablePoints):
        SuccessMessage = f"Error: Point index {PointIndex} is out of bounds."
    else:
        point = TablePoints[PointIndex]  # Get the point at the specified index
        x, y, z = rhino_to_robodk_coordinates(point)  # Transform Rhino coordinates to RoboDK coordinates

        # Set the base if SetBase is true, otherwise retrieve current base position
        if SetBase:
            rz_deg = RotationZ  # Get the rotation value for the base
            SuccessMessage = set_robot_base(robot, x, y, z, rz_deg)
            BasePosition = f"Base set at: X={x}, Y={y}, Z={z}, RotationZ={rz_deg} degrees"
        else:
            BasePosition = get_current_base_position(robot)
else:
    BasePosition = ""

# Output the messages
print(SuccessMessage)
print(BasePosition)
# ---------- end python_3_script_3 ----------
python_3_script_4 = Python3Script(TablePoints=concatenate, RobotName=robot_2_3, PointIndex=data_dam_2, SetBase=Toggle(False), RotationZ=data_dam_3)  # -> out, BasePosition, SuccessMessage; inputs TablePoints: list of Point3d, PointIndex: Int32, RotationZ: Double; disabled
# ---------- python_3_script_4: Python ----------
import robolink as rl       
import robodk as rdk        
import Rhino.Geometry as rg 
import math                 
SuccessMessage = ""   
BasePosition = ""     
JointPoints = []      
JointLines = []       


RDK = rl.Robolink()
robot = RDK.Item(RobotName, rl.ITEM_TYPE_ROBOT)
if not robot.Valid():
    
    SuccessMessage = f"Error: Could not find robot '{RobotName}' in RoboDK."
else:
    
    SuccessMessage = f"Connected to robot '{RobotName}' in RoboDK."

    
    if PointIndex >= len(TablePoints) or PointIndex < 0:
        SuccessMessage = f"Error: Point index {PointIndex} is out of bounds."
    else:
        
        point = TablePoints[PointIndex]
        
        
        x = float(point.X)
        y = float(point.Y)
        z = float(point.Z)
        
        
        if SetBase:
           

            
            rz_deg = RotationZ  

            
            rz_rad = math.radians(rz_deg)

           
            rotation_matrix = rdk.rotz(rz_rad)

           
            translation_matrix = rdk.transl(x, y, z)

            
            base_pose = translation_matrix * rotation_matrix

            # === End of Code for RotationZ ===

            # Get the robot's base (parent item in RoboDK)
            robot_base = robot.Parent()

            # Check if robot base is valid before setting pose
            if robot_base.Valid():
                # Set the robot base pose in RoboDK
                robot_base.setPose(base_pose)

                
                BasePosition = f"Base set at: X={x}, Y={y}, Z={z}, RotationZ={rz_deg} degrees"
                SuccessMessage = f"Robot '{RobotName}' base set at Point {PointIndex} with RotationZ={rz_deg} degrees successfully."
            else:
                
                SuccessMessage = "Error: Could not find or access the robot base."
                BasePosition = ""
        else:
            
            robot_base = robot.Parent()
            if robot_base.Valid():
                
                current_base_pose = robot_base.Pose()
                # Extract the translation components (position)
                current_position = current_base_pose.Pos()
                # Extract rotation angles around X, Y, Z axes (in radians)
                rx_rad, ry_rad, rz_rad = rdk.pose_2_xyzrpy(current_base_pose)[3:]  # Angles in radians
                # Convert rotation around Z-axis from radians to degrees
                rz_deg = math.degrees(rz_rad)
                # Update the BasePosition output with current position and rotation
                BasePosition = f"Current base position: X={current_position[0]}, Y={current_position[1]}, Z={current_position[2]}, RotationZ={rz_deg} degrees"
            else:
                # If robot base is not valid, update the BasePosition output
                BasePosition = "Error: Could not retrieve base position."
# ---------- end python_3_script_4 ----------
python_3_script_5 = Python3Script(
    TablePoints=tablepointscomau_2,
    RobotName=robot_3_3,
    PointIndex=number_slider_5,
    SetBase=Toggle(True),
    RotationZ=Slider(0, range=-360..360))  # -> out, BasePosition, SuccessMessage; inputs TablePoints: list of Point3d, PointIndex: Int32, RotationZ: Double; same code as python_3_script_3
panel_11 = Panel(python_3_script_3.BasePosition)
panel_12 = Panel(python_3_script_3.SuccessMessage)
panel_13 = Panel(python_3_script_4.BasePosition)
panel_14 = Panel(python_3_script_4.SuccessMessage)
panel_15 = Panel(python_3_script_5.BasePosition)
panel_16 = Panel(python_3_script_5.SuccessMessage)

list_item_5 = ListItem(List=tablepointscomau_2, Index=number_slider_5, Wrap=True)
list_item_6 = ListItem(List=tablepointsur5_2, Index=data_dam, Wrap=True)
comaubase = RemoteSender(list_item_5)
ur5base = RemoteSender(list_item_6)

# ----
# base point
panel_17 = Panel("2350")
division_2 = Division(A=panel_17, B="2")
comaubase_2 = RemoteReceiver(comaubase)
ur5base_2 = RemoteReceiver(ur5base)
unit_z_4 = UnitZ(Factor=division)
unit_z_5 = UnitZ(Factor=division_2)
point_4 = Point(comaubase_2)
point_5 = Point(ur5base_2)
move_3 = Move(Geometry=point_5, Motion=unit_z_4)  # -> Geometry, Transform
move_4 = Move(Geometry=point_4, Motion=unit_z_5)  # -> Geometry, Transform
orientation_point_a = RemoteSender(move_3.Geometry)
orientation_point_b = RemoteSender(move_4.Geometry)

list_item_7 = ListItem(List=[python_3_script.RobotPosition, ur5_setup.RobotPosition], Index=0, Wrap=True)  # -> Item, Item1
point_6 = Point([list_item_7.Item, list_item_7.Item1, comaubase, ur5base])
sphere = Sphere(Base=point_6, Radius=Slider(5, range=0..100))
custom_preview_2 = CustomPreview(Geometry=sphere, Material=ColourSwatch(SwatchColor=RGB(0, 0, 0)))

# ----
# select group
null_item = NullItem(Item=entwine)  # -> NullFlags, InvalidFlags, Description
number_slider_6 = Slider(6, range=0..9)
cull_pattern = CullPattern(List=entwine, CullPattern=invert(null_item.NullFlags))
construct_domain = ConstructDomain(DomainStart=0, DomainEnd=number_slider_6)
range = Range(Domain=construct_domain, Steps=number_slider_6)  # -> flatten(Range)

partition_list = PartitionList(List=cull_pattern, Size="3")
concatenate_3 = Concatenate(Fragment_A="{", Fragment_B=range, A=";*}")

split_tree = SplitTree(Data=partition_list, Masks=flatten(concatenate_3))  # -> Positive, Negative
curve_middle = CurveMiddle(Curve=split_tree.Positive)
line = Line(split_tree.Positive)

# ----
# task allocation robots
orientation_point_a_2 = RemoteReceiver(orientation_point_a)
orientation_point_b_2 = RemoteReceiver(orientation_point_b)
python_3_script_6 = Python3Script(EdgesTree=line, RobotPointA=orientation_point_a_2, RobotPointB=orientation_point_b_2)  # -> out, assembly_order, task_allocation; inputs EdgesTree: tree of Line, RobotPointA: Point3d, RobotPointB: Point3d
# ---------- python_3_script_6: Python ----------
import Rhino.Geometry as rg
from Grasshopper import DataTree
from Grasshopper.Kernel.Data import GH_Path

# Inputs:
# EdgesTree - DataTree of Line objects representing truss edges
# RobotPointA - Point3d representing Robot A's base location
# RobotPointB - Point3d representing Robot B's base location

# Initialize outputs
assembly_order = DataTree[object]()
task_allocation = DataTree[str]()

# Collect all distances to determine the maximum distance for each robot
distances_A = []
distances_B = []

for path in EdgesTree.Paths:
    edges = EdgesTree.Branch(path)
    for edge in edges:
        mid_point = edge.PointAt(0.5)
        dist_to_A = mid_point.DistanceTo(RobotPointA)
        dist_to_B = mid_point.DistanceTo(RobotPointB)
        distances_A.append(dist_to_A)
        distances_B.append(dist_to_B)

max_dist_A = max(distances_A) if distances_A else 1.0
max_dist_B = max(distances_B) if distances_B else 1.0

# Process each branch
for path in EdgesTree.Paths:
    edges = EdgesTree.Branch(path)
    num_edges = len(edges)
    assembly_branch = []
    allocation_branch = []

    # Collect edge data
    edge_data = []
    for idx, edge in enumerate(edges):
        mid_point = edge.PointAt(0.5)
        dist_to_A = mid_point.DistanceTo(RobotPointA)
        dist_to_B = mid_point.DistanceTo(RobotPointB)
        rel_dist_to_A = dist_to_A / max_dist_A
        rel_dist_to_B = dist_to_B / max_dist_B
        edge_data.append({
            'index': idx,
            'edge': edge,
            'dist_to_A': dist_to_A,
            'dist_to_B': dist_to_B,
            'rel_dist_to_A': rel_dist_to_A,
            'rel_dist_to_B': rel_dist_to_B
        })

    if path.Indices[-1] == 0:
        # Branch {*;0}
        # Determine which robot is closer to the total of all edges
        total_rel_dist_A = sum(e['rel_dist_to_A'] for e in edge_data)
        total_rel_dist_B = sum(e['rel_dist_to_B'] for e in edge_data)
        if total_rel_dist_A <= total_rel_dist_B:
            closer_robot = '0'
            farther_robot = '1'
        else:
            closer_robot = '1'
            farther_robot = '0'

        # Assign edges to robots
        # Closer robot gets two edges (farthest from its base point)
        # Farther robot gets one edge (closest to its base point)
        if closer_robot == '0':
            edge_data.sort(key=lambda e: e['dist_to_A'], reverse=True)
            closer_edges = edge_data[:2]
            farther_edges = [e for e in edge_data if e not in closer_edges]
            farther_edge = min(farther_edges, key=lambda e: e['dist_to_B'])
        else:
            edge_data.sort(key=lambda e: e['dist_to_B'], reverse=True)
            closer_edges = edge_data[:2]
            farther_edges = [e for e in edge_data if e not in closer_edges]
            farther_edge = min(farther_edges, key=lambda e: e['dist_to_A'])

        # Assign to assembly order and task allocation
        assigned_edges = []
        for e in closer_edges:
            assigned_edges.append((e['index'], closer_robot, e['edge']))
        assigned_edges.append((farther_edge['index'], farther_robot, farther_edge['edge']))

        # Arrange edges to alternate for the first two edges
        assigned_edges.sort(key=lambda x: x[0])  # Sort by original index
        if assigned_edges[0][1] == assigned_edges[1][1]:
            # If first two edges are assigned to the same robot, swap the second with the third
            assigned_edges[1], assigned_edges[2] = assigned_edges[2], assigned_edges[1]

        # Add to outputs
        for idx, robot, edge in assigned_edges:
            assembly_branch.append(edge)
            allocation_branch.append(robot)
    else:
        # Branch {*;1}
        # Assign each edge to the relative closest robot
        for e in edge_data:
            idx = e['index']
            edge = e['edge']
            if e['rel_dist_to_A'] <= e['rel_dist_to_B']:
                robot = '0'
            else:
                robot = '1'
            assembly_branch.append(edge)
            allocation_branch.append(robot)

        # For each robot, sort their assigned edges by decreasing absolute distance
        # Since we need to maintain assembly order, we can sort the entire branch if necessary
        # For now, we keep the order as is, assuming the original order is acceptable

    # Add branches to outputs
    assembly_order.AddRange(assembly_branch, path)
    task_allocation.AddRange(allocation_branch, path)

# Outputs:
# AssemblyOrder - DataTree of edges in assembly order
# TaskAllocation - DataTree of strings indicating which robot ('0' or '1') is assigned to each edge
# ---------- end python_3_script_6 ----------
assembly_order = RemoteSender(python_3_script_6.assembly_order)
task_allocation = RemoteSender(python_3_script_6.task_allocation)

# ----
# orientation to truss
# average point of the 5 closest lines in the current state of assambly
flatten_tree = FlattenTree(Tree=python_3_script_6.assembly_order, Path="{0}")
list_indices = ListIndices(List=flatten_tree)
split_list = SplitList(List=flatten_tree, Index=graft(list_indices))  # -> simplify(ListA), ListB
insert_items = InsertItems(List=split_list.ListA, Item=explode.Segments, Indices=0, Wrap=False)
number_slider_7 = Slider(5, range=0..10)
curve_middle_2 = CurveMiddle(Curve=insert_items)
list_item_8 = ListItem(List=curve_middle_2, Index="-1", Wrap=True)
construct_domain_2 = ConstructDomain(DomainStart=0, DomainEnd=number_slider_7)
distance = Distance(PointA=curve_middle_2, PointB=list_item_8)
sort_list = SortList(Keys=distance, ValuesValuesA=curve_middle_2)  # -> Keys, ValuesValuesA
range_2 = Range(Domain=construct_domain_2, Steps=number_slider_7)
line_2 = Line(flatten_tree)
curve_middle_3 = CurveMiddle(Curve=line_2)
end_points = EndPoints(Curve=line_2)  # -> Start, End
list_item_9 = ListItem(List=sort_list.ValuesValuesA, Index=range_2, Wrap=True)
average = Average(Input=list_item_9)  # -> flatten(ArithmeticMean)
plane_3pt = Plane3Pt(PointA=curve_middle_3, PointB=end_points.Start, PointC=average)
rotate_plane_by_axis = RotatePlaneByAxis(Plane=plane_3pt, Axis="x", Angle=270)
assembly_order_2 = RemoteReceiver(assembly_order)
task_allocation_2 = RemoteReceiver(task_allocation)
flip_plane = FlipPlane(Plane=rotate_plane_by_axis, ReverseX=False, ReverseY=False, SwapAxes=False)
# truss centre
unflatten_tree = UnflattenTree(Tree=flip_plane, Guide=assembly_order_2)
dispatch = Dispatch(List=unflatten_tree, DispatchPattern=task_allocation_2)  # -> ListA, ListB

# ----
# orientation frames Robot A
orientation_point_a_3 = RemoteReceiver(orientation_point_a)
assembly_order_3 = RemoteReceiver(assembly_order)
task_allocation_3 = RemoteReceiver(task_allocation)
dispatch_2 = Dispatch(List=assembly_order_3, DispatchPattern=task_allocation_3)  # -> ListA, ListB
line_3 = Line(dispatch_2.ListA)
curve_middle_4 = CurveMiddle(Curve=line_3)
end_points_2 = EndPoints(Curve=line_3)  # -> Start, End
point_7 = Point(orientation_point_a_3)
plane_3pt_2 = Plane3Pt(PointA=curve_middle_4, PointB=end_points_2.Start, PointC=point_7)
rotate_plane_by_axis_2 = RotatePlaneByAxis(Plane=plane_3pt_2, Axis="x", Angle=90)
flip_plane_2 = FlipPlane(Plane=rotate_plane_by_axis_2, ReverseX=False, ReverseY=False, SwapAxes=False)
plane_3 = Plane(flip_plane_2)

# ----
# orientation frames Robot B
# target angle tuning
orientation_point_b_3 = RemoteReceiver(orientation_point_b)
assembly_order_4 = RemoteReceiver(assembly_order)
task_allocation_4 = RemoteReceiver(task_allocation)
dispatch_3 = Dispatch(List=assembly_order_4, DispatchPattern=task_allocation_4)  # -> ListA, ListB
line_4 = Line(dispatch_3.ListB)
curve_middle_5 = CurveMiddle(Curve=line_4)
end_points_3 = EndPoints(Curve=line_4)  # -> Start, End
point_8 = Point(orientation_point_b_3)
plane_3pt_3 = Plane3Pt(PointA=curve_middle_5, PointB=end_points_3.Start, PointC=point_8)
# robot base
rotate_plane_by_axis_3 = RotatePlaneByAxis(Plane=plane_3pt_3, Axis="x", Angle=90)
# truss centre
flip_plane_3 = FlipPlane(Plane=rotate_plane_by_axis_3, ReverseX=False, ReverseY=False, SwapAxes=False)
plane_4 = Plane(flip_plane_3)

# ----
# Display
# Step
number_slider_8 = Slider(32, range=0..32)
assembly_order_5 = RemoteReceiver(assembly_order)
task_allocation_5 = RemoteReceiver(task_allocation)
split_list_2 = SplitList(List=flatten(assembly_order_5), Index=number_slider_8)  # -> ListA, ListB
split_list_3 = SplitList(List=flatten(task_allocation_5), Index=number_slider_8)  # -> ListA, ListB
dispatch_4 = Dispatch(List=split_list_2.ListA, DispatchPattern=split_list_3.ListA)  # -> ListA, ListB
pipe = Pipe(Curve=dispatch_4.ListA, Radius=5, Caps=0)
pipe_2 = Pipe(Curve=dispatch_4.ListB, Radius=5, Caps=0)
custom_preview_3 = CustomPreview(
    Geometry=pipe,
    Material={diffuse=RGB(255, 0, 0), emission=RGB(76, 0, 0), shine=0.5, specular=RGB(255, 255, 255), transparency=0})  # disabled
custom_preview_4 = CustomPreview(
    Geometry=pipe_2,
    Material={diffuse=RGB(0, 76, 255), emission=RGB(0, 23, 76), shine=0.5, specular=RGB(255, 255, 255), transparency=0})  # disabled

task_allocation_6 = RemoteReceiver(task_allocation)  # disabled

# ----
# target planes
tween_two_planes = TweenTwoPlanes(PlaneA=flatten(plane_3), PlaneB=flatten(dispatch.ListA), Factor=number_slider_2, Quaternion=True)  # -> flatten(Tween)
tween_two_planes_2 = TweenTwoPlanes(PlaneA=flatten(plane_4), PlaneB=flatten(dispatch.ListB), Factor=number_slider_3, Quaternion=True)  # -> flatten(Tween)
task_allocation_7 = RemoteReceiver(flatten(task_allocation))
assembly_order_6 = RemoteReceiver(assembly_order)
weave = Weave(Pattern=task_allocation_7, Stream0=tween_two_planes_2, Stream1=tween_two_planes, NullGaps=False)
unflatten_tree_2 = UnflattenTree(Tree=weave, Guide=assembly_order_6)
plane_5 = Plane(unflatten_tree_2)

task_allocation_8 = RemoteReceiver(task_allocation)  # disabled
assembly_order_7 = RemoteReceiver(assembly_order)
boolean = Boolean(invert(flatten(task_allocation_8)))  # disabled

# ----
# approach planes
number_slider_9 = Slider(40, range=0..1000)
deconstruct_plane = DeconstructPlane(Plane=plane_5)  # -> Origin, XAxis, YAxis, ZAxis
amplitude = Amplitude(Vector=deconstruct_plane.ZAxis, Amplitude=number_slider_9)
move_5 = Move(Geometry=plane_5, Motion=expr("-x", amplitude))  # -> Geometry, Transform
approach_target_planes = RemoteSender(move_5.Geometry)

approach_target_planes_2 = RemoteReceiver(approach_target_planes)

sphere_2 = Sphere(Base=ur5_setup.JointPoints, Radius=Slider(20.8, range=0..100))
custom_preview_5 = CustomPreview(Geometry=sphere_2, Material=ColourSwatch(SwatchColor=RGB(201, 201, 201)))
panel_18 = Panel("{0;1}")
panel_19 = Panel("""J0
J1
J2
J3
J4
J5""")

entwine_4 = Entwine(Branch00=list_item.Item, Branch01=list_item.Item1, FlattenInputs=True)
end_points_4 = EndPoints(Curve=entwine_4)  # -> Start, End
text_tag = TextTag(Location=end_points_4.End, Text="x")

entwine_5 = Entwine(Branch00=list_item_2.Item, Branch01=list_item_2.Item1, FlattenInputs=True)
entwine_6 = Entwine(Branch00=list_item_3.Item, Branch01=list_item_3.Item1, FlattenInputs=True)
data = Data(sphere_2)

end_points_5 = EndPoints(Curve=entwine_5)  # -> Start, End
end_points_6 = EndPoints(Curve=entwine_6)  # -> Start, End
text_tag_2 = TextTag(Location=end_points_5.End, Text="y")
text_tag_3 = TextTag(Location=end_points_6.End, Text="z")

panel_20 = Panel(data)
area = Area(Geometry=data)  # -> Area, Centroid

tree_branch = TreeBranch(Tree=area.Centroid, Path="{0;0}", MaintainPaths=True)  # -> flatten(Branch)
panel_21 = Panel(tree_branch)

text_tag_4 = TextTag(Location=tree_branch, Text=panel_19, Colour=ColourSwatch(SwatchColor=RGB(255, 0, 0)))  # disabled

# ----
# reorientate x/z target planes
deconstruct_plane_2 = DeconstructPlane(Plane=weave)  # -> Origin, XAxis, YAxis, ZAxis; disabled
deconstruct_vector = DeconstructVector(Vector=deconstruct_plane_2.XAxis)  # -> XComponent, YComponent, ZComponent; disabled
smaller_than = SmallerThan(FirstNumber=deconstruct_vector.ZComponent, SecondNumber=0)  # -> SmallerThan, OrEqualTo; disabled
dispatch_5 = Dispatch(List=weave, DispatchPattern=smaller_than.SmallerThan)  # -> ListA, ListB; disabled
flip_plane_4 = FlipPlane(Plane=dispatch_5.ListA, ReverseX=True, ReverseY=True, SwapAxes=False)  # disabled
flip_plane_5 = FlipPlane(Plane=dispatch_5.ListB, ReverseX=False, ReverseY=True, SwapAxes=False)  # disabled

boolean_2 = Boolean(invert(smaller_than.SmallerThan))  # disabled

weave_2 = Weave(Pattern=boolean_2, Stream0=flip_plane_4, Stream1=flip_plane_5, NullGaps=False)  # disabled
deconstruct_plane_3 = DeconstructPlane(Plane=weave_2)  # -> Origin, XAxis, YAxis, ZAxis; disabled
deconstruct_vector_2 = DeconstructVector(Vector=deconstruct_plane_3.YAxis)  # -> XComponent, YComponent, ZComponent; disabled
smaller_than_2 = SmallerThan(FirstNumber=deconstruct_vector_2.XComponent, SecondNumber=0)  # -> SmallerThan, OrEqualTo; disabled
dispatch_6 = Dispatch(List=weave_2, DispatchPattern=smaller_than_2.SmallerThan)  # -> ListA, ListB; disabled
flip_plane_6 = FlipPlane(Plane=dispatch_6.ListA, ReverseX=False, ReverseY=True, SwapAxes=False)  # disabled
flip_plane_7 = FlipPlane(Plane=dispatch_6.ListB, ReverseX=False, ReverseY=False, SwapAxes=False)  # disabled

boolean_3 = Boolean(invert(smaller_than_2.SmallerThan))  # disabled
unflatten_tree_3 = UnflattenTree(Tree=flatten(weave_2), Guide=assembly_order_7)
panel_22 = Panel(weave_2)  # disabled
# preview plane A
deconstruct_plane_4 = DeconstructPlane(Plane=weave_2)  # -> Origin, XAxis, YAxis, ZAxis; disabled
amplitude_2 = Amplitude(Vector=deconstruct_plane_4.ZAxis, Amplitude=50)  # disabled
custom_preview_6 = CustomPreview(
    Geometry=weave_2,
    Material={diffuse=RGB(255, 0, 0), emission=RGB(76, 0, 0), shine=0.5, specular=RGB(255, 255, 255), transparency=0})  # disabled
vector_display = VectorDisplay(Anchor=deconstruct_plane_4.Origin, Vector=amplitude_2)  # disabled

weave_3 = Weave(Pattern=boolean_3, Stream0=flip_plane_6, Stream1=flip_plane_7, NullGaps=False)  # disabled

dispatch_7 = Dispatch(List=weave_3, DispatchPattern=flatten(task_allocation_6))  # -> ListA, ListB; disabled

deconstruct_plane_5 = DeconstructPlane(Plane=dispatch_7.ListA)  # -> Origin, XAxis, YAxis, ZAxis; disabled
deconstruct_vector_3 = DeconstructVector(Vector=deconstruct_plane_5.ZAxis)  # -> XComponent, YComponent, ZComponent; disabled
smaller_than_3 = SmallerThan(FirstNumber=deconstruct_vector_3.YComponent, SecondNumber=0)  # -> SmallerThan, OrEqualTo; disabled
dispatch_8 = Dispatch(List=dispatch_7.ListA, DispatchPattern=smaller_than_3.SmallerThan)  # -> ListA, ListB; disabled
boolean_4 = Boolean(invert(smaller_than_3.SmallerThan))  # disabled
flip_plane_8 = FlipPlane(Plane=dispatch_8.ListB, ReverseX=False, ReverseY=False, SwapAxes=False)  # disabled
weave_4 = Weave(Pattern=boolean_4, Stream0=dispatch_8.ListA, Stream1=flip_plane_8, NullGaps=False)  # disabled

deconstruct_plane_6 = DeconstructPlane(Plane=dispatch_7.ListB)  # -> Origin, XAxis, YAxis, ZAxis; disabled
deconstruct_vector_4 = DeconstructVector(Vector=deconstruct_plane_6.ZAxis)  # -> XComponent, YComponent, ZComponent; disabled
smaller_than_4 = SmallerThan(FirstNumber=deconstruct_vector_4.YComponent, SecondNumber=0)  # -> SmallerThan, OrEqualTo; disabled
dispatch_9 = Dispatch(List=dispatch_7.ListB, DispatchPattern=smaller_than_4.SmallerThan)  # -> ListA, ListB; disabled
boolean_5 = Boolean(invert(smaller_than_4.SmallerThan))  # disabled
flip_plane_9 = FlipPlane(Plane=dispatch_8.ListA)  # disabled
flip_plane_10 = FlipPlane(Plane=dispatch_9.ListA, ReverseX=False, ReverseY=False, SwapAxes=False)  # disabled
flip_plane_11 = FlipPlane(Plane=dispatch_9.ListB, ReverseX=False, ReverseY=False, SwapAxes=False)  # disabled
weave_5 = Weave(Pattern=boolean_5, Stream0=flip_plane_10, Stream1=flip_plane_11, NullGaps=False)  # disabled
weave_6 = Weave(Pattern=boolean, Stream0=weave_4, Stream1=weave_5, NullGaps=False)  # disabled

# ----
# approach pickup planes A
number_slider_10 = Slider(60, range=0..100)

# ----
# approach pickup planes B
number_slider_11 = Slider(60, range=0..100)

# ----
# script v6
task_allocation_9 = RemoteReceiver(task_allocation)
panel_23 = Panel("gripper = 0")
panel_24 = Panel("gripper = 1")
panel_25 = Panel("waiting")
panel_26 = Panel("pause")
boolean_6 = Boolean(invert(task_allocation_9))
integer = Integer(boolean_6)

# ----
# pick_up_planes_A
pickup_slots = Slider(6, range=0..10)
distance_from_base = Slider(-600, range=-1000..1000)
distance_between_slots = Slider(60, range=0..100)
ur5base_3 = RemoteReceiver(ur5base)
xy_plane = XYPlane(Origin=ur5base_3)
multiplication = Multiplication(A=distance_between_slots, B=pickup_slots)
division_3 = Division(A=multiplication, B=2)
rotate_plane_by_axis_4 = RotatePlaneByAxis(Plane=xy_plane, Axis="z", Angle=90)
deconstruct_plane_7 = DeconstructPlane(Plane=rotate_plane_by_axis_4)  # -> Origin, XAxis, YAxis, ZAxis
amplitude_3 = Amplitude(Vector=deconstruct_plane_7.YAxis, Amplitude=distance_from_base)
amplitude_4 = Amplitude(Vector=deconstruct_plane_7.YAxis, Amplitude=expr("-x", division_3))
move_6 = Move(Geometry=rotate_plane_by_axis_4, Motion=amplitude_3)  # -> Geometry, Transform
move_7 = Move(Geometry=move_6.Geometry, Motion=amplitude_4)  # -> Geometry, Transform
amplitude_5 = Amplitude(Vector=deconstruct_plane_7.YAxis, Amplitude=distance_between_slots)
linear_array = LinearArray(Geometry=move_7.Geometry, Direction=amplitude_5, Count=pickup_slots)  # -> Geometry, Transform
flip_plane_12 = FlipPlane(Plane=linear_array.Geometry, ReverseX=True, ReverseY=True, SwapAxes=True)

rotate_plane_by_axis_5 = RotatePlaneByAxis(Plane=flip_plane_12, Axis="z", Angle="270")

pick_up_planes_a = RemoteSender(rotate_plane_by_axis_5)

pick_up_planes_a_2 = RemoteReceiver(pick_up_planes_a)
deconstruct_plane_8 = DeconstructPlane(Plane=pick_up_planes_a_2)  # -> Origin, XAxis, YAxis, ZAxis
amplitude_6 = Amplitude(Vector=deconstruct_plane_8.ZAxis, Amplitude=number_slider_10)
move_8 = Move(Geometry=pick_up_planes_a_2, Motion=expr("-x", amplitude_6))  # -> Geometry, Transform
approach_pickup_planes_a = RemoteSender(move_8.Geometry)

plane_6 = Plane(pick_up_planes_a_2)

approach_pickup_planes_a_2 = RemoteReceiver(approach_pickup_planes_a)
pick_up_planes_a_3 = RemoteReceiver(pick_up_planes_a)

# ----
# pick_up_planes_B
distance_between_slots_2 = Slider(60, range=0..100)
pickup_slots_2 = Slider(6, range=0..10)
distance_from_base_2 = Slider(800, range=0..1000)
comaubase_3 = RemoteReceiver(comaubase)
xy_plane_2 = XYPlane(Origin=comaubase_3)
multiplication_2 = Multiplication(A=distance_between_slots_2, B=pickup_slots_2)
division_4 = Division(A=multiplication_2, B=2)
rotate_plane_by_axis_6 = RotatePlaneByAxis(Plane=xy_plane_2, Axis="z", Angle=90)
deconstruct_plane_9 = DeconstructPlane(Plane=rotate_plane_by_axis_6)  # -> Origin, XAxis, YAxis, ZAxis
amplitude_7 = Amplitude(Vector=deconstruct_plane_9.YAxis, Amplitude=distance_from_base_2)
amplitude_8 = Amplitude(Vector=deconstruct_plane_9.YAxis, Amplitude=expr("-x", division_4))
move_9 = Move(Geometry=rotate_plane_by_axis_6, Motion=amplitude_7)  # -> Geometry, Transform
move_10 = Move(Geometry=move_9.Geometry, Motion=amplitude_8)  # -> Geometry, Transform
amplitude_9 = Amplitude(Vector=deconstruct_plane_9.YAxis, Amplitude=distance_between_slots_2)
linear_array_2 = LinearArray(Geometry=move_10.Geometry, Direction=amplitude_9, Count=pickup_slots_2)  # -> Geometry, Transform
flip_plane_13 = FlipPlane(Plane=linear_array_2.Geometry, ReverseX=False, ReverseY=False, SwapAxes=True)

rotate_plane_by_axis_7 = RotatePlaneByAxis(Plane=flip_plane_13, Axis="z", Angle="270")

pick_up_planes_b = RemoteSender(rotate_plane_by_axis_7)

pick_up_planes_b_2 = RemoteReceiver(pick_up_planes_b)
deconstruct_plane_10 = DeconstructPlane(Plane=pick_up_planes_b_2)  # -> Origin, XAxis, YAxis, ZAxis
amplitude_10 = Amplitude(Vector=deconstruct_plane_10.ZAxis, Amplitude=number_slider_11)
move_11 = Move(Geometry=pick_up_planes_b_2, Motion=expr("-x", amplitude_10))  # -> Geometry, Transform
approach_pickup_planes_b = RemoteSender(move_11.Geometry)

approach_pickup_planes_b_2 = RemoteReceiver(approach_pickup_planes_b)
pick_up_planes_b_3 = RemoteReceiver(pick_up_planes_b)
python_3_script_7 = Python3Script(
    target_planes=plane_5,
    task_allocation=integer,
    approach_planes=approach_target_planes_2,
    pick_up_planes_A=pick_up_planes_a_3,
    pick_up_planes_B=pick_up_planes_b_3,
    pickup_approach_planes_A=approach_pickup_planes_a_2,
    pickup_approach_planes_B=approach_pickup_planes_b_2)  # -> out, robotA_commands, robotB_commands, robotA_status, robotB_status; inputs target_planes: tree, task_allocation: tree of Int32, approach_planes: tree of Plane, pick_up_planes_A: list of Plane, pick_up_planes_B: list of Plane, pickup_approach_planes_A: list of Plane, pickup_approach_planes_B: list of Plane
# ---------- python_3_script_7: Python ----------
import Rhino.Geometry as rg
import Grasshopper
from Grasshopper.Kernel.Data import GH_Path

# Inputs:
# target_planes - DataTree of Planes in assembly order
# approach_planes - DataTree of Planes corresponding to target_planes (optional)
# task_allocation - DataTree of integers (0 or 1) indicating robot assignment (0 for A, 1 for B)
# pick_up_planes_A - List of Planes for Robot A's pick-up points
# pick_up_planes_B - List of Planes for Robot B's pick-up points
# pickup_approach_planes_A - List of Planes for Robot A's pickup approach points (optional)
# pickup_approach_planes_B - List of Planes for Robot B's pickup approach points (optional)
# pause_command - Command to pause the robot (optional)
# waiting_command - Command for waiting state (optional)
# home_plane_A - Plane for Robot A's home position (optional)
# home_plane_B - Plane for Robot B's home position (optional)

# Ensure inputs are set to the correct access and type hints in the Grasshopper Python component

# Initialize output data trees
robotA_commands = Grasshopper.DataTree[object]()
robotB_commands = Grasshopper.DataTree[object]()
robotA_status = Grasshopper.DataTree[str]()
robotB_status = Grasshopper.DataTree[str]()

# Initialize gripper states and last edge counters
gripper_state = {'A': 0, 'B': 0}
last_edge_counter = {'A': None, 'B': None}

# Initialize edge counter
edge_counter = 0

# Initialize pickup plane indices for each robot
pickup_index = {'A': 0, 'B': 0}

# Get the total number of pickup planes for each robot
num_pickup_planes_A = len(pick_up_planes_A) if pick_up_planes_A else 1
num_pickup_planes_B = len(pick_up_planes_B) if pick_up_planes_B else 1

# Get the total number of pickup approach planes for each robot
num_pickup_approach_planes_A = len(pickup_approach_planes_A) if pickup_approach_planes_A else 0
num_pickup_approach_planes_B = len(pickup_approach_planes_B) if pickup_approach_planes_B else 0

# Process each branch
for path in target_planes.Paths:
    planes = target_planes.Branch(path)
    approaches = approach_planes.Branch(path) if approach_planes and approach_planes.PathExists(path) else [None]*len(planes)
    allocations = task_allocation.Branch(path)
    num_edges = len(planes)
    
    # Check if the branch is {*;0}
    if path.Indices[-1] == 0:
        # Special handling for branch {*;0}
        
        # Collect indices of edges placed by each robot
        indices_by_robot = {'A': [], 'B': []}
        for idx, alloc in enumerate(allocations):
            robot_name = 'A' if alloc == 0 else 'B'
            indices_by_robot[robot_name].append(idx)
        
        # Prepare variables to keep track of steps
        max_steps = 0  # To synchronize steps between robots
        # Lists to store actions per robot
        actions_A = []
        actions_B = []
        
        # Process the first two edges
        for idx in range(2):
            edge_counter += 1
            plane = planes[idx]
            approach = approaches[idx] if idx < len(approaches) else None
            robot = allocations[idx]
            assigned_robot = 'A' if robot == 0 else 'B'
            other_robot = 'B' if assigned_robot == 'A' else 'A'
            last_edge_counter[assigned_robot] = edge_counter
            
            # Select the pickup plane for the assigned robot
            if assigned_robot == 'A':
                pickup_plane_list = pick_up_planes_A
                pickup_approach_list = pickup_approach_planes_A
                num_pickup_planes = num_pickup_planes_A
                num_pickup_approach_planes = num_pickup_approach_planes_A
                if num_pickup_planes > 0:
                    pickup_plane = pickup_plane_list[pickup_index['A'] % num_pickup_planes]
                else:
                    pickup_plane = None  # Handle empty list case
                if num_pickup_approach_planes > 0:
                    pickup_approach_plane = pickup_approach_list[pickup_index['A'] % num_pickup_approach_planes]
                else:
                    pickup_approach_plane = None
                pickup_index['A'] += 1
            else:
                pickup_plane_list = pick_up_planes_B
                pickup_approach_list = pickup_approach_planes_B
                num_pickup_planes = num_pickup_planes_B
                num_pickup_approach_planes = num_pickup_approach_planes_B
                if num_pickup_planes > 0:
                    pickup_plane = pickup_plane_list[pickup_index['B'] % num_pickup_planes]
                else:
                    pickup_plane = None  # Handle empty list case
                if num_pickup_approach_planes > 0:
                    pickup_approach_plane = pickup_approach_list[pickup_index['B'] % num_pickup_approach_planes]
                else:
                    pickup_approach_plane = None
                pickup_index['B'] += 1
            
            # Steps for the assigned robot
            steps_robot = []
            # Step 1: Move to pickup approach plane (if provided)
            if pickup_approach_plane is not None:
                steps_robot.append(("Move to pickup approach", pickup_approach_plane))
            # Step 2: Move to pick up
            if pickup_plane is not None:
                steps_robot.append(("Move to pick up", pickup_plane))
            else:
                steps_robot.append(("Move to pick up", "No pickup plane provided"))
            # Step 3: Close gripper
            steps_robot.append(("Close gripper", gripper_close_command))
            gripper_state[assigned_robot] = 1
            # Step 4: Move to approach plane (if provided)
            if approach is not None:
                steps_robot.append((f"Move to approach plane {edge_counter}", approach))
            # Step 5: Move to target plane
            steps_robot.append((f"Move to target {edge_counter}", plane))
            # Step 6 onwards: Holding edge
            steps_robot.append((f"Holding edge {edge_counter}", waiting_command))
            # Add steps to robot's action list
            if assigned_robot == 'A':
                actions_A.extend(steps_robot)
            else:
                actions_B.extend(steps_robot)
            
            # For the other robot, add waiting steps to synchronize
            num_steps = len(steps_robot)
            waiting_status = f"Holding edge {last_edge_counter[other_robot]}" if gripper_state[other_robot] == 1 else "Waiting for other robot"
            waiting_steps = [(waiting_status, waiting_command)] * num_steps
            if other_robot == 'A':
                actions_A.extend(waiting_steps)
            else:
                actions_B.extend(waiting_steps)
            
            max_steps = max(max_steps, len(actions_A), len(actions_B))
        
        # After first two edges, both robots pause for connection
        if pause_command is not None:
            pause_step = ("Pause for connection", pause_command)
            actions_A.append(pause_step)
            actions_B.append(pause_step)
            max_steps += 1
        
        # Process the third edge if it exists
        if num_edges > 2:
            idx = 2  # Index of the third edge
            edge_counter += 1
            plane = planes[idx]
            approach = approaches[idx] if idx < len(approaches) else None
            robot = allocations[idx]
            assigned_robot = 'A' if robot == 0 else 'B'
            other_robot = 'B' if assigned_robot == 'A' else 'A'
            last_edge_counter[assigned_robot] = edge_counter
            
            # Select the pickup plane for the assigned robot
            if assigned_robot == 'A':
                pickup_plane_list = pick_up_planes_A
                pickup_approach_list = pickup_approach_planes_A
                num_pickup_planes = num_pickup_planes_A
                num_pickup_approach_planes = num_pickup_approach_planes_A
                if num_pickup_planes > 0:
                    pickup_plane = pickup_plane_list[pickup_index['A'] % num_pickup_planes]
                else:
                    pickup_plane = None
                if num_pickup_approach_planes > 0:
                    pickup_approach_plane = pickup_approach_list[pickup_index['A'] % num_pickup_approach_planes]
                else:
                    pickup_approach_plane = None
                pickup_index['A'] += 1
            else:
                pickup_plane_list = pick_up_planes_B
                pickup_approach_list = pickup_approach_planes_B
                num_pickup_planes = num_pickup_planes_B
                num_pickup_approach_planes = num_pickup_approach_planes_B
                if num_pickup_planes > 0:
                    pickup_plane = pickup_plane_list[pickup_index['B'] % num_pickup_planes]
                else:
                    pickup_plane = None
                if num_pickup_approach_planes > 0:
                    pickup_approach_plane = pickup_approach_list[pickup_index['B'] % num_pickup_approach_planes]
                else:
                    pickup_approach_plane = None
                pickup_index['B'] += 1
            
            # Steps for the assigned robot
            steps_robot = []
            # Step 1: Move to pickup approach plane (if provided)
            if pickup_approach_plane is not None:
                steps_robot.append(("Move to pickup approach", pickup_approach_plane))
            # Step 2: Move to pick up
            if pickup_plane is not None:
                steps_robot.append(("Move to pick up", pickup_plane))
            else:
                steps_robot.append(("Move to pick up", "No pickup plane provided"))
            # Step 3: Close gripper
            steps_robot.append(("Close gripper", gripper_close_command))
            gripper_state[assigned_robot] = 1
            # Step 4: Move to approach plane (if provided)
            if approach is not None:
                steps_robot.append((f"Move to approach plane {edge_counter}", approach))
            # Step 5: Move to target plane
            steps_robot.append((f"Move to target {edge_counter}", plane))
            # Step 6: Pause for connection
            if pause_command is not None:
                steps_robot.append(("Pause for connection", pause_command))
            # Step 7: Open gripper
            steps_robot.append(("Open gripper", gripper_open_command))
            gripper_state[assigned_robot] = 0
            # Step 8: Move back to approach plane (if provided)
            if approach is not None:
                steps_robot.append((f"Move to approach plane {edge_counter}", approach))
            # Step 9: Move to home plane (if provided)
            home_plane = home_plane_A if assigned_robot == 'A' else home_plane_B
            if home_plane is not None:
                steps_robot.append(("Moving to home plane", home_plane))
            # Add steps to robot's action list
            if assigned_robot == 'A':
                actions_A.extend(steps_robot)
            else:
                actions_B.extend(steps_robot)
            
            # For the other robot, continue holding edge until pause for connection
            other_steps = []
            for i, (step, cmd) in enumerate(steps_robot):
                if step == "Pause for connection" and pause_command is not None:
                    other_steps.append(("Pause for connection", pause_command))
                else:
                    if gripper_state[other_robot] == 1:
                        other_steps.append((f"Holding edge {last_edge_counter[other_robot]}", waiting_command))
                    else:
                        other_steps.append(("Waiting for other robot", waiting_command))
            if other_robot == 'A':
                actions_A.extend(other_steps)
            else:
                actions_B.extend(other_steps)
            
            max_steps = max(max_steps, len(actions_A), len(actions_B))
        
        # After the third edge and pause, both robots can open grippers and move home
        # Open gripper for the robot that was holding edge
        for robot in ['A', 'B']:
            if gripper_state[robot] == 1:
                gripper_state[robot] = 0
                steps = []
                # Open gripper
                steps.append(("Open gripper", gripper_open_command))
                # Move back to approach plane (if provided)
                if indices_by_robot[robot]:
                    last_edge_idx = indices_by_robot[robot][-1]
                    approach = approaches[last_edge_idx] if last_edge_idx < len(approaches) else None
                    if approach is not None:
                        steps.append((f"Move to approach plane {last_edge_counter[robot]}", approach))
                else:
                    approach = None
                # Move to home plane (if provided)
                home_plane = home_plane_A if robot == 'A' else home_plane_B
                if home_plane is not None:
                    steps.append(("Moving to home plane", home_plane))
                # Add steps to robot's action list
                if robot == 'A':
                    actions_A.extend(steps)
                else:
                    actions_B.extend(steps)
                max_steps = max(max_steps, len(actions_A), len(actions_B))
        
        # Synchronize steps between robots
        total_steps = max(len(actions_A), len(actions_B))
        for i in range(total_steps):
            sub_path = GH_Path(path)
            sub_path = sub_path.AppendElement(i)
            # Robot A actions
            if i < len(actions_A):
                status_A, command_A = actions_A[i]
            else:
                status_A = "Waiting for other robot"
                command_A = waiting_command
            robotA_status.Add(status_A, sub_path)
            robotA_commands.Add(command_A, sub_path)
            # Robot B actions
            if i < len(actions_B):
                status_B, command_B = actions_B[i]
            else:
                status_B = "Waiting for other robot"
                command_B = waiting_command
            robotB_status.Add(status_B, sub_path)
            robotB_commands.Add(command_B, sub_path)
    else:
        # Handle other branches as before
        for idx in range(num_edges):
            plane = planes[idx]
            approach = approaches[idx] if idx < len(approaches) else None
            robot = allocations[idx]
            assigned_robot = 'A' if robot == 0 else 'B'
            other_robot = 'B' if assigned_robot == 'A' else 'A'
            edge_counter += 1
            last_edge_counter[assigned_robot] = edge_counter
            
            # Select the pickup plane for the assigned robot
            if assigned_robot == 'A':
                pickup_plane_list = pick_up_planes_A
                pickup_approach_list = pickup_approach_planes_A
                num_pickup_planes = num_pickup_planes_A
                num_pickup_approach_planes = num_pickup_approach_planes_A
                if num_pickup_planes > 0:
                    pickup_plane = pickup_plane_list[pickup_index['A'] % num_pickup_planes]
                else:
                    pickup_plane = None
                if num_pickup_approach_planes > 0:
                    pickup_approach_plane = pickup_approach_list[pickup_index['A'] % num_pickup_approach_planes]
                else:
                    pickup_approach_plane = None
                pickup_index['A'] += 1
            else:
                pickup_plane_list = pick_up_planes_B
                pickup_approach_list = pickup_approach_planes_B
                num_pickup_planes = num_pickup_planes_B
                num_pickup_approach_planes = num_pickup_approach_planes_B
                if num_pickup_planes > 0:
                    pickup_plane = pickup_plane_list[pickup_index['B'] % num_pickup_planes]
                else:
                    pickup_plane = None
                if num_pickup_approach_planes > 0:
                    pickup_approach_plane = pickup_approach_list[pickup_index['B'] % num_pickup_approach_planes]
                else:
                    pickup_approach_plane = None
                pickup_index['B'] += 1
            
            # Steps for the assigned robot
            steps_robot = []
            # Step 1: Move to pickup approach plane (if provided)
            if pickup_approach_plane is not None:
                steps_robot.append(("Move to pickup approach", pickup_approach_plane))
            # Step 2: Move to pick up
            if pickup_plane is not None:
                steps_robot.append(("Move to pick up", pickup_plane))
            else:
                steps_robot.append(("Move to pick up", "No pickup plane provided"))
            # Step 3: Close gripper
            steps_robot.append(("Close gripper", gripper_close_command))
            gripper_state[assigned_robot] = 1
            # Step 4: Move to approach plane (if provided)
            if approach is not None:
                steps_robot.append((f"Move to approach plane {edge_counter}", approach))
            # Step 5: Move to target plane
            steps_robot.append((f"Move to target {edge_counter}", plane))
            # Step 6: Pause for connection (if provided)
            if pause_command is not None:
                steps_robot.append(("Pause for connection", pause_command))
            # Step 7: Open gripper
            steps_robot.append(("Open gripper", gripper_open_command))
            gripper_state[assigned_robot] = 0
            # Step 8: Move back to approach plane (if provided)
            if approach is not None:
                steps_robot.append((f"Move to approach plane {edge_counter}", approach))
            # Step 9: Move to home plane (if provided)
            home_plane = home_plane_A if assigned_robot == 'A' else home_plane_B
            if home_plane is not None:
                steps_robot.append(("Moving to home plane", home_plane))
            
            # Steps for the other robot
            other_steps = []
            for step, cmd in steps_robot:
                if step == "Pause for connection" and pause_command is not None:
                    other_steps.append(("Pause for connection", pause_command))
                else:
                    if gripper_state[other_robot] == 1:
                        other_steps.append((f"Holding edge {last_edge_counter[other_robot]}", waiting_command))
                    else:
                        other_steps.append(("Waiting for other robot", waiting_command))
            
            # Add steps to data trees
            for i in range(len(steps_robot)):
                sub_path = GH_Path(path)
                sub_path = sub_path.AppendElement(idx)
                sub_path = sub_path.AppendElement(i)
                # Assigned robot
                if assigned_robot == 'A':
                    robotA_status.Add(steps_robot[i][0], sub_path)
                    robotA_commands.Add(steps_robot[i][1], sub_path)
                    robotB_status.Add(other_steps[i][0], sub_path)
                    robotB_commands.Add(other_steps[i][1], sub_path)
                else:
                    robotB_status.Add(steps_robot[i][0], sub_path)
                    robotB_commands.Add(steps_robot[i][1], sub_path)
                    robotA_status.Add(other_steps[i][0], sub_path)
                    robotA_commands.Add(other_steps[i][1], sub_path)

# Outputs:
RobotA_Command = robotA_commands
RobotB_Command = robotB_commands
RobotA_Status = robotA_status
RobotB_Status = robotB_status
# ---------- end python_3_script_7 ----------
path_mapper = PathMapper(python_3_script_7.robotA_commands, source=["{A;B;C}", "{A;B;C;D}"], target=["{A}", "{A}"])
path_mapper_2 = PathMapper(python_3_script_7.robotB_commands, source=["{A;B;C}", "{A;B;C;D}"], target=["{A}", "{A}"])
path_mapper_3 = PathMapper(python_3_script_7.robotA_status, source=["{A;B;C}", "{A;B;C;D}"], target=["{A}", "{A}"])
path_mapper_4 = PathMapper(python_3_script_7.robotB_status, source=["{A;B;C}", "{A;B;C;D}"], target=["{A}", "{A}"])
null_item_2 = NullItem(Item=path_mapper)  # -> NullFlags, InvalidFlags, Description
null_item_3 = NullItem(Item=path_mapper_2)  # -> NullFlags, InvalidFlags, Description
cull_pattern_2 = CullPattern(List=path_mapper, CullPattern=invert(null_item_2.NullFlags))
cull_pattern_3 = CullPattern(List=path_mapper_2, CullPattern=invert(null_item_3.NullFlags))
commands_a = RemoteSender(cull_pattern_2)
commands_b = RemoteSender(cull_pattern_3)
status_a = RemoteSender(path_mapper_3)
status_b = RemoteSender(path_mapper_4)

commands_a_2 = RemoteReceiver(commands_a)
commands_b_2 = RemoteReceiver(commands_b)
list_item_10 = ListItem(List=flatten(commands_a_2), Index=Slider(0, range=0..100), Wrap=False)
list_item_11 = ListItem(List=flatten(commands_b_2), Index=Slider(0, range=0..100), Wrap=False)

# ----
# preview plane A
deconstruct_plane_11 = DeconstructPlane(Plane=commands_a_2)  # -> Origin, XAxis, YAxis, ZAxis
amplitude_11 = Amplitude(Vector=deconstruct_plane_11.ZAxis, Amplitude=50)
custom_preview_7 = CustomPreview(
    Geometry=commands_a_2,
    Material={diffuse=RGB(255, 0, 0), emission=RGB(76, 0, 0), shine=0.5, specular=RGB(255, 255, 255), transparency=0})
vector_display_2 = VectorDisplay(Anchor=deconstruct_plane_11.Origin, Vector=amplitude_11)

# ----
# preview plane B
deconstruct_plane_12 = DeconstructPlane(Plane=commands_b_2)  # -> Origin, XAxis, YAxis, ZAxis
amplitude_12 = Amplitude(Vector=deconstruct_plane_12.ZAxis, Amplitude=50)
custom_preview_8 = CustomPreview(
    Geometry=commands_b_2,
    Material={diffuse=RGB(0, 30, 255), emission=RGB(0, 9, 76), shine=0.5, specular=RGB(255, 255, 255), transparency=0})
vector_display_3 = VectorDisplay(Anchor=deconstruct_plane_12.Origin, Vector=amplitude_12)

commands_a_3 = RemoteReceiver(commands_a)
commands_b_3 = RemoteReceiver(commands_b)

# ----
# Status
# Command
# UR5
# COMAU
panel_27 = Panel(commands_a_3)
panel_28 = Panel(commands_b_3)
status_a_2 = RemoteReceiver(status_a)
status_b_2 = RemoteReceiver(status_b)
panel_29 = Panel(status_a_2)
panel_30 = Panel(status_b_2)
assembly_order_8 = RemoteReceiver(assembly_order)
task_allocation_10 = RemoteReceiver(task_allocation)
panel_31 = Panel(task_allocation_10)
panel_32 = Panel(assembly_order_8)
