# Grasshopper definition script frames robot 6.gh (Grasshopper 1.0.8)
# plug-ins: Aggregations, RhinoCodePluginGH, Heteroptera, Pufferfish, Human, MetaHopper

dynamic_geometry_pipeline = DynamicGeometryPipeline(
    LayerFilter="Structure::Lines",
    TypeFilter="Curve",
    NameFilter="*",
    GroupByLayer=False,
    GroupByType=False,
    IncludeHidden=True,
    IncludeLocked=True,
    enableFullPath=True,
    listenToAttributes=True)
dynamic_geometry_pipeline_2 = DynamicGeometryPipeline(
    LayerFilter="Structure::Rigid",
    TypeFilter="Point",
    NameFilter="*",
    GroupByLayer=False,
    GroupByType=False,
    IncludeHidden=True,
    IncludeLocked=True,
    enableFullPath=True,
    listenToAttributes=True)
dynamic_geometry_pipeline_3 = DynamicGeometryPipeline(
    LayerFilter="Structure::Start",
    TypeFilter="Point",
    NameFilter="*",
    GroupByLayer=False,
    GroupByType=False,
    IncludeHidden=True,
    IncludeLocked=True,
    enableFullPath=True,
    listenToAttributes=True)

py3 = Python3Script(
    in_lines=dynamic_geometry_pipeline,
    in_rigid_points=dynamic_geometry_pipeline_2,
    in_start_point=dynamic_geometry_pipeline_3)  # -> out, assembly_steps, ordered_nodes; inputs in_lines: list of Line, in_rigid_points: list of Point3d, in_start_point: Point3d
# ---------- py3: Python ----------
import rhinoscriptsyntax as rs
import Grasshopper as gh
import Grasshopper.Kernel as ghk
from Grasshopper.Kernel.Data import GH_Path
import Rhino.Geometry as rg
import networkx as nx
from collections import Counter
import math
import numpy as np
import itertools
from itertools import combinations

class Trussemble:
    def __init__(self, lines, rigid_points, start_point):
        ## inputs
        self.lines = lines
        self.points, self.connection_tree = self.__get_line_connectivity(in_lines)
        self.rigid_points = rigid_points
        self.rigid_indices = self.__get_rigid_point_indices()
        self.start_point = start_point
        ## outputs
        self.graph = self.__turn_tree_to_graph(self.connection_tree)
        self.assembly_steps = gh.DataTree[object]()
        self.processed_nodes = []
    
    def __average_point(self, pt1, pt2, pt3):
            # Calculate the average of the x, y, and z coordinates
            avg_x = (pt1.X + pt2.X + pt3.X) / 3
            avg_y = (pt1.Y + pt2.Y + pt3.Y) / 3
            avg_z = (pt1.Z + pt2.Z + pt3.Z) / 3
            
            # Return the average point as a Point3d
            return rg.Point3d(avg_x, avg_y, avg_z)

    def __get_rigid_point_indices(self):
        rigid_indices = []
        for rigid_point in self.rigid_points:
            min_distance = float('inf')
            rigid_idx = None

            if rigid_point in self.points:
                rigid_indices.append(self.points.index(rigid_point))
            else:
                for i, point in enumerate(self.points):
                    distance = rs.Distance(point,rigid_point)
                    if distance < min_distance:
                        min_distance = distance
                        rigid_idx = i
                        
                rigid_indices.append(rigid_idx)
                    
        return rigid_indices

    def __get_line_connectivity(self, lines):
        """
        Create a connectivity tree from a set of lines and return unique points as Point3d and 
        a Grasshopper data structure containing the connectivity information.

        lines: A list of line objects in Rhino.

        Returns a tuple containing a list of unique Point3d and a GH_Structure for connectivity.
        """
        connectivity_tree = gh.DataTree[object]()
        unique_points = {}  # Use a dictionary to map points to their indices

        # Iterate through each line
        for line_index, line in enumerate(lines):
            # Get the start and end points of the line
            start_point = line.From
            end_point = line.To
            
            # Convert to Point3d objects
            start_point3d = rg.Point3d(start_point.X, start_point.Y, start_point.Z)
            end_point3d = rg.Point3d(end_point.X, end_point.Y, end_point.Z)

            # Add points to the unique points dictionary if they don't already exist
            if start_point3d not in unique_points:
                unique_points[start_point3d] = len(unique_points)
            if end_point3d not in unique_points:
                unique_points[end_point3d] = len(unique_points)
            
            # Get the indices of the start and end points
            start_index = unique_points[start_point3d]
            end_index = unique_points[end_point3d]

            # Append the indices to the connectivity tree
            connectivity_tree.EnsurePath(GH_Path(line_index))  # Create a new branch for the line index
            connectivity_tree.AddRange([start_index, end_index], GH_Path(line_index))

        # Convert unique points to a list of Point3d
        unique_points_list = list(unique_points.keys())

        return unique_points_list, connectivity_tree

    def __can_point_be_rigid(self, node):
        graph = self.graph
        neighbours = list(graph.neighbors(node))
        count = 0
        for neighbour in neighbours:
            if neighbour in self.processed_nodes:
                count += 1

        return count >= 3

    def __turn_tree_to_graph(self, connections_tree):
        ## turns connections tree input into networkx graph, connections should be implemented in python (ideally) without use of heteroptera or proximity 2-d
        list_of_tuples = []

        for i in range(connections_tree.BranchCount):
            branch = connections_tree.Branch(i) 
            
            if len(branch) == 2:
                list_of_tuples.append(tuple(branch))
        
        G = nx.Graph()
        G.add_edges_from(list_of_tuples)
        return G

    def __get_first_move(self): 
        start_point = self.start_point
        rigid_ids = self.rigid_indices
        points = self.points
        graph = self.graph

        min_avg_distance_to_start = float('inf')
        neighbours_to_connect_to = []
        first_supports = None

        def find_common_neighbour_combinations(graph, rigid_points_indices):
            valid_combinations = []
            common_neighbors = []
            
            # Generate all combinations of three nodes from rigid_points
            for comb in combinations(rigid_points_indices, 3):
                # Get neighbors for each node in the combination
                neighbors_1 = set(graph.neighbors(comb[0]))
                neighbors_2 = set(graph.neighbors(comb[1]))
                neighbors_3 = set(graph.neighbors(comb[2]))
                
                # Find common neighbors
                common_neighbor = neighbors_1 & neighbors_2 & neighbors_3
                
                # If there is at least one common neighbor, add the combination to the result
                if common_neighbor:
                    valid_combinations.append(comb)
                    common_neighbors.append(list(common_neighbor)[0])

            return valid_combinations, common_neighbors
                
        starting_three_candidates, common_neighbours = find_common_neighbour_combinations(graph, rigid_ids)

        for i, starting_three in enumerate(starting_three_candidates):
            p1 = points[starting_three[0]]
            p2 = points[starting_three[1]]
            p3 = points[starting_three[2]]

            centre = self.__average_point(p1, p2, p3)

            avg_distance = rs.Distance(start_point, centre)
            if avg_distance < min_avg_distance_to_start:
                min_avg_distance_to_start = avg_distance
                first_supports = starting_three
                neighbours_to_connect_to.append(list([common_neighbours[i]]))

        neighbour_to_connect_to = neighbours_to_connect_to[-1][0]

        self.processed_nodes.extend(first_supports)
        self.processed_nodes.append(neighbour_to_connect_to)
        return list(first_supports), neighbour_to_connect_to

    def __check_edges(self, sub_graph_edges):
        graph = self.graph
        edges_to_add = []

        for node1, node2 in combinations(sub_graph_edges, 2):
            if graph.has_edge(node1, node2):
                edges_to_add.append((node1, node2))

        return edges_to_add

    def __find_unprocessed_neighbors_subgraphs(self):
        graph = self.graph
        processed_nodes = self.processed_nodes
        processed_nodes_set = set(processed_nodes)
        
        # Step 1: Find neighbors of the processed nodes that are not yet processed
        unprocessed_neighbors = set()

        # Get the last processed node and find its neighbors first
        last_node = processed_nodes[-1]
        neighbors_last_node = set(graph.neighbors(last_node))
        unprocessed_neighbors_last_node = neighbors_last_node - processed_nodes_set

        # Find unprocessed neighbors of all other nodes
        for node in processed_nodes_set:
            if node == last_node:
                continue  # Skip the last node as we already processed it
            neighbors = set(graph.neighbors(node))
            unprocessed_neighbors.update(neighbors - processed_nodes_set)

        # Add unprocessed neighbors of the last node to the main unprocessed set
        unprocessed_neighbors.update(unprocessed_neighbors_last_node)

        # Step 2: Create subgraphs by finding connected components
        subgraphs = []
        
        # Subgraph that includes only unprocessed neighbors
        unprocessed_subgraph = graph.subgraph(unprocessed_neighbors)
        
        # Find connected components in the unprocessed subgraph
        for component in nx.connected_components(unprocessed_subgraph):
            subgraphs.append(list(component))
        
        # Step 3: Ensure the subgraph connected to the last node in processed_nodes comes first
        subgraphs_sorted = []
        
        # Subgraph connected to the last processed node
        subgraph_last_node = [comp for comp in subgraphs if any(node in unprocessed_neighbors_last_node for node in comp)]
        
        # Remaining subgraphs (not connected to the last node)
        other_subgraphs = [comp for comp in subgraphs if comp not in subgraph_last_node]
        
        # Sort the final output
        if subgraph_last_node:
            subgraphs_sorted.extend(subgraph_last_node)
        
        subgraphs_sorted.extend(other_subgraphs)

        # Return the sorted subgraphs as a nested list
        return subgraphs_sorted

    def __find_connections(self, node):
        graph = self.graph
        can_connect_to = []
        neighbours = graph.neighbors(node)
        for neighbour in neighbours:
            if neighbour in self.processed_nodes:
                can_connect_to.append(neighbour)
        
        return can_connect_to

    def __distance(self, point1, point2):
        return np.linalg.norm(np.array(point1) - np.array(point2))

    def __sort_rigid_candidates(self, candidates):
        origin = self.processed_nodes[-1]
        points = self.points

        sorted_candidates = []
        remaining_candidates = candidates.copy()
        
        # Find the closest point to the origin first
        current_point = min(remaining_candidates, key=lambda c: rs.Distance(points[origin], points[c]))
        sorted_candidates.append(current_point)
        remaining_candidates.remove(current_point)
        
        # Iteratively find the closest point to the last point in sorted_points
        while remaining_candidates:
            current_point = min(remaining_candidates, key=lambda c: rs.Distance(points[sorted_candidates[-1]], points[c]))
            sorted_candidates.append(current_point)
            remaining_candidates.remove(current_point)
        
        return sorted_candidates

    def __get_sorted_supports(self, candidate, supports):
        support_combinations = list(itertools.combinations([x for x in range(len(supports))], 3))
        score_per_combination = {}
        result_supports = []

        def get_combined_distance_to_supports(supports):
            combined_distance = 1.0

            for i in supports:
                for j in supports:
                    if i != j:
                        combined_distance *= rs.Distance(i,j)    
            return combined_distance

        def triangle_area(rs_pointA, rs_pointB, rs_pointC):

            pointA = [rs_pointA.X, rs_pointA.Y, rs_pointA.Z]
            pointB = [rs_pointB.X, rs_pointB.Y, rs_pointB.Z]
            pointC = [rs_pointC.X, rs_pointC.Y, rs_pointC.Z]

            A = np.array(pointA)
            B = np.array(pointB)
            C = np.array(pointC)

            AB = B - A
            AC = C - A

            cross_product = np.cross(AB, AC)

            area = np.linalg.norm(cross_product) / 2

            return area

        for c in support_combinations:
            supports_list = [supports[c[0]], supports[c[1]], supports[c[2]]]

            combined_distance = float(get_combined_distance_to_supports(supports_list))
            area = float(triangle_area(supports_list[0], supports_list[1], supports_list[2]))
            score = combined_distance * (1.0 / area)
            score_per_combination[c] = score
        
        score_per_combination = dict(sorted(score_per_combination.items(), key=lambda item: item[1]))

        support_combinations = list(score_per_combination.keys())
        for support_combination in support_combinations:
            result_support = list(support_combination)
            for i, support in enumerate(supports):

                if i not in support_combination:
                    result_support.append(i)

                result_supports.append(result_support)
        
        return result_supports[0]

    def __check_if_door(self, support_nodes, load_node):
        support_points = [self.points[x] for x in support_nodes]
        load_point = self.points[load_node]
        combination = []

        def point_plane_distance(plane_pts, test_pt):
            # Extract points A, B, C from plane_pts
            A, B, C = plane_pts
            
            # Create two vectors from the points on the plane
            AB = B - A
            AC = C - A
            
            # Calculate the normal vector to the plane using the cross product
            normal_vector = np.cross(AB, AC)
            
            # Plane equation coefficients: Ax + By + Cz + D = 0
            A_coeff, B_coeff, C_coeff = normal_vector
            D_coeff = -np.dot(normal_vector, A)  # D = -(Ax + By + Cz) at point A
            
            # Coordinates of the test point
            x1, y1, z1 = test_pt
            
            # Calculate the distance from the point to the plane
            numerator = abs(A_coeff * x1 + B_coeff * y1 + C_coeff * z1 + D_coeff)
            denominator = np.linalg.norm(normal_vector)
            
            # Distance formula
            distance = numerator / denominator
            return distance

        def rhino_points_to_numpy(rhino_points):
            # Convert a list of Rhino Point3d objects to a 2D NumPy array
            return np.array([[pt.X, pt.Y, pt.Z] for pt in rhino_points])

        def distance_to_centroid(pts, test_pt):
            # Compute the centroid by averaging the x, y, z coordinates of the three points
            centroid = np.mean(pts, axis=0)
            
            # Compute the Euclidean distance between the test point and the centroid
            distance = np.linalg.norm(test_pt - centroid)
            
            return distance

        def is_door(three_supports, load_point, span_height_ratio = 0.25):
            support_pts = rhino_points_to_numpy(three_supports)
            load_pt = np.array([load_point.X, load_point.Y, load_point.Z])

            plane_pts = [support_pts[0], support_pts[1], load_pt]
            test_pt = support_pts[2]

            distance = point_plane_distance(plane_pts, test_pt)
            effective_span = distance_to_centroid(support_pts, load_pt)

            if distance <= (effective_span * span_height_ratio):
                return True
            else:
                return False

        first_three = support_points[:3]
        if not is_door(first_three, load_point):
            return support_points
        else:
            for comb in combinations(support_points, 3):
                if not is_door(list(comb), load_point):
                    combination.extend(list(comb))
                    missing = [x for x in support_points if x not in list(comb)]
                    if missing:
                        combination.extend(missing)
                    return combination
            return True

    def assemble(self):
        graph = self.graph
        points = self.points
        assembly_steps = self.assembly_steps

        while True:
            if len(self.processed_nodes) == 0:
                first_supports, first_neighbours = self.__get_first_move()
                first_neighbour = first_neighbours
                lines_to_add = []

                for support in first_supports:
                    p1 = points[support]
                    p2 = points[first_neighbour]

                    line = rs.AddLine(p1, p2)
                    lines_to_add.append(line)
                
                missing_edges = self.__check_edges(first_supports)
                for missing_edge in missing_edges:
                    p1 = points[missing_edge[0]]
                    p2 = points[missing_edge[1]]

                    line = rs.AddLine(p1,p2)
                    lines_to_add.append(line)

                path = GH_Path(0)
                assembly_steps.AddRange(lines_to_add, path)

            elif len(self.processed_nodes) < len(points):
                non_rigid_candidates = self.__find_unprocessed_neighbors_subgraphs()[0]
                rigid_candidates = [candidate for candidate in non_rigid_candidates if self.__can_point_be_rigid(candidate)]
                sorted_rigid_candidates = self.__sort_rigid_candidates(rigid_candidates)

                for candidate in sorted_rigid_candidates:
                    lines_to_add = []
                    nodes_to_connect_to = self.__find_connections(candidate)
                    nodes_sorted_indices = self.__get_sorted_supports(points[candidate], [points[x] for x in nodes_to_connect_to])
                    sorted_support_nodes = [nodes_to_connect_to[x] for x in nodes_sorted_indices]

                    ## check if it is door
                    if self.__check_if_door(sorted_support_nodes, candidate) == True:

                        ## if it is and cant be resolved, continue to next candidate
                        continue
                    else:

                        ## if it can be resolved return the ordered supports
                        sorted_support_points = self.__check_if_door(sorted_support_nodes, candidate)

                    for point in sorted_support_points:
                        line = rs.AddLine(points[candidate], point)
                        lines_to_add.append(line)
                        
                    self.processed_nodes.append(candidate)
                    path = GH_Path(assembly_steps.BranchCount)
                    assembly_steps.AddRange(lines_to_add, path)
            else:
                return assembly_steps



my_truss = Trussemble(in_lines, in_rigid_points, in_start_point)
assembly_steps = my_truss.assemble()
processed_nodes = my_truss.processed_nodes
nodes = my_truss.points
processed_points = nodes
ordered_nodes = processed_points
# ---------- end py3 ----------
previewlw = CustomPreviewLineweights(
    Geometry=dynamic_geometry_pipeline,
    Shader=ColourSwatch(SwatchColor=RGB(230, 230, 230)),
    Thickness=Slider(0.77, range=0..4),
    Absolute=False)
partition_list = PartitionList(List=py3.assembly_steps, Size="3")
number_slider = Slider(0, range=0..10)  # disabled
number_slider_2 = Slider(7, range=0..20)  # disabled

# ----
# Tony
line = Line([Line((30.44870653, 74.99272119, 0.9052592443), (31.13166696, 74.17658289, 0.9385147668)), Line((30.44870653, 74.99272119, 0.9052592443), (29.39515554, 74.67377143, 0.9159464208)), Line((30.44870653, 74.99272119, 0.9052592443), (30.78371464, 76.14833983, 0.862820439)), Line((32.65870572, 75.48933909, 0.8969596774), (33.73394847, 75.64904018, 0.8976186586)), Line((32.65870572, 75.48933909, 0.8969596774), (32.33940389, 74.44250509, 0.9356012469)), Line((32.65870572, 75.48933909, 0.8969596774), (31.92592265, 76.40978856, 0.855623842))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])
end = EndPoints(Curve=line)  # -> Start, End
merge = Merge(Data1=end.Start, Data2=end.End)
cullpt = CullDuplicates(Points=merge, Tolerance=0.1, CullMode=3)  # -> Points, Indices, Valence
pdecon = Deconstruct(Point=cullpt.Points)  # -> XComponent, YComponent, ZComponent
equalst = EqualityWithinTolerance(FirstNumber=pdecon.ZComponent, SecondNumber=0, Tolerance=0.001)  # -> Equality, Inequality
cull = CullPattern(List=cullpt.Points, CullPattern=equalst.Equality)
rigid_points = Point(flatten([Point(15.82836385, 56.66583125, 0.001774889233), Point(25.53723907, 56.66638259, 0.001607446302), Point(35.24611048, 56.66583125, 0.001774889233), Point(-10.96012806, 6.42290871, 0.001551504205), Point(-10.96011933, 17.48091422, 0.001552515577), Point(62.03459462, 17.48091422, 0.001552515577)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]))
rigid_points_2 = Point(flatten(cull))
truss_lines = Curve(line)
list_item = ListItem(List=rigid_points_2, Index=Slider(29, range=0..100), Wrap=True)
truss_lines_2 = Curve([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])
pt = Point(<point referenced from the Rhino model>)
py3_2 = Python3Script(in_lines=truss_lines, in_rigid_points=rigid_points_2, in_start_point=pt)  # -> out, assembly_steps, ordered_nodes; inputs in_lines: list of Line, in_rigid_points: list of Point3d, in_start_point: Point3d; same code as py3
previewlw_2 = CustomPreviewLineweights(Geometry=truss_lines_2, Shader=ColourSwatch(SwatchColor=RGB(230, 230, 230)), Absolute=False)
item = ListItem(Index=0, Wrap=True)
number_slider_3 = Slider(810, range=1..2182)
panel = Panel(py3_2.assembly_steps)
assembly_steps = Data(py3_2.assembly_steps)

series = Series(Start=0, Step=1, Count=number_slider_3)
tstat = TreeStatistics(Tree=assembly_steps)  # -> Paths, Length, Count
item_2 = ListItem(List=tstat.Paths, Index=series, Wrap=True)
branch = TreeBranch(Tree=assembly_steps, Path=item_2, MaintainPaths=True)

enumerator = Enumerator(Object=branch)  # -> Numbers, Color

dom = ConstructDomain(DomainStart=1, DomainEnd=expr("x+1", tstat.Count))
connected = GetConnectedObjects(Objects=number_slider_3)
set_slider = SetSliderProperties(Slider=connected, Range=dom, Type=1)

previewlw_3 = CustomPreviewLineweights(Geometry=branch, Shader=ColourSwatch(SwatchColor=RGB(70, 93, 125)), Thickness=Slider(5, range=0..10), Absolute=False)

# ----
# select group
# edges
number_slider_4 = Slider(4, range=0..20)
construct_domain = ConstructDomain(DomainStart=0, DomainEnd=number_slider_4)
range = Range(Domain=construct_domain, Steps=number_slider_4)  # -> flatten(Range)

concatenate = Concatenate(Fragment_A="{", Fragment_B=range, A=";*}")

split_tree = SplitTree(Data=partition_list, Masks=flatten(concatenate))  # -> Positive, Negative
curve_middle = CurveMiddle(Curve=split_tree.Positive)
line_2 = Line(split_tree.Positive)

length = Length(Curve=line_2)

deconstruct = Deconstruct(Point=curve_middle)  # -> XComponent, YComponent, ZComponent
sort_list = SortList(Keys=length, ValuesValuesA=line_2)  # -> reverse(Keys), reverse(ValuesValuesA)
list_length = ListLength(List=sort_list.ValuesValuesA)
split_list = SplitList(List=sort_list.ValuesValuesA, Index=expr("x/2", list_length))  # -> ListA, ListB
geometry = Geometry(split_list.ListA)
geometry_2 = Geometry(split_list.ListB)

# ----
# orientation frames "bottom"
line_3 = Line(line_2)  # disabled
end_points = EndPoints(Curve=line_3)  # -> Start, End; disabled

# ----
# 3de plane point based on average closest neighbours
flatten_tree = FlattenTree(Tree=curve_middle, Path="{0}")  # -> graft(Tree); disabled
distance = Distance(PointA=flatten_tree, PointB=flatten(curve_middle))  # disabled
sort_list_2 = SortList(Keys=distance, ValuesA=flatten(line_3))  # -> Keys, ValuesA; disabled
list_item_2 = ListItem(List=sort_list_2.ValuesA, Index=0, Wrap=True)  # -> Item, Item1, Item2, Item3; disabled
merge_2 = Merge(Data1=list_item_2.Item, Data2=list_item_2.Item1, Data3=list_item_2.Item2)  # -> simplify(Result); disabled
curve_middle_2 = CurveMiddle(Curve=merge_2)  # disabled
average = Average(Input=curve_middle_2)  # disabled
geometry_3 = Geometry(merge_2)  # disabled
flatten_tree_2 = FlattenTree(Tree=average, Path="{0}")  # disabled
unflatten_tree = UnflattenTree(Tree=flatten_tree_2, Guide=curve_middle)  # disabled

curve_middle_3 = CurveMiddle(Curve=line_3)  # disabled
tree_branch = TreeBranch(Tree=merge_2, Path=number_slider, MaintainPaths=True)  # disabled
curve_middle_4 = CurveMiddle(Curve=tree_branch)  # disabled
average_2 = Average(Input=curve_middle_4)  # disabled
list_item_3 = ListItem(List=flatten(line_3), Index=number_slider_2, Wrap=True)  # disabled
list_item_4 = ListItem(List=flatten(unflatten_tree), Index=number_slider_2, Wrap=True)  # disabled

# ----
# orientation frames "bottom"
line_4 = Line(geometry_2)
unit_z = UnitZ(Factor="10000")
end_points_2 = EndPoints(Curve=line_4)  # -> Start, End

curve_middle_5 = CurveMiddle(Curve=line_4)

# ----
# orientation frames "bottom"
line_5 = Line(geometry)  # disabled
group = Group(Geometry=flatten(line_5))  # disabled
end_points_3 = EndPoints(Curve=line_5)  # -> Start, End; disabled
bounding_box = BoundingBox(Content=group, Plane=PlaneXY(0, 0, 0))  # -> Box, Box_2; disabled
volume = Volume(Geometry=bounding_box.Box)  # -> Volume, Centroid; disabled

curve_middle_6 = CurveMiddle(Curve=line_5)  # disabled

# ----
# orientation frames "top"
line_6 = Line(geometry)
unit_z_2 = UnitZ(Factor="10000")
end_points_4 = EndPoints(Curve=line_6)  # -> Start, End

curve_middle_7 = CurveMiddle(Curve=line_6)

move = Move(Geometry=curve_middle_5, Motion=unit_z)  # -> Geometry, Transform
plane_3pt = Plane3Pt(PointA=curve_middle_5, PointB=end_points_2.Start, PointC=move.Geometry)  # -> flatten(Plane)
rotate_plane_by_axis = RotatePlaneByAxis(Plane=plane_3pt, Axis="x", Angle=90)

flip_plane = FlipPlane(Plane=rotate_plane_by_axis, ReverseX=False, ReverseY=False, SwapAxes=True)

plane = Plane(flip_plane)

deconstruct_plane = DeconstructPlane(Plane=plane)  # -> Origin, XAxis, YAxis, ZAxis
list_length_2 = ListLength(List=plane)
amplitude = Amplitude(Vector=deconstruct_plane.ZAxis, Amplitude=50)
panel_2 = Panel(list_length_2)
# bottom
vector_display = VectorDisplay(Anchor=deconstruct_plane.Origin, Vector=amplitude)
plane_2 = Plane(plane)

move_2 = Move(Geometry=curve_middle_7, Motion=unit_z_2)  # -> Geometry, Transform
plane_3pt_2 = Plane3Pt(PointA=curve_middle_7, PointB=end_points_4.Start, PointC=move_2.Geometry)  # -> flatten(Plane)
rotate_plane_by_axis_2 = RotatePlaneByAxis(Plane=plane_3pt_2, Axis="x", Angle=90)

flip_plane_2 = FlipPlane(Plane=rotate_plane_by_axis_2, ReverseX=False, ReverseY=False, SwapAxes=False)

plane_3 = Plane(flip_plane_2)

deconstruct_plane_2 = DeconstructPlane(Plane=plane_3)  # -> Origin, XAxis, YAxis, ZAxis
list_length_3 = ListLength(List=plane_3)
amplitude_2 = Amplitude(Vector=deconstruct_plane_2.ZAxis, Amplitude=50)
panel_3 = Panel(list_length_3)
# top
vector_display_2 = VectorDisplay(Anchor=deconstruct_plane_2.Origin, Vector=amplitude_2)
plane_4 = Plane(plane_3)

plane_3pt_3 = Plane3Pt(PointA=curve_middle_6, PointB=end_points_3.Start, PointC=volume.Centroid)  # -> flatten(Plane); disabled
rotate_plane_by_axis_3 = RotatePlaneByAxis(Plane=plane_3pt_3, Axis="x", Angle=90)  # disabled

flip_plane_3 = FlipPlane(Plane=rotate_plane_by_axis_3, ReverseX=False, ReverseY=False, SwapAxes=False)  # disabled

plane_5 = Plane(flip_plane_3)  # disabled

tween_two_planes = TweenTwoPlanes(PlaneA=plane_5, PlaneB=plane_3, Factor=0.5, Quaternion=True)  # disabled

deconstruct_plane_3 = DeconstructPlane(Plane=plane_5)  # -> Origin, XAxis, YAxis, ZAxis; disabled
list_length_4 = ListLength(List=plane_5)  # disabled
amplitude_3 = Amplitude(Vector=deconstruct_plane_3.ZAxis, Amplitude=50)  # disabled
panel_4 = Panel(list_length_4)  # disabled
vector_display_3 = VectorDisplay(Anchor=deconstruct_plane_3.Origin, Vector=amplitude_3)  # disabled
plane_6 = Plane(plane_5)  # disabled

deconstruct_plane_4 = DeconstructPlane(Plane=tween_two_planes)  # -> Origin, XAxis, YAxis, ZAxis; disabled
list_length_5 = ListLength(List=tween_two_planes)  # disabled
amplitude_4 = Amplitude(Vector=deconstruct_plane_4.ZAxis, Amplitude=50)  # disabled
panel_5 = Panel(list_length_5)  # disabled
vector_display_4 = VectorDisplay(Anchor=deconstruct_plane_4.Origin, Vector=amplitude_4)  # disabled
plane_7 = Plane(tween_two_planes)  # disabled

plane_3pt_4 = Plane3Pt(PointA=curve_middle_3, PointB=end_points.Start, PointC=unflatten_tree)  # -> flatten(Plane); disabled
rotate_plane_by_axis_4 = RotatePlaneByAxis(Plane=plane_3pt_4, Axis="x", Angle=90)  # disabled

flip_plane_4 = FlipPlane(Plane=rotate_plane_by_axis_4, ReverseX=False, ReverseY=False, SwapAxes=True)  # disabled

plane_8 = Plane(flip_plane_4)  # disabled

deconstruct_plane_5 = DeconstructPlane(Plane=plane_8)  # -> Origin, XAxis, YAxis, ZAxis; disabled
move_3 = Move(Geometry=deconstruct_plane_5.Origin, Motion=deconstruct_plane_5.ZAxis)  # -> Geometry, Transform; disabled

deconstruct_plane_6 = DeconstructPlane(Plane=plane_8)  # -> Origin, XAxis, YAxis, ZAxis; disabled
amplitude_5 = Amplitude(Vector=deconstruct_plane_6.ZAxis, Amplitude=50)  # disabled
vector_display_5 = VectorDisplay(Anchor=deconstruct_plane_6.Origin, Vector=amplitude_5)  # disabled
plane_9 = Plane(plane_8)  # disabled

# ----
# if z axis is pointing down
deconstruct_2 = Deconstruct(Point=deconstruct_plane_5.Origin)  # -> XComponent, YComponent, ZComponent; disabled
deconstruct_3 = Deconstruct(Point=move_3.Geometry)  # -> XComponent, YComponent, ZComponent; disabled
smaller_than = SmallerThan(FirstNumber=deconstruct_2.ZComponent, SecondNumber=deconstruct_3.ZComponent)  # -> SmallerThan, OrEqualTo; disabled
split_list_2 = SplitList(Index=smaller_than.SmallerThan)  # -> ListA, ListB; disabled
dispatch = Dispatch(List=plane_8, DispatchPattern=smaller_than.SmallerThan)  # -> ListA, ListB; disabled
panel_6 = Panel(smaller_than.SmallerThan)  # disabled
flatten_tree_3 = FlattenTree(Tree=dispatch.ListA, Path="{0}")  # disabled
flatten_tree_4 = FlattenTree(Tree=dispatch.ListB, Path="{0}")  # disabled
