# Grasshopper definition script frames robot 7.gh (Grasshopper 1.0.8)
# plug-ins: RhinoCodePluginGH, Pufferfish, Human

# ----
# Input
panel = Panel("Structure::Rigid")
dynamic_geometry_pipeline = DynamicGeometryPipeline(
    LayerFilter="Structure::Lines",
    TypeFilter="Curve",
    NameFilter="*",
    GroupByLayer=False,
    GroupByType=False,
    IncludeHidden=True,
    IncludeLocked=True,
    enableFullPath=True,
    listenToAttributes=True)
dynamic_geometry_pipeline_2 = DynamicGeometryPipeline(
    LayerFilter=panel,
    TypeFilter="Point",
    NameFilter="*",
    GroupByLayer=False,
    GroupByType=False,
    IncludeHidden=True,
    IncludeLocked=True,
    enableFullPath=True,
    listenToAttributes=True)
dynamic_geometry_pipeline_3 = DynamicGeometryPipeline(
    LayerFilter="Structure::Start",
    TypeFilter="Point",
    NameFilter="*",
    GroupByLayer=False,
    GroupByType=False,
    IncludeHidden=True,
    IncludeLocked=True,
    enableFullPath=True,
    listenToAttributes=True)

py3 = Python3Script(
    in_lines=dynamic_geometry_pipeline,
    in_rigid_points=dynamic_geometry_pipeline_2,
    in_start_point=dynamic_geometry_pipeline_3)  # -> out, assembly_steps, ordered_nodes; inputs in_lines: list of Line, in_rigid_points: list of Point3d, in_start_point: Point3d
# ---------- py3: Python ----------
import rhinoscriptsyntax as rs
import Grasshopper as gh
import Grasshopper.Kernel as ghk
from Grasshopper.Kernel.Data import GH_Path
import Rhino.Geometry as rg
import networkx as nx
from collections import Counter
import math
import numpy as np
import itertools
from itertools import combinations

class Trussemble:
    def __init__(self, lines, rigid_points, start_point):
        ## inputs
        self.lines = lines
        self.points, self.connection_tree = self.__get_line_connectivity(in_lines)
        self.rigid_points = rigid_points
        self.rigid_indices = self.__get_rigid_point_indices()
        self.start_point = start_point
        ## outputs
        self.graph = self.__turn_tree_to_graph(self.connection_tree)
        self.assembly_steps = gh.DataTree[object]()
        self.processed_nodes = []
    
    def __average_point(self, pt1, pt2, pt3):
            # Calculate the average of the x, y, and z coordinates
            avg_x = (pt1.X + pt2.X + pt3.X) / 3
            avg_y = (pt1.Y + pt2.Y + pt3.Y) / 3
            avg_z = (pt1.Z + pt2.Z + pt3.Z) / 3
            
            # Return the average point as a Point3d
            return rg.Point3d(avg_x, avg_y, avg_z)

    def __get_rigid_point_indices(self):
        rigid_indices = []
        for rigid_point in self.rigid_points:
            min_distance = float('inf')
            rigid_idx = None

            if rigid_point in self.points:
                rigid_indices.append(self.points.index(rigid_point))
            else:
                for i, point in enumerate(self.points):
                    distance = rs.Distance(point,rigid_point)
                    if distance < min_distance:
                        min_distance = distance
                        rigid_idx = i
                        
                rigid_indices.append(rigid_idx)
                    
        return rigid_indices

    def __get_line_connectivity(self, lines):
        """
        Create a connectivity tree from a set of lines and return unique points as Point3d and 
        a Grasshopper data structure containing the connectivity information.

        lines: A list of line objects in Rhino.

        Returns a tuple containing a list of unique Point3d and a GH_Structure for connectivity.
        """
        connectivity_tree = gh.DataTree[object]()
        unique_points = {}  # Use a dictionary to map points to their indices

        # Iterate through each line
        for line_index, line in enumerate(lines):
            # Get the start and end points of the line
            start_point = line.From
            end_point = line.To
            
            # Convert to Point3d objects
            start_point3d = rg.Point3d(start_point.X, start_point.Y, start_point.Z)
            end_point3d = rg.Point3d(end_point.X, end_point.Y, end_point.Z)

            # Add points to the unique points dictionary if they don't already exist
            if start_point3d not in unique_points:
                unique_points[start_point3d] = len(unique_points)
            if end_point3d not in unique_points:
                unique_points[end_point3d] = len(unique_points)
            
            # Get the indices of the start and end points
            start_index = unique_points[start_point3d]
            end_index = unique_points[end_point3d]

            # Append the indices to the connectivity tree
            connectivity_tree.EnsurePath(GH_Path(line_index))  # Create a new branch for the line index
            connectivity_tree.AddRange([start_index, end_index], GH_Path(line_index))

        # Convert unique points to a list of Point3d
        unique_points_list = list(unique_points.keys())

        return unique_points_list, connectivity_tree

    def __can_point_be_rigid(self, node):
        graph = self.graph
        neighbours = list(graph.neighbors(node))
        count = 0
        for neighbour in neighbours:
            if neighbour in self.processed_nodes:
                count += 1

        return count >= 3

    def __turn_tree_to_graph(self, connections_tree):
        ## turns connections tree input into networkx graph, connections should be implemented in python (ideally) without use of heteroptera or proximity 2-d
        list_of_tuples = []

        for i in range(connections_tree.BranchCount):
            branch = connections_tree.Branch(i) 
            
            if len(branch) == 2:
                list_of_tuples.append(tuple(branch))
        
        G = nx.Graph()
        G.add_edges_from(list_of_tuples)
        return G

    def __get_first_move(self): 
        start_point = self.start_point
        rigid_ids = self.rigid_indices
        points = self.points
        graph = self.graph

        min_avg_distance_to_start = float('inf')
        neighbours_to_connect_to = []
        first_supports = None

        def find_common_neighbour_combinations(graph, rigid_points_indices):
            valid_combinations = []
            common_neighbors = []
            
            # Generate all combinations of three nodes from rigid_points
            for comb in combinations(rigid_points_indices, 3):
                # Get neighbors for each node in the combination
                neighbors_1 = set(graph.neighbors(comb[0]))
                neighbors_2 = set(graph.neighbors(comb[1]))
                neighbors_3 = set(graph.neighbors(comb[2]))
                
                # Find common neighbors
                common_neighbor = neighbors_1 & neighbors_2 & neighbors_3
                
                # If there is at least one common neighbor, add the combination to the result
                if common_neighbor:
                    valid_combinations.append(comb)
                    common_neighbors.append(list(common_neighbor)[0])

            return valid_combinations, common_neighbors
                
        starting_three_candidates, common_neighbours = find_common_neighbour_combinations(graph, rigid_ids)

        for i, starting_three in enumerate(starting_three_candidates):
            p1 = points[starting_three[0]]
            p2 = points[starting_three[1]]
            p3 = points[starting_three[2]]

            centre = self.__average_point(p1, p2, p3)

            avg_distance = rs.Distance(start_point, centre)
            if avg_distance < min_avg_distance_to_start:
                min_avg_distance_to_start = avg_distance
                first_supports = starting_three
                neighbours_to_connect_to.append(list([common_neighbours[i]]))

        neighbour_to_connect_to = neighbours_to_connect_to[-1][0]

        self.processed_nodes.extend(first_supports)
        self.processed_nodes.append(neighbour_to_connect_to)
        return list(first_supports), neighbour_to_connect_to

    def __check_edges(self, sub_graph_edges):
        graph = self.graph
        edges_to_add = []

        for node1, node2 in combinations(sub_graph_edges, 2):
            if graph.has_edge(node1, node2):
                edges_to_add.append((node1, node2))

        return edges_to_add

    def __find_unprocessed_neighbors_subgraphs(self):
        graph = self.graph
        processed_nodes = self.processed_nodes
        processed_nodes_set = set(processed_nodes)
        
        # Step 1: Find neighbors of the processed nodes that are not yet processed
        unprocessed_neighbors = set()

        # Get the last processed node and find its neighbors first
        last_node = processed_nodes[-1]
        neighbors_last_node = set(graph.neighbors(last_node))
        unprocessed_neighbors_last_node = neighbors_last_node - processed_nodes_set

        # Find unprocessed neighbors of all other nodes
        for node in processed_nodes_set:
            if node == last_node:
                continue  # Skip the last node as we already processed it
            neighbors = set(graph.neighbors(node))
            unprocessed_neighbors.update(neighbors - processed_nodes_set)

        # Add unprocessed neighbors of the last node to the main unprocessed set
        unprocessed_neighbors.update(unprocessed_neighbors_last_node)

        # Step 2: Create subgraphs by finding connected components
        subgraphs = []
        
        # Subgraph that includes only unprocessed neighbors
        unprocessed_subgraph = graph.subgraph(unprocessed_neighbors)
        
        # Find connected components in the unprocessed subgraph
        for component in nx.connected_components(unprocessed_subgraph):
            subgraphs.append(list(component))
        
        # Step 3: Ensure the subgraph connected to the last node in processed_nodes comes first
        subgraphs_sorted = []
        
        # Subgraph connected to the last processed node
        subgraph_last_node = [comp for comp in subgraphs if any(node in unprocessed_neighbors_last_node for node in comp)]
        
        # Remaining subgraphs (not connected to the last node)
        other_subgraphs = [comp for comp in subgraphs if comp not in subgraph_last_node]
        
        # Sort the final output
        if subgraph_last_node:
            subgraphs_sorted.extend(subgraph_last_node)
        
        subgraphs_sorted.extend(other_subgraphs)

        # Return the sorted subgraphs as a nested list
        return subgraphs_sorted

    def __find_connections(self, node):
        graph = self.graph
        can_connect_to = []
        neighbours = graph.neighbors(node)
        for neighbour in neighbours:
            if neighbour in self.processed_nodes:
                can_connect_to.append(neighbour)
        
        return can_connect_to

    def __distance(self, point1, point2):
        return np.linalg.norm(np.array(point1) - np.array(point2))

    def __sort_rigid_candidates(self, candidates):
        origin = self.processed_nodes[-1]
        points = self.points

        sorted_candidates = []
        remaining_candidates = candidates.copy()
        
        # Find the closest point to the origin first
        current_point = min(remaining_candidates, key=lambda c: rs.Distance(points[origin], points[c]))
        sorted_candidates.append(current_point)
        remaining_candidates.remove(current_point)
        
        # Iteratively find the closest point to the last point in sorted_points
        while remaining_candidates:
            current_point = min(remaining_candidates, key=lambda c: rs.Distance(points[sorted_candidates[-1]], points[c]))
            sorted_candidates.append(current_point)
            remaining_candidates.remove(current_point)
        
        return sorted_candidates

    def __get_sorted_supports(self, candidate, supports):
        support_combinations = list(itertools.combinations([x for x in range(len(supports))], 3))
        score_per_combination = {}
        result_supports = []

        def get_combined_distance_to_supports(supports):
            combined_distance = 1.0

            for i in supports:
                for j in supports:
                    if i != j:
                        combined_distance *= rs.Distance(i,j)    
            return combined_distance

        def triangle_area(rs_pointA, rs_pointB, rs_pointC):

            pointA = [rs_pointA.X, rs_pointA.Y, rs_pointA.Z]
            pointB = [rs_pointB.X, rs_pointB.Y, rs_pointB.Z]
            pointC = [rs_pointC.X, rs_pointC.Y, rs_pointC.Z]

            A = np.array(pointA)
            B = np.array(pointB)
            C = np.array(pointC)

            AB = B - A
            AC = C - A

            cross_product = np.cross(AB, AC)

            area = np.linalg.norm(cross_product) / 2

            return area

        for c in support_combinations:
            supports_list = [supports[c[0]], supports[c[1]], supports[c[2]]]

            combined_distance = float(get_combined_distance_to_supports(supports_list))
            area = float(triangle_area(supports_list[0], supports_list[1], supports_list[2]))
            score = combined_distance * (1.0 / area)
            score_per_combination[c] = score
        
        score_per_combination = dict(sorted(score_per_combination.items(), key=lambda item: item[1]))

        support_combinations = list(score_per_combination.keys())
        for support_combination in support_combinations:
            result_support = list(support_combination)
            for i, support in enumerate(supports):

                if i not in support_combination:
                    result_support.append(i)

                result_supports.append(result_support)
        
        return result_supports[0]

    def __check_if_door(self, support_nodes, load_node):
        support_points = [self.points[x] for x in support_nodes]
        load_point = self.points[load_node]
        combination = []

        def point_plane_distance(plane_pts, test_pt):
            # Extract points A, B, C from plane_pts
            A, B, C = plane_pts
            
            # Create two vectors from the points on the plane
            AB = B - A
            AC = C - A
            
            # Calculate the normal vector to the plane using the cross product
            normal_vector = np.cross(AB, AC)
            
            # Plane equation coefficients: Ax + By + Cz + D = 0
            A_coeff, B_coeff, C_coeff = normal_vector
            D_coeff = -np.dot(normal_vector, A)  # D = -(Ax + By + Cz) at point A
            
            # Coordinates of the test point
            x1, y1, z1 = test_pt
            
            # Calculate the distance from the point to the plane
            numerator = abs(A_coeff * x1 + B_coeff * y1 + C_coeff * z1 + D_coeff)
            denominator = np.linalg.norm(normal_vector)
            
            # Distance formula
            distance = numerator / denominator
            return distance

        def rhino_points_to_numpy(rhino_points):
            # Convert a list of Rhino Point3d objects to a 2D NumPy array
            return np.array([[pt.X, pt.Y, pt.Z] for pt in rhino_points])

        def distance_to_centroid(pts, test_pt):
            # Compute the centroid by averaging the x, y, z coordinates of the three points
            centroid = np.mean(pts, axis=0)
            
            # Compute the Euclidean distance between the test point and the centroid
            distance = np.linalg.norm(test_pt - centroid)
            
            return distance

        def is_door(three_supports, load_point, span_height_ratio = 0.25):
            support_pts = rhino_points_to_numpy(three_supports)
            load_pt = np.array([load_point.X, load_point.Y, load_point.Z])

            plane_pts = [support_pts[0], support_pts[1], load_pt]
            test_pt = support_pts[2]

            distance = point_plane_distance(plane_pts, test_pt)
            effective_span = distance_to_centroid(support_pts, load_pt)

            if distance <= (effective_span * span_height_ratio):
                return True
            else:
                return False

        first_three = support_points[:3]
        if not is_door(first_three, load_point):
            return support_points
        else:
            for comb in combinations(support_points, 3):
                if not is_door(list(comb), load_point):
                    combination.extend(list(comb))
                    missing = [x for x in support_points if x not in list(comb)]
                    if missing:
                        combination.extend(missing)
                    return combination
            return True

    def assemble(self):
        graph = self.graph
        points = self.points
        assembly_steps = self.assembly_steps

        while True:
            if len(self.processed_nodes) == 0:
                first_supports, first_neighbours = self.__get_first_move()
                first_neighbour = first_neighbours
                lines_to_add = []

                for support in first_supports:
                    p1 = points[support]
                    p2 = points[first_neighbour]

                    line = rs.AddLine(p1, p2)
                    lines_to_add.append(line)
                
                missing_edges = self.__check_edges(first_supports)
                for missing_edge in missing_edges:
                    p1 = points[missing_edge[0]]
                    p2 = points[missing_edge[1]]

                    line = rs.AddLine(p1,p2)
                    lines_to_add.append(line)

                path = GH_Path(0)
                assembly_steps.AddRange(lines_to_add, path)

            elif len(self.processed_nodes) < len(points):
                non_rigid_candidates = self.__find_unprocessed_neighbors_subgraphs()[0]
                rigid_candidates = [candidate for candidate in non_rigid_candidates if self.__can_point_be_rigid(candidate)]
                sorted_rigid_candidates = self.__sort_rigid_candidates(rigid_candidates)

                for candidate in sorted_rigid_candidates:
                    lines_to_add = []
                    nodes_to_connect_to = self.__find_connections(candidate)
                    nodes_sorted_indices = self.__get_sorted_supports(points[candidate], [points[x] for x in nodes_to_connect_to])
                    sorted_support_nodes = [nodes_to_connect_to[x] for x in nodes_sorted_indices]

                    ## check if it is door
                    if self.__check_if_door(sorted_support_nodes, candidate) == True:

                        ## if it is and cant be resolved, continue to next candidate
                        continue
                    else:

                        ## if it can be resolved return the ordered supports
                        sorted_support_points = self.__check_if_door(sorted_support_nodes, candidate)

                    for point in sorted_support_points:
                        line = rs.AddLine(points[candidate], point)
                        lines_to_add.append(line)
                        
                    self.processed_nodes.append(candidate)
                    path = GH_Path(assembly_steps.BranchCount)
                    assembly_steps.AddRange(lines_to_add, path)
            else:
                return assembly_steps



my_truss = Trussemble(in_lines, in_rigid_points, in_start_point)
assembly_steps = my_truss.assemble()
processed_nodes = my_truss.processed_nodes
nodes = my_truss.points
processed_points = nodes
ordered_nodes = processed_points
# ---------- end py3 ----------
partition_list = PartitionList(List=py3.assembly_steps, Size="3")

# ----
# select group
number_slider = Slider(9, range=0..20)
construct_domain = ConstructDomain(DomainStart=0, DomainEnd=number_slider)
range = Range(Domain=construct_domain, Steps=number_slider)  # -> flatten(Range)

concatenate = Concatenate(Fragment_A="{", Fragment_B=range, A=";*}")

split_tree = SplitTree(Data=partition_list, Masks=flatten(concatenate))  # -> Positive, Negative
curve_middle = CurveMiddle(Curve=split_tree.Positive)
line = Line(split_tree.Positive)

# ----
# script v3
xy_plane = XYPlane(Origin=Point(500, 500, 0))
xy_plane_2 = XYPlane(Origin=Point(0, 0, 0))
panel_2 = Panel("waiting")
panel_3 = Panel("pause")
null_placeholder = NullPlaceholder()
python_3_script = Python3Script(
    LinesTree=line,
    pick_up_plane_A=xy_plane_2,
    pick_up_plane_B=xy_plane,
    waiting_command=null_placeholder,
    pause_command=null_placeholder)  # -> out, RobotA_Command, RobotB_Command, RobotA_Status, RobotB_Status; inputs LinesTree: tree of Line
# ---------- python_3_script: Python ----------
import Rhino.Geometry as rg
from Grasshopper import DataTree
from Grasshopper.Kernel.Data import GH_Path

# Inputs:
# LinesTree - DataTree of Line objects
# pick_up_plane_A - pick up plane for Robot A (input parameter)
# pick_up_plane_B - pick up plane for Robot B (input parameter)
# pause_command - command for pauses (input parameter)
# waiting_command - command when waiting for other robot (input parameter)

# Initialize output data trees
robotA_commands = DataTree[object]()
robotB_commands = DataTree[object]()
robotA_status = DataTree[str]()
robotB_status = DataTree[str]()

# Collect all heights to determine the middle height of the truss
heights = []
for branch in LinesTree.Branches:
    for line in branch:
        start_pt = line.From
        end_pt = line.To
        avg_height = (start_pt.Z + end_pt.Z) / 2.0
        heights.append(avg_height)

min_height = min(heights)
max_height = max(heights)
middle_height = (min_height + max_height) / 2.0

# Process each branch
for b, branch in enumerate(LinesTree.Branches):
    path = LinesTree.Paths[b]
    # Identify if subbranch is {-;0} or {-;1}
    if path.Indices[-1] == 0:
        # Subbranch {-;0} - special processing
        edges = branch
        if len(edges) != 3:
            # Handle the case where there are not exactly 3 edges
            # For simplicity, assume there are 3 edges
            pass
        else:
            edge1, edge2, edge3 = edges[0], edges[1], edges[2]
            steps = []
            
            # Step 1: Robot A moves to pick up
            step = {'RobotA': {'status': 'Move to pick up', 'command': pick_up_plane_A},
                    'RobotB': {'status': 'Waiting for other robot', 'command': waiting_command}}
            steps.append(step)
            
            # Step 2: Robot A closes gripper
            step = {'RobotA': {'status': 'Close gripper', 'command': 'gripper = 1'},
                    'RobotB': {'status': steps[-1]['RobotB']['status'], 'command': steps[-1]['RobotB']['command']}}
            steps.append(step)
            
            # Step 3: Robot A moves to target (edge1)
            step = {'RobotA': {'status': 'Move to target 1', 'command': edge1},
                    'RobotB': {'status': 'Waiting for other robot', 'command': waiting_command}}
            steps.append(step)
            
            # Step 4: Robot B moves to pick up
            step = {'RobotA': {'status': 'Waiting for other robot', 'command': waiting_command},
                    'RobotB': {'status': 'Move to pick up', 'command': pick_up_plane_B}}
            steps.append(step)
            
            # Step 5: Robot B closes gripper
            step = {'RobotA': {'status': steps[-1]['RobotA']['status'], 'command': steps[-1]['RobotA']['command']},
                    'RobotB': {'status': 'Close gripper', 'command': 'gripper = 1'}}
            steps.append(step)
            
            # Step 6: Robot B moves to target (edge2)
            step = {'RobotA': {'status': 'Waiting for other robot', 'command': waiting_command},
                    'RobotB': {'status': 'Move to target 2', 'command': edge2}}
            steps.append(step)
            
            # Step 7: Both robots pause for connection
            step = {'RobotA': {'status': 'Pause for connection', 'command': pause_command},
                    'RobotB': {'status': 'Pause for connection', 'command': pause_command}}
            steps.append(step)
            
            # Step 8: Robot A opens gripper
            step = {'RobotA': {'status': 'Open gripper', 'command': 'gripper = 0'},
                    'RobotB': {'status': steps[-1]['RobotB']['status'], 'command': steps[-1]['RobotB']['command']}}
            steps.append(step)
            
            # Step 9: Robot A moves to pick up
            step = {'RobotA': {'status': 'Move to pick up', 'command': pick_up_plane_A},
                    'RobotB': {'status': 'Waiting for other robot', 'command': waiting_command}}
            steps.append(step)
            
            # Step 10: Robot A closes gripper
            step = {'RobotA': {'status': 'Close gripper', 'command': 'gripper = 1'},
                    'RobotB': {'status': steps[-1]['RobotB']['status'], 'command': steps[-1]['RobotB']['command']}}
            steps.append(step)
            
            # Step 11: Robot A moves to target (edge3)
            step = {'RobotA': {'status': 'Move to target 3', 'command': edge3},
                    'RobotB': {'status': 'Waiting for other robot', 'command': waiting_command}}
            steps.append(step)
            
            # Step 12: Both robots pause for connection
            step = {'RobotA': {'status': 'Pause for connection', 'command': pause_command},
                    'RobotB': {'status': 'Pause for connection', 'command': pause_command}}
            steps.append(step)
            
            # Step 13: Both robots open gripper
            step = {'RobotA': {'status': 'Open gripper', 'command': 'gripper = 0'},
                    'RobotB': {'status': 'Open gripper', 'command': 'gripper = 0'}}
            steps.append(step)
            
            # Add the steps to the output data trees
            for step in steps:
                robotA_commands.Add(step['RobotA']['command'], path)
                robotA_status.Add(step['RobotA']['status'], path)
                robotB_commands.Add(step['RobotB']['command'], path)
                robotB_status.Add(step['RobotB']['status'], path)
    else:
        # Subbranch {-;1} - process edges assigned to robots, repeating the pattern
        edges = branch
        line_heights = []
        for line in edges:
            start_pt = line.From
            end_pt = line.To
            avg_height = (start_pt.Z + end_pt.Z) / 2.0
            line_heights.append((line, avg_height))
        
        # Sort edges based on their distance from middle height
        line_heights_sorted = sorted(line_heights, key=lambda x: abs(x[1] - middle_height))
        
        # Assign edges to robots based on average height
        robotA_edges = []
        robotB_edges = []
        for line, avg_height in line_heights_sorted:
            if avg_height <= middle_height:
                robotA_edges.append(line)
            else:
                robotB_edges.append(line)
        
        steps = []
        i = 0  # index for Robot A's edges
        j = 0  # index for Robot B's edges
        edge_counter_A = 1
        edge_counter_B = 1
        while i < len(robotA_edges) or j < len(robotB_edges):
            if i < len(robotA_edges):
                # Robot A processes an edge
                # Step: Robot A moves to pick up
                step = {'RobotA': {'status': 'Move to pick up', 'command': pick_up_plane_A},
                        'RobotB': {'status': 'Waiting for other robot', 'command': waiting_command}}
                steps.append(step)
                
                # Step: Robot A closes gripper
                step = {'RobotA': {'status': 'Close gripper', 'command': 'gripper = 1'},
                        'RobotB': {'status': steps[-1]['RobotB']['status'], 'command': steps[-1]['RobotB']['command']}}
                steps.append(step)
                
                # Step: Robot A moves to target
                step = {'RobotA': {'status': f'Move to target {edge_counter_A}', 'command': robotA_edges[i]},
                        'RobotB': {'status': 'Waiting for other robot', 'command': waiting_command}}
                steps.append(step)
                
                # Step: Pause for connection
                step = {'RobotA': {'status': 'Pause for connection', 'command': pause_command},
                        'RobotB': {'status': 'Pause for connection', 'command': pause_command}}
                steps.append(step)
                
                # Step: Robot A opens gripper
                step = {'RobotA': {'status': 'Open gripper', 'command': 'gripper = 0'},
                        'RobotB': {'status': steps[-1]['RobotB']['status'], 'command': steps[-1]['RobotB']['command']}}
                steps.append(step)
                
                i += 1
                edge_counter_A += 1
                
            if j < len(robotB_edges):
                # Robot B processes an edge
                # Step: Robot B moves to pick up
                step = {'RobotA': {'status': 'Waiting for other robot', 'command': waiting_command},
                        'RobotB': {'status': 'Move to pick up', 'command': pick_up_plane_B}}
                steps.append(step)
                
                # Step: Robot B closes gripper
                step = {'RobotA': {'status': steps[-1]['RobotA']['status'], 'command': steps[-1]['RobotA']['command']},
                        'RobotB': {'status': 'Close gripper', 'command': 'gripper = 1'}}
                steps.append(step)
                
                # Step: Robot B moves to target
                step = {'RobotA': {'status': 'Waiting for other robot', 'command': waiting_command},
                        'RobotB': {'status': f'Move to target {edge_counter_B}', 'command': robotB_edges[j]}}
                steps.append(step)
                
                # Step: Pause for connection
                step = {'RobotA': {'status': 'Pause for connection', 'command': pause_command},
                        'RobotB': {'status': 'Pause for connection', 'command': pause_command}}
                steps.append(step)
                
                # Step: Robot B opens gripper
                step = {'RobotA': {'status': steps[-1]['RobotA']['status'], 'command': steps[-1]['RobotA']['command']},
                        'RobotB': {'status': 'Open gripper', 'command': 'gripper = 0'}}
                steps.append(step)
                
                j += 1
                edge_counter_B += 1
                
        # Remove unnecessary double pauses
        optimized_steps = []
        prev_step = None
        for step in steps:
            if prev_step:
                if (prev_step['RobotA']['status'] == 'Pause for connection' and
                    step['RobotA']['status'] == 'Pause for connection'):
                    # Skip this step
                    continue
            optimized_steps.append(step)
            prev_step = step
            
        # Add the steps to the output data trees
        for step in optimized_steps:
            robotA_commands.Add(step['RobotA']['command'], path)
            robotA_status.Add(step['RobotA']['status'], path)
            robotB_commands.Add(step['RobotB']['command'], path)
            robotB_status.Add(step['RobotB']['status'], path)
    
# Set the outputs
RobotA_Command = robotA_commands
RobotB_Command = robotB_commands
RobotA_Status = robotA_status
RobotB_Status = robotB_status
# ---------- end python_3_script ----------

# ----
# Robot_B
# Robot_A
# Command
# Status
# Status
# Command
panel_4 = Panel(python_3_script.RobotA_Command)
panel_5 = Panel(python_3_script.RobotA_Status)
panel_6 = Panel(python_3_script.RobotB_Command)
panel_7 = Panel(python_3_script.RobotB_Status)
